# Grasshopper definition DFLUR5_DR1_T32024.gh (Grasshopper 1.0.8)
# plug-ins: Robots, Pufferfish, Human, Bifocals

# ---- group: Set Up Pen / Tool
tip_dia_mm = Panel("0.3")
name_of_pen = Panel("DR_Basic")
pen_length = Slider(107, range=1..250)
pen_dia = Slider(7.5, range=6..16)
speed = Slider(100, range=1..100)
nib_height = Panel("1")
preview_colour = ColourSwatch(SwatchColor=RGB(255, 0, 254))
pen_weight_kg = Panel(".01")

# ---- group: Section / Functional Group
# info: Written by Richard Blackwell and Charlotte firth for the Design Futures Lab and BENV10020202
# Template Elements
# Instructions for UR operator: Please ensure you Pen and paper is Correctly loaded, that DFL staff have set up the Robot, and that you have reviewed the simulation in Grasshopper or on the SmartPad
steps = Panel("""STEPS
STEP""")

# ---- group: Set Up Pen / Tool
hatch_angle = Slider(-60, range=-90..90)
pen_pressure = Slider(0.5, range=0..8)
line_gap = Slider(0.3, range=0..10)
retract_height = Slider(4, range=0..8)

dfl_custom_pen = DFLCustomPen(
    d1=name_of_pen,
    preview_colour=preview_colour,
    length=pen_length,
    dia=pen_dia,
    weight=pen_weight_kg,
    tip_dia=tip_dia_mm,
    speed=speed,
    nib_height=nib_height,
    hatch_angle=hatch_angle,
    hatch_frequency=line_gap,
    pressure=pen_pressure,
    retract_height=retract_height)

# ----
tool_data_idex = Panel(dfl_custom_pen)

controlled_speed = ListItem(List=dfl_custom_pen, Index=1, Wrap=True)
pen_name = ListItem(List=dfl_custom_pen, Index=0, Wrap=True)
tcp = ListItem(List=dfl_custom_pen, Index=5, Wrap=True)
pen_weight = ListItem(List=dfl_custom_pen, Index=2, Wrap=True)
tool_mesh = ListItem(List=dfl_custom_pen, Index=6, Wrap=True)

# ---- group: Robot Setup + initial pose
inital_pose_axis_values_in_degrees = Panel("""0
-50
-80
-90
90
0""")
# Robot Setup
list = RobotsLibrary(
    {"DFL - UR5", "DFL- UR5 + Turntable", "DFL - KR70", "UR3e", "UR5e", "UR10e", "UR16e", "UR3", "UR5", "UR10"}, selected="UR5",
    Type=0)
loadrobot = LoadRobotSystem(Name=list, Base=PlaneXY(0, 0, 0))
degrees_to_radians = DegreesToRadians(Degrees=inital_pose_axis_values_in_degrees, RobotSystem=loadrobot, MechanicalGroup=0)

transfer_speed = Slider(100, range=1..100)
zone_accuracy = Slider(0.01, range=0..1)

# ----
create_tool = CreateTool(Name=flatten(pen_name), TCP=flatten(tcp), Weight=flatten(pen_weight), Mesh=flatten(tool_mesh))  # -> Tool, TCP
tool_centre_point = Panel(create_tool.TCP)

robot_placement = ValueList({"Cart": 0, "Table": 1}, selected="Cart")
fixture_in_use = ValueList({"Custom Fixture": 0, "Draw Table": 1, "Turn Table": 2}, selected="Draw Table")
adaptor_distance_from_table_edge = Slider(162, range=0..600)

# ----
# DFL Draw a 4 Colour Drawing from Adobe Illustrator
# Grasshopper Instrucitons: Import your Drawing
# File as a .ai File
# Select Render Hashes upon import
# Position Art Where you can see it in the XY plane
# Click Data Dam to Generate Toolpath
# View/Test Simulation
# Adjust 'Pen Tilt' to avoid Singularities
# Set File Path for USB Drive
# Name Project
# Click Save Button
# Eject Drive Safely and Load onto Robot
# Click File Load Program
# Select Most Current .URP file on USB drive
instructions_for_ur_operator = Panel("Please ensure you Pen and paper is Correctly loaded, that DFL staff have set up the Robot, and that you have reviewed the simulation in Grasshopper or on the SmartPad")

custom_z_offset = Slider(0, range=0..50)
custom_x_offset = Slider(356, range=0..800)
dfl_ur_fixutres = DFLURFixutres(A=adaptor_distance_from_table_edge, i_2=robot_placement, d1=custom_z_offset, d2=custom_x_offset, i=fixture_in_use)  # -> adaptorplate_2, G, G_2, i_5, i_6, i_3, i_4
table = CustomPreview(Geometry=dfl_ur_fixutres.G, Material=ColourSwatch(SwatchColor=RGBA(217, 185, 126, 200)))
fixture = CustomPreview(Geometry=[dfl_ur_fixutres.i_3, dfl_ur_fixutres.i_4], Material=ColourSwatch(SwatchColor=RGB(214, 214, 214)))
adaptorandtrack = CustomPreview(Geometry=[dfl_ur_fixutres.adaptorplate_2, dfl_ur_fixutres.G_2], Material=ColourSwatch(SwatchColor=RGB(152, 149, 158)))

width_y = Slider(210, range=0..420)
length_x = Slider(297, range=0..420)
fixtureheight_z = Panel(dfl_ur_fixutres.i_5)
x_distance_from_robot = Panel(dfl_ur_fixutres.i_6)
dfl_paper_setup = DFLPaperSetup(A_2=length_x, A_3=width_y, X=x_distance_from_robot, A=fixtureheight_z)  # -> I_2, I, P

# ---- group: 4 point Calibration
_4_point_calibration_x_y_z = Panel("""662.12,-119.64,3.88
336.37,-119.8,1.97
336.76,120.8,3.13
665.19,122.35,5.14""")
dfl_4_point_calibration = DFL4PointCalibration(L=_4_point_calibration_x_y_z, G=dfl_paper_setup.P)

# ----
ideal_paper_plane = Plane(dfl_paper_setup.P)

layer_name_case_sensitive = Panel("Black")
dfl_simple_drawing_import = DFLSimpleDrawingImport(layer_name=layer_name_case_sensitive, paper_plane=ideal_paper_plane)

calibrated_plane = Plane(dfl_4_point_calibration)
paper_plane = Plane(calibrated_plane)

# ---- group: Create Pressure planes
pen_pressure_2 = ListItem(List=dfl_custom_pen, Index=10, Wrap=True)
multiplication = Multiplication(A=pen_pressure_2, B=-1)
offpln = OffsetPlane(Plane=paper_plane, Distance=multiplication, BothSides=0, OffsetX=False, OffsetY=False, OffsetZ=True)
pen_pressed_plane = Plane(offpln)

# ---- group: Create Transfer Planes
retact_height = ListItem(List=dfl_custom_pen, Index=11, Wrap=True)
offpln_2 = OffsetPlane(Plane=paper_plane, Distance=retact_height, BothSides=0, OffsetX=False, OffsetY=False, OffsetZ=True)
pen_transfer_plane = Plane(offpln_2)

# ---- group: Move Drawing To Paper / Re Calculate
dam = DataDam(DataA=dfl_simple_drawing_import, BufferDelay=2500000, BufferMode=0)

# ---- group: Pen Change
pen_name_2 = ListItem(List=dfl_custom_pen, Index=0, Wrap=True)
concat = Concatenate(
    FragmentA="Insert ",
    FragmentB=pen_name_2,
    FragmentD=" for ",
    FragmentE=layer_name_case_sensitive,
    FragmentC=" layer and click continue to resume")
pen_change_pose_av_degrees = Panel("""24.38
-106.28
-87.02
-168.27
24.22
46.25""")
concat_2 = Concatenate(FragmentB=pen_name, FragmentC="_change")
popup_text = Panel(concat)
popup_title_no_spaces = Panel(concat_2)
degrees_to_radians_2 = DegreesToRadians(Degrees=pen_change_pose_av_degrees, RobotSystem=loadrobot, MechanicalGroup=0)
custom_popup = CustomPopup(N=popup_title_no_spaces, B=popup_text, D=popup_title_no_spaces)
create_target = CreateTarget(
    Joints=degrees_to_radians_2,
    Tool=flatten(create_tool.Tool),
    Speed=transfer_speed,
    Zone=zone_accuracy,
    Command=custom_popup,
    IsCartesian=False)

# ---- group: Startup
popup_title_no_spaces_2 = Panel("Operator_Safety")
popup_text_2 = Panel(instructions_for_ur_operator)
custom_popup_2 = CustomPopup(N=popup_title_no_spaces_2, B=popup_text_2, D=popup_title_no_spaces_2)
create_target_2 = CreateTarget(
    Joints=degrees_to_radians,
    Tool=create_tool.Tool,
    Speed=transfer_speed,
    Zone=zone_accuracy,
    Command=custom_popup_2,
    IsCartesian=False)

# ---- group: Move Drawing To Paper
brec = BoundingRectangle(Geometry=flatten(dam), Plane=PlaneXY(0, 0, 0), Axis=0, Slide=0, Union=True)  # -> Bounding, DimensionX, DimensionY
area = Area(Geometry=brec.Bounding)  # -> Area, Centroid
move2pt = MoveToPoint(Geometry=dam, PointA=area.Centroid, PointB=ideal_paper_plane)  # -> Moved, Vector, Transform
project = Project(Geometry=move2pt.Moved, Plane=pen_pressed_plane)  # -> Geometry, Transform

# ---- group: Job Done
popup_title_no_spaces_3 = Panel("Job_Done")
popup_text_3 = Panel("Job Complete! Please put all the caps back on the pens and tidy up!")
custom_popup_3 = CustomPopup(N=popup_title_no_spaces_3, B=popup_text_3, D=popup_title_no_spaces_3)
create_target_3 = CreateTarget(
    Joints=degrees_to_radians,
    Tool=create_tool.Tool,
    Speed=transfer_speed,
    Zone=zone_accuracy,
    Command=custom_popup_3,
    IsCartesian=False)

# ---- group: Lead In and Out
join = JoinCurves(Curves=project.Geometry, Preserve=False)
opncrv = OpenCurve(Curve=join, Length=0.001, Normalized=False, Seam=0)  # -> Opened, R
end = EndPoints(Curve=opncrv.Opened)  # -> Start, End
project_2 = Project(Geometry=end.Start, Plane=pen_transfer_plane)  # -> Geometry, Transform
project_3 = Project(Geometry=end.End, Plane=pen_transfer_plane)  # -> Geometry, Transform
ln = Line(StartPoint=project_3.Geometry, EndPoint=end.End)
ln_2 = Line(StartPoint=project_2.Geometry, EndPoint=end.Start)
weave = Weave(Pattern=[0, 1, 2], Stream0=ln_2, Stream1=opncrv.Opened, Stream2=ln, NullGaps=False)
join_2 = JoinCurves(Curves=weave, Preserve=False)  # -> simplify(Curves)

# ---- group: Divide (Polyline)
topoly = CurveToPolyline(Curve=join_2, ToleranceDistance=Slider(0.01, range=0..10), ToleranceAngle=0)  # -> Polyline, Segments
cp = ControlPoints(Curve=topoly.Polyline)  # -> simplify(Points), Weights, Knots
pl_origin = PlaneOrigin(Base=ideal_paper_plane, Origin=cp.Points)  # -> simplify(Plane)

# ---- group: Reorient Planes
deplane = DeconstructPlane(Plane=pl_origin)  # -> Origin, XAxis, YAxis, ZAxis
amp = Amplitude(Vector=deplane.YAxis, Amplitude="20")
pen_tilt = Slider(0, range=0..45)
move = Move(Geometry=deplane.Origin, Motion=amp)  # -> Geometry, Transform
list_2 = ValueList({"0 deg": 0, "90 deg": 90, "180 deg": 180, "270 deg": 270, "360 deg": 360}, selected="180 deg")
ln_3 = Line(StartPoint=deplane.Origin, EndPoint=move.Geometry)
addition = Addition(A=pen_tilt, B=list_2)
rotax = RotateAxis(Geometry=pl_origin, Angle=degrees(addition), Axis=ln_3)  # -> Geometry, Transform

# ---- group: Reorient Planes X
deplane_2 = DeconstructPlane(Plane=rotax.Geometry)  # -> Origin, XAxis, YAxis, ZAxis
amp_2 = Amplitude(Vector=deplane_2.ZAxis, Amplitude="20")
pen_tilt_2 = Slider(0, range=0..45)
move_2 = Move(Geometry=deplane_2.Origin, Motion=amp_2)  # -> Geometry, Transform
list_3 = ValueList({"0 deg": 0, "90 deg": 90, "180 deg": 180, "270 deg": 270, "360 deg": 360}, selected="360 deg")
ln_4 = Line(StartPoint=deplane_2.Origin, EndPoint=move_2.Geometry)
addition_2 = Addition(A=pen_tilt_2, B=list_3)
rotax_2 = RotateAxis(Geometry=rotax.Geometry, Angle=degrees(addition_2), Axis=ln_4)  # -> Geometry, Transform

# ----
pln = Plane(rotax_2.Geometry)

# ---- group: Make Linear Movements
controlled_speed_2 = Panel(controlled_speed)
list_4 = ValueList({"Joint", "Linear"}, selected="Linear")
create_target_4 = CreateTarget(Plane=pln, Motion=list_4, Tool=graft(create_tool.Tool), Speed=controlled_speed_2, Zone=zone_accuracy, IsCartesian=True)

# ---- group: Order Toolpaths
merge = Merge(Data1=create_target_2, Data2=create_target, Data3=flatten(create_target_4), Data4=create_target_3)  # -> flatten(Result)

# ---- group: Save URP / Program Name
panel = Panel("Done")

# ---- group: Save a Backup of your script
select_backup_directory = FilePath("/Users/z3528358/Documents/GitHub/DR/Script Archive/")
backup = Panel(select_backup_directory)

# ---- group: Drawing Preview
move2pt_2 = MoveToPoint(Geometry=dam, PointA=area.Centroid, PointB=paper_plane)  # -> Moved, Vector, Transform
tool_preview_colour = ListItem(List=dfl_custom_pen, Index=4, Wrap=True)
pt = Point(Point(0, 0, 0.1))
move_3 = Move(Geometry=move2pt_2.Moved, Motion=pt)  # -> Geometry, Transform
previewlw = CustomPreviewLineweights(Geometry=move_3.Geometry, Shader=tool_preview_colour, Absolute=False)

# ---- group: Paper Preview
# Preview UI
paper_outline = ColourSwatch(SwatchColor=RGB(0, 0, 0))
rectangle = Rectangle(Plane=ideal_paper_plane, XSize=dfl_paper_setup.I_2, YSize=dfl_paper_setup.I, Radius=0)  # -> Rectangle, Length
previewlw_2 = CustomPreviewLineweights(Geometry=rectangle.Rectangle, Shader=paper_outline, Absolute=False)

# ----
# Simulate
sim_slider = Slider(0, range=0..1)
tool_colour = ColourSwatch(SwatchColor=RGB(168, 168, 168))

# ---- group: Dynamic Camera Person
robot_tcp_to_target = Slider(7, range=1..7)
lense_length = Slider(28, range=1..150)

# ---- group: Save URP
save_as_urp = Button()
select_directory = FilePath("/Volumes/RB/UR/")
set_as_your_usb_drive = Panel(select_directory)
dispatch = Dispatch(List=[set_as_your_usb_drive, backup], DispatchPattern=save_as_urp)  # -> ListA, ListB

rec = DataRecorder(save_as_urp, DataLimit=-10, RecordData=True)
increment_on_save = IncrementOnSave(L=rec, Panel=rec, T=panel)
next_file_name = Panel(increment_on_save)

# ----
create_program = CreateProgram(Name=next_file_name, RobotSystem=loadrobot, Targets=merge, StepSize=1)  # -> Program, Code, Duration, Warnings, Errors
program_simulation = ProgramSimulation(Program=create_program.Program, Time=sim_slider, Normalized=True)  # -> SystemMeshes, JointRotations, Plane, Index, Time, flatten(Program), Errors
custom_preview = CustomPreview(Geometry=program_simulation.SystemMeshes, Material=tool_colour)

# ----
# Analysis
any_program_warnings = Panel(create_program.Warnings)
any_program_errors = Panel(create_program.Errors)
duration = Panel(create_program.Duration)
degrees = Degrees(Radians=graft(program_simulation.JointRotations))  # -> simplify(Degrees)
each_axis_rotation_analysis = Panel(degrees)

# ---- group: Colour Swatch
trail = SimpleTrail(Program=program_simulation.Program, Length=500, MechanicalGroup=0)

# ---- group: Dynamic Camera Person (continued)
item = ListItem(List=program_simulation.Plane, Index=robot_tcp_to_target, Wrap=True)
mod_viewport = ModifyViewport(ViewportName="Camera_Person", CameraTarget=item, CameraLensLength=lense_length, AnimateRestore=False, RestoreFrames=10)

# ---- group: Save URP (continued)
saveprog = SaveProgram(Program=create_program.Program, Folder=dispatch.ListA)

# ==== cluster IncrementOnSave
panel = Panel(ClusterInput())
T = ClusterInput()
rep = ReplaceText(Text=T, Find=" ", Replace="_", RecursiveReplace=False)
L = ClusterInput()
lng = ListLength(List=L)
division = Division(A=lng, B=2)
round = Round(Number=division)  # -> Nearest, Floor, Ceiling
panel_2 = Panel(round.Ceiling)
concat = Concatenate(FragmentA=rep, FragmentB=panel_2)
R = ClusterOutput(concat)

# ==== cluster DFLURFixutres
turntablebase = Mesh(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)
drawing_table = Mesh(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)
turntable = Mesh(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)
zoffset = Panel("34.8")
zoffset_2 = Panel("19")
mesh = Mesh(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)
zoffset_3 = Panel("0")
d1 = ClusterInput()
d2 = ClusterInput()
carttabletop = Mesh(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)
carttrack = Mesh([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])
tabletrack = Mesh([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])
tabletop = Mesh(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)
merge = Merge(Data1=zoffset_2, Data2="500", Data3=drawing_table, Data4=mesh)
merge_2 = Merge(Data1=zoffset, Data2="500", Data3=turntablebase, Data4=turntable)
merge_3 = Merge(Data1=d1, Data2=d2, Data3=mesh, Data4=mesh)
adaptorplate = Mesh(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)
merge_4 = Merge(Data1=carttabletop, Data2=flatten(carttrack))
merge_5 = Merge(Data1=tabletop, Data2=flatten(tabletrack))
merge_6 = Merge(Data1=graft(merge_3), Data2=graft(merge), Data3=graft(merge_2))
adaptorplate_2 = ClusterOutput(adaptorplate)
i = ClusterInput()
merge_7 = Merge(Data1=graft(merge_4), Data2=graft(merge_5))
i_2 = ClusterInput()
item = ListItem(List=merge_6, Index=i, Wrap=True)
item_2 = ListItem(List=merge_7, Index=i_2, Wrap=True)
A = ClusterInput()
tabletop_2 = ListItem(List=flatten(item_2), Index=0, Wrap=True)
track = ListItem(List=flatten(item_2), Index=1, Wrap=True)
track_2 = ListItem(List=flatten(item_2), Index=2, Wrap=True)
track_3 = ListItem(List=flatten(item), Index=2, Wrap=False)
track_4 = ListItem(List=flatten(item), Index=3, Wrap=False)
multiplication = Multiplication(A=A, B=-1)
tabletop_3 = ListItem(List=flatten(item), Index=0, Wrap=False)
track_5 = ListItem(List=flatten(item), Index=1, Wrap=False)
i_3 = ClusterOutput(track_3)
i_4 = ClusterOutput(track_4)
pt = ConstructPoint(XCoordinate=multiplication, YCoordinate=0, ZCoordinate=0)
move = Move(Geometry=tabletop_2, Motion=pt)  # -> Geometry, Transform
i_5 = ClusterOutput(tabletop_3)
move_2 = Move(Geometry=[track, track_2], Motion=pt)  # -> Geometry, Transform
i_6 = ClusterOutput(track_5)
G = ClusterOutput(move.Geometry)
G_2 = ClusterOutput(move_2.Geometry)

# ==== cluster CustomPopup
B = ClusterInput()
D = ClusterInput()
N = ClusterInput()
concat = Concatenate(
    FragmentA="popup (\"",
    FragmentB=B,
    FragmentC="\", title=\"",
    FragmentD=D,
    FragmentE="\", warning=False, error=False, blocking=True)")
customcmd = CustomCommand(Name=N, Manufacturer="UR", Code=concat)
C = ClusterOutput(customcmd)

# ==== cluster DFLCustomPen
d1 = ClusterInput()
preview_colour = ClusterInput()
length = ClusterInput()
dia = ClusterInput()
weight = ClusterInput()
speed = ClusterInput()
tip_dia = ClusterInput()
mesh = Mesh(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)
pen_length_offset = Panel("1.5")
pen_v_block_offset_mm = Panel("16")
holder_weight = Panel(".133")
division = Division(A=dia, B=2)
pt = ConstructPoint(XCoordinate=division, YCoordinate=division, ZCoordinate=0)
addition = Addition(A=holder_weight, B=weight)
xy = XYPlane(Origin=pt)
cir = Circle(Plane=xy, Radius=division)
subtraction = Subtraction(A=length, B=pen_length_offset)
pt_2 = Point(Point(0, 0, 0))
pt_3 = ConstructPoint(XCoordinate=0, YCoordinate=0, ZCoordinate="1")
ln = Line(StartPoint=pt_2, EndPoint=pt_3)
rotax = RotateAxis(Geometry=cir, Angle=degrees("45"), Axis=ln)  # -> Geometry, Transform
pt_4 = ConstructPoint(XCoordinate="1", YCoordinate=0, ZCoordinate=0)
ln_2 = Line(StartPoint=pt_2, EndPoint=pt_4)
rotax_2 = RotateAxis(Geometry=rotax.Geometry, Angle=degrees("90"), Axis=ln_2)  # -> Geometry, Transform
pt_5 = ConstructPoint(XCoordinate=0, YCoordinate=subtraction, ZCoordinate=pen_v_block_offset_mm)
move = Move(Geometry=rotax_2.Geometry, Motion=pt_5)  # -> Geometry, Transform
pt_6 = ConstructPoint(XCoordinate=0, YCoordinate=0, ZCoordinate="1")
ln_3 = Line(StartPoint=pt_2, EndPoint=pt_6)
range = Range(Domain="0 to 1", Steps="3")
rotax_3 = RotateAxis(Geometry=move.Geometry, Angle=degrees("-45"), Axis=ln_3)  # -> Geometry, Transform
pen_visulaization_hack = GraphMapper(range, x0=0, x1=1, y0=0, y1=1, container_name="Bezier", cpx=[0, 0.1894655079, 0, 1], cpy=[0, 0.6900714636, 1, 1])
area = Area(Geometry=rotax_3.Geometry)  # -> Area, Centroid
pdecon = Deconstruct(Point=area.Centroid)  # -> XComponent, YComponent, ZComponent
merge = Merge(Data1=division, Data2=division, Data3=tip_dia, Data4=tip_dia)
pt_7 = ConstructPoint(XCoordinate=0, YCoordinate=0, ZCoordinate=pdecon.ZComponent)
ln_4 = Line(StartPoint=pt_7, EndPoint=area.Centroid)
vpipe = PipeVariable(Curve=ln_4, Parameters=pen_visulaization_hack, Radii=merge, Caps=2)
mesh_2 = MeshBrep(
    Brep=vpipe,
    Settings={GridMaxCount=0, GridMinCount=16, JaggedSeams=False, MaxEdgeLength=0, MinEdgeLength=0.0001, MinTolerance=0, Refine=True, RefineAngle=0, RelativeTolerance=0.65, SimplePlanes=True, Tolerance=0})
pframes = PerpFrames(Curve=ln_4, Count="1", Align=True)  # -> Frames, Parameters
munion = MeshUnion(Meshes=flatten([mesh, mesh_2]))
item = ListItem(List=pframes.Frames, Index=1, Wrap=True)
data = Data(preview_colour)
num = Number(speed)
num_2 = Number(tip_dia)
num_3 = Number(addition)
hatch_frequency = ClusterInput()
hatch_angle = ClusterInput()
retract_height = ClusterInput()
pressure = ClusterInput()
nib_height = ClusterInput()
pln = Plane(flatten(item))
mesh_3 = Mesh(munion)
merge_2 = Merge(
    Data1=d1,
    Data2=num,
    Data3=num_3,
    Data4=num_2,
    Data5=data,
    Data6=pln,
    Data7=mesh_3,
    Data8=nib_height,
    Data9=hatch_angle,
    Data10=hatch_frequency,
    Data11=pressure,
    Data12=retract_height)  # -> flatten(Result)
tool_data = ClusterOutput(merge_2)
panel = Panel(merge_2)

# ==== cluster DFL4PointCalibration
L = ClusterInput()
G = ClusterInput()
item = ListItem(List=L, Index=0, Wrap=True)  # -> Item, Item1, Item2, Item3
plfit = PlaneFit(Points=L)  # -> Plane, Deviation
srf4pt = _4PointSurface(CornerA=item.Item, CornerB=item.Item1, CornerC=item.Item2, CornerD=item.Item3)
flippln = FlipPlane(Plane=plfit.Plane, Guide=G, FlipX=False, FlipY=False, FlipZ=True)  # -> Flipped, R
area = Area(Geometry=srf4pt)  # -> Area, Centroid
move2pt = MoveToPoint(Geometry=flippln.Flipped, PointA=flippln.Flipped, PointB=area.Centroid)  # -> Moved, Vector, Transform
M = ClusterOutput(move2pt.Moved)

# ==== cluster DFLPaperSetup
A = ClusterInput()
A_2 = ClusterInput()
A_3 = ClusterInput()
X = ClusterInput()
subtraction = Subtraction(A=A, B=15)
multiplication = Multiplication(A=A_3, B=-0.5)
multiplication_2 = Multiplication(A=A_3, B=0.5)
multiplication_3 = Multiplication(A=A_2, B=-0.5)
multiplication_4 = Multiplication(A=A_2, B=0.5)
pt = ConstructPoint(XCoordinate=X, YCoordinate=0, ZCoordinate=subtraction)
dom = ConstructDomain(DomainStart=multiplication, DomainEnd=multiplication_2)
dom_2 = ConstructDomain(DomainStart=multiplication_3, DomainEnd=multiplication_4)
xy = XYPlane(Origin=pt)
I = ClusterOutput(dom)
I_2 = ClusterOutput(dom_2)
P = ClusterOutput(xy)

# ==== cluster DFLSimpleDrawingImport
paper_plane = ClusterInput()
layer_name = ClusterInput()
gh_curves = ClusterInput()
dpipeline = DynamicGeometryPipeline(
    LayerFilter=graft(layer_name),
    TypeFilter="curve",
    NameFilter="*",
    GroupByLayer=False,
    GroupByType=False,
    IncludeHidden=True,
    IncludeLocked=True,
    enableFullPath=True,
    listenToAttributes=True)  # -> simplify(GeometryOut)
merge = Merge(Data1=dpipeline, Data2=gh_curves)  # -> flatten(Result)
clean = CleanTree(RemoveNulls=True, RemoveInvalid=True, RemoveEmpty=True, Tree=merge)
project = Project(Geometry=clean, Plane=paper_plane)  # -> Geometry, Transform
crv = Curve(flatten(project.Geometry))
merge_2 = Merge(Data1=crv)
tool_with_curves = ClusterOutput(merge_2)
