# Grasshopper definition DFLUR5_DR1_T32026_CALIB.gh (Grasshopper 1.0.8)
# plug-ins: Robots, Pufferfish, Bifocals

# ---- group: RB Drawing Cleanup / Set Minimum Crv Length
input_curves = Curve()
number_slider = Slider(55, range=0..1000)
len = Length(Curve=input_curves)
sort = SortList(Keys=len, ValuesA=input_curves)  # -> Keys, ValuesA
split = SplitList(List=sort.ValuesA, Index=number_slider)  # -> ListA, ListB
item = ListItem(List=sort.Keys, Index=number_slider, Wrap=False)
smallest_crv_length = Panel(item)
join = JoinCurves(Curves=split.ListB, Preserve=False)

# ---- group: RB Drawing Cleanup / Set Minimum Feature Area
brec = BoundingRectangle(Geometry=graft(join), Plane=PlaneXY(0, 0, 0), Axis=0, Slide=0, Union=True)  # -> Bounding, DimensionX, DimensionY
area = Area(Geometry=brec.Bounding)  # -> Area, Centroid
sort_2 = SortList(Keys=flatten(area.Area), ValuesA=join)  # -> Keys, ValuesA
item_2 = ListItem(List=sort_2.Keys, Index=Slider(83, range=0..1000), Wrap=False)
split_2 = SplitList(List=sort_2.ValuesA, Index=item_2)  # -> ListA, ListB
minimum_area = Panel(item_2)

# ---- group: RB HATCH 2025
y_shift = Slider(8, range=0..10)
hatch_type = ValueList({"Strait": 0, "Zig Zag": 1, "2 Deg Zag": 2}, selected="Strait")
hatch_gap = Panel("1")
shift_count = Slider(12, range=1..20)
input_edge_crvs = Curve()
xy = XYPlane(Origin=Point(0, 0, 0))
rb_hatch_2025 = RBHATCH2025(
    edge_curves=input_edge_crvs,
    base_plane=xy,
    hatch_angle=degrees(Slider(45, range=0..90)),
    G=hatch_type,
    relay=shift_count,
    D=y_shift,
    hatch_gap=hatch_gap)  # -> flatten(ci)
crv = Curve(rb_hatch_2025)

# ---- group: RB Drawing Cleanup
reb = RebuildCurve(Curve=split_2.ListB, Degree="3", Count="20", Tangents=False)
crv_2 = Curve(reb)

# ---- group: Student Calibration Test Results
# Training A student tool: Measure the diameter and length of your tool
# Insert pen and run 4-point TCP calibration with DFL staff
# Enter resulting X, Y, Z values
# Click Toggle to activate the student pen
# Preview will appear in red to confirm activation
panel = Panel("0")
# DFL DR1 - Drawing and Painting
# info: Written by Richard Blackwell and Charlotte firth for the Design Futures Lab and BENV2001
# Grasshopper Instrucitons: --- First Time Use ---
# Find the Load Robot System Component in the Robot Setup Group
# Click 'Libraries'
# Select the Universal Robot's Library and click "Install"
# --- Student Tool Calibration Exercise ---
# Run Student Pen Calibration with Lab Technicians on the UR
# Edit Student Tool with TCP value
# Click Toggle Bool to activate, you will see the color change to red in the preview when it is activated
# --- General Use ---
# Clear Example Data from 'Input Curves'
# Set your Input Curves for drawing
# Click Data Dam "Play" button to generate Toolpath
# View/Test Simulation
# Optional: Adjust 'Pen Tilt' to avoid singularities
# Set File Path for USB Drive
# Name Project
# Click Save Button
# Eject Drive and load onto Robot
# Click File → Load Program
# Select filename.URP file on USB drive
panel_2 = Panel("0")
pt = ConstructPoint(XCoordinate=panel_2, YCoordinate=panel, ZCoordinate="0")

# ----
crv_3 = Curve([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])

# ---- group: Drawing Examples
calibration_test_curves = Curve([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])
dfl_logo_curves = Curve([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])

# ---- group: Make Custom Tool
motion_type = ValueList({"Drawing": 0, "Painting": 1}, selected="Drawing")
retract = Slider(8, range=0..8)
paint_pot = ValueList({"1": 0, "2": 1}, selected="1")
pressure = Slider(1, range=0..8)

use_calibrated_tcp = BooleanToggle(False)
pt_2 = ConstructPoint(XCoordinate="0", YCoordinate="0", ZCoordinate="0")

pen_length = Slider(107, range=1..250)
pen_dia = Slider(7.5, range=6..16)
pen_weight_kg = Panel(".1")

# ---- group: DFL PAINT BRUSH
paint_pot_2 = ValueList({"1": 0, "2": 1}, selected="1")
retract_2 = Slider(8, range=0..8)
pressure_2 = Slider(3, range=0..8)

# ---- group: DFL FULL TOOL
pressure_3 = Slider(1, range=0..8)
pen_preview_colour = ColourSwatch(SwatchColor=RGB(53, 196, 156))
pen_drawing = Curve(flatten(crv_3))
dfl_stabilo = DFLSTABILO(drawing_curve=pen_drawing, preview_colour=pen_preview_colour, tool_pressue=pressure_3)

# ---- group: DFL IKEA PENCIL
pressure_4 = Slider(1.4, range=0..8)
retract_3 = Slider(8, range=0..8)

# Note about pencils: Pencils need sharpenning and will blunten over time, always run the pencil calibration script between drawings
pencil_drawing = Curve(flatten(calibration_test_curves))
ikea_pencil = IKEAPENCIL(drawing_curve=pencil_drawing, tool_pressue=pressure_4, tool_retract=retract_3)  # -> tcp, drawing_data

# ----
robot_placement = ValueList({"Cart": 0, "Table": 1}, selected="Cart")
sandbox_x_gap = Slider(155, range=0..200)
all_fixtures = ValueList({"Custom Fixture": 0, "Draw Table": 1, "Turntable": 2, "Turntable With riser": 3, "Turntable With large": 4, "Clay Cover": 5, "Clay Riser": 6, "Sand Box": 7}, selected="Draw Table")
addition = Addition(A=sandbox_x_gap, B=90)

# ----
# Fixture Setup
number_slider_2 = Slider(780, range=0..1000)
dfl_ur_fixutres = DFLURFixutres(A_2=56, i_2=robot_placement, d2="500", i=all_fixtures, F=addition)  # -> G, adaptorplate_2, G_2, fixture_z, fixture_x, i_4, i_3, point
cluster = Cluster_2(paintpot_offset=number_slider_2)  # -> G, paint_pots_2
table = ColourSwatch(SwatchColor=RGB(217, 185, 126))
mounts = CustomPreview(
    Geometry=[dfl_ur_fixutres.adaptorplate_2, dfl_ur_fixutres.G_2],
    Material=ColourSwatch(SwatchColor=RGBA(152, 149, 158, 165)))
table_2 = CustomPreview(Geometry=dfl_ur_fixutres.G, Material=table)
fixture = CustomPreview(Geometry=[dfl_ur_fixutres.i_4, dfl_ur_fixutres.i_3, cluster.G], Material=ColourSwatch(SwatchColor=RGB(214, 214, 214)))

# ---- group: Make Custom Tool
pen_preview_colour_2 = ColourSwatch(SwatchColor=RGB(196, 53, 53))
tool_name = Panel("Custom_Tool")
input_curves_2 = Curve()
new_pen_holder = BooleanToggle(True)
dfl_dr2_tool = DFLDR2Tool_2(
    relay_4=tool_name,
    relay_6=pen_preview_colour_2,
    relay_5=input_curves_2,
    new_pen_holder=new_pen_holder,
    A=pen_length,
    A_2=pen_dia,
    B=pen_weight_kg,
    G=use_calibrated_tcp,
    pt=pt_2,
    relay_3=motion_type,
    L=cluster.paint_pots_2,
    i=paint_pot,
    relay=pressure,
    relay_2=retract)  # -> tool, tcp, R
tool_centre_point = Panel(dfl_dr2_tool.tcp)

# ---- group: DFL PAINT BRUSH
pen_preview_colour_3 = ColourSwatch(SwatchColor=RGB(196, 53, 192))
painting = Curve(flatten([<curve referenced from the Rhino model> x53]))
dfl_paint_brush = DFLPAINTBRUSH(
    preview_colour=pen_preview_colour_3,
    drawing_curve=painting,
    paint_pots=cluster.paint_pots_2,
    paint_pot_choice=paint_pot_2,
    tool_pressue=pressure_2,
    tool_retract=retract_2)

# ----
get_latest_calibration_data = Button()

# ---- group: Drawing Layers / Collate Drawing Steps / Entwine
# Layers
# Insert the drawing data (from the tools) in the order that you want the drawing to take place, Click the data danm (play button) to regenerate any changes
entwine = Entwine(Branch0X=dfl_stabilo, FlattenInputs=False)

# ---- group: Drawing Layers / Collate Drawing Steps / Entwine / Re Calculate
dam = DataDam(DataA=entwine, BufferDelay=2500000, BufferMode=1)

# ---- group: Drawing Layers
# Drawing Setup
_4_pt_plane_in_use = ValueList({"Charlie (pre calibrated)": 0, "Darcy (pre calibrated)": 1, "Custom Calibration": 2}, selected="Charlie (pre calibrated)")
paper_length_x = Slider(297, range=0..420)
paper_width_y = Slider(420, range=0..420)
use_4_pt_calibrated_plane = BooleanToggle(True)
custom_calibration = Panel("")
dr_drawing_setup = DRDrawingSetup(
    G_2=use_4_pt_calibrated_plane,
    G=_4_pt_plane_in_use,
    trigger=get_latest_calibration_data,
    custom_calibration_points=custom_calibration,
    length=paper_length_x,
    height=paper_width_y,
    x_distance_from_robot=dfl_ur_fixutres.fixture_x,
    fixtureheight_z=dfl_ur_fixutres.fixture_z,
    D=dam)  # -> pl, pl_2, paper_plane, height_dom, width_dom, R
panel_4 = Panel(dr_drawing_setup.R)
paper_outline = ColourSwatch(SwatchColor=RGB(0, 0, 0))
pln = Plane(dr_drawing_setup.pl_2)
rectangle = Rectangle(Plane=dr_drawing_setup.paper_plane, XSize=dr_drawing_setup.height_dom, YSize=dr_drawing_setup.width_dom, Radius=0)  # -> Rectangle, Length
pln_2 = Plane(dr_drawing_setup.paper_plane)
pln_3 = Plane(dr_drawing_setup.pl)
paper_outline_2 = CustomPreview(Geometry=rectangle.Rectangle, Material=paper_outline)

# ---- group: Number of planes (should not exeed 40,000)
# Path Planning
number_slider_3 = Slider(0.1, range=0..10)
dr_path_planning = DRPathPlanning(relay=pln, tollerance=number_slider_3, D=dam)  # -> G, M
lng = ListLength(List=flatten(dr_path_planning.G))
number_of_planes_should_not_exeed_40_000 = Panel(lng)

# ---- group: Robot Setup + initial pose
controlled_speed = Slider(30, range=1..100)
transfer_speed = Slider(100, range=1..100)
zone_accuracy = Slider(0.5, range=-0.01..2)

# ---- group: Save URP
select_a_directory = FilePath("/Volumes/UR20/")
set_as_your_usb_drive = Panel(select_a_directory)

# ---- group: Robot Setup + initial pose
# Robot Setup
list = RobotsLibrary(
    {"AA-KR60", "AA-KR30", "AA-KR60_KR30", "UR3e", "UR5e", "UR10e", "UR16e", "UR3", "UR5", "UR10", "UR20", "UR30"}, selected="UR5",
    Type=0)
loadrobot = LoadRobotSystem(Name=list, Base=PlaneXY(0, 0, 0))
strokes_per_refill = Slider(6, range=1..10)
pen_change_pose_av_degrees = Panel("""9
-50
-126
-37
83
0""")
degrees_to_radians = DegreesToRadians(Degrees=pen_change_pose_av_degrees, RobotSystem=loadrobot, MechanicalGroup=0)

# ----
# Simulate
# Analisis
sim_slider = Slider(0.51983, range=0..1)
preview_transitions = BooleanToggle(False)
live_toolpath = ColourSwatch(SwatchColor=RGBA(96, 11, 153, 147))
robot = ColourSwatch(SwatchColor=RGBA(93, 116, 120, 159))

# ---- group: Save URP
# Save
# Saving Instrucitons: Please set your Project Name without spaces
# Right-click 'Select a Directory' and choose a location on your USB drive
# Click 'Save as URP' (if the icon flashes red, the directory is not set or the USB is not mounted)
# Files must have unique names on the controller. A Data Recorder appends a number to each saved file
# To reset the counter, click the X on the 'click counter' Data Recorder
project_name = Panel("demo1")
save_as_urp = Button()
include_pen_test_script = BooleanToggle(True)
click_counter = DataRecorder(save_as_urp, DataLimit=-10, RecordData=False)
cluster_2 = Cluster(T=project_name, L=click_counter)
dispatch = Dispatch(List=set_as_your_usb_drive, DispatchPattern=save_as_urp)  # -> ListA, ListB
unique_file_name = Panel(cluster_2)

# ---- group: Robot Setup + initial pose (continued)
dr_robotic_motions = DRRoboticMotions(
    relay_3=loadrobot,
    data=degrees_to_radians,
    num_3=controlled_speed,
    num_2=transfer_speed,
    num=zone_accuracy,
    relay_4=dam,
    pen_transfer_plane=pln_3,
    relay=pln_2,
    relay_2=dr_path_planning.G,
    paint_strokes_per_refill=strokes_per_refill,
    test_location_plane=dr_drawing_setup.paper_plane,
    program_name=unique_file_name)  # -> R, grafted_drawing_commands, program

# ----
create_program = CreateProgram(Name=unique_file_name, RobotSystem=loadrobot, Targets=dr_robotic_motions.R, StepSize=1)  # -> Program, Code, Duration, Warnings, Errors
any_program_errors = Panel(create_program.Errors)
any_program_warnings = Panel(create_program.Warnings)
scr_preview = Panel(create_program.Code)
expression = Expression(x=create_program.Duration, Expression="Floor(x/60)")
duration_minutes = Panel(expression)
program_simulation = ProgramSimulation(Program=create_program.Program, Time=sim_slider, Normalized=True)  # -> SystemMeshes, JointRotations, Plane, Index, Time, flatten(Program), Errors
degrees = Degrees(Radians=graft(program_simulation.JointRotations))  # -> simplify(Degrees)
each_axis_rotation_analysis = Panel(degrees)
dr_preview = DRPreview(D=dam, G_2=preview_transitions, G=dr_path_planning.M, T=dr_robotic_motions.grafted_drawing_commands)  # -> s_0, col_2
preview = CustomPreview(Geometry=dr_preview.s_0, Material=dr_preview.col_2)
custom_preview = CustomPreview(Geometry=program_simulation.SystemMeshes, Material=robot)

# ---- group: Colour Swatch
trail = SimpleTrail(Program=program_simulation.Program, Length=500, MechanicalGroup=0)

# ----
preview_2 = CustomPreview(Geometry=trail, Material=live_toolpath)

# ---- group: Save URP (continued)
filter = StreamFilter(
    Gate=include_pen_test_script,
    Stream0=create_program.Program,
    Stream1=[create_program.Program, dr_robotic_motions.program])
# Paint Brush additions
saveprog = SaveProgram(Program=filter, Folder=dispatch.ListA)

# ==== cluster Cluster
L = ClusterInput()
lng = ListLength(List=L)
addition = Addition(A=lng, B=1)
T = ClusterInput()
division = Division(A=addition, B=2)
rep = ReplaceText(Text=T, Find=" ", Replace="_", RecursiveReplace=False)
round = Round(Number=division)  # -> Nearest, Floor, Ceiling
concat = Concatenate(FragmentA=rep, FragmentC="_", FragmentB=round.Ceiling)
R = ClusterOutput(concat)

# ==== cluster RBHATCH2025
hatch_angle = ClusterInput()
edge_curves = ClusterInput()
base_plane = ClusterInput()
hatch_gap = ClusterInput()
relay = ClusterInput()
D = ClusterInput()
rb_bounding_hatch = RBBoundingHatch(shift=D, G=base_plane, A=degrees(hatch_angle), E=edge_curves, D=hatch_gap)  # -> G_2, M, G_3
pln = Plane(rb_bounding_hatch.G_2)
dispatch = Dispatch(List=rb_bounding_hatch.M, DispatchPattern=[True, False])  # -> ListA, ListB
G = ClusterInput()
flip = FlipCurve(Curve=dispatch.ListB)  # -> Curve, Flag
weave = Weave(Pattern=[0, 1], Stream0=dispatch.ListA, Stream1=flip.Curve, NullGaps=False)
divide = DivideCurve(Curve=weave, Count=relay, Kinks=False)  # -> Points, Tangents, Parameters
xy = XYPlane(Origin=Point(0, 0, 0))
vec = VectorXYZ(XComponent=0, YComponent=D, ZComponent=0)  # -> Vector, Length
dispatch_2 = Dispatch(List=divide.Points, DispatchPattern=[True, False])  # -> ListA, ListB
move = Move(Geometry=xy, Motion=vec.Vector)  # -> Geometry, Transform
pl_origin = PlaneOrigin(Base=pln, Origin=dispatch_2.ListA)
pl_origin_2 = PlaneOrigin(Base=pln, Origin=dispatch_2.ListB)
orient = Orient(Geometry=move.Geometry, Source=xy, Target=pl_origin)  # -> Geometry, Transform
weave_2 = Weave(Pattern=[0, 1], Stream0=orient.Geometry, Stream1=pl_origin_2, NullGaps=False)
pline = PolyLine(Vertices=weave_2, Closed=False)
reb = RebuildCurve(Curve=pline, Degree="2", Count=expr("X*2", relay), Tangents=False)
filter = StreamFilter(Gate=G, Stream0=weave, Stream1=pline, Stream2=reb)
crv = Curve(flatten(filter))
crv_2 = Curve(flatten(pline))
trim = TrimWithBrep(Curve=crv, Brep=graft(rb_bounding_hatch.G_3))  # -> simplify(Inside), Outside
ci = ClusterOutput(trim.Inside)

# ==== cluster DRDrawingSetup
get_latest_calibration_data = Button()
panel = Panel("https://raw.githubusercontent.com/designfutureslab/DR/refs/heads/main/CharlieDrawCalib.txt")
panel_2 = Panel("https://raw.githubusercontent.com/designfutureslab/DR/refs/heads/main/DarcyDrawCalib.txt")
trigger = ClusterInput()
py3 = Python3Script(url=panel_2, trigger=trigger)  # -> text, ok, msg; inputs url: String, trigger: Boolean
# ---------- py3: Python ----------
"""
General-purpose: fetches any text file from a URL whenever `trigger` goes True.
Also looks up the file's last GitHub commit date (if it's a raw.githubusercontent.com URL)
and appends it to the status message, converted to local time.

Safe for multiple instances of this component on the same canvas: the cache
is keyed by the URL itself, so separate components with separate URLs never
collide or overwrite each other's stored result.

Inputs:
    url     : str  - full URL to the text file (raw.githubusercontent.com works best)
    trigger : bool - fires the fetch on True
Outputs:
    text    : list of str - the file's contents, one line per list item
    ok      : bool - True if fetch succeeded
    msg     : str  - status message, including last GitHub commit date if available
"""

import urllib.request
import urllib.error
import datetime
import time
import json
import re
import scriptcontext as sc

# Key the cache by URL so multiple instances of this component (e.g. one per robot)
# never stomp on each other's stored result.
key = "url_fetch_cache::" + str(url)

if key not in sc.sticky:
    sc.sticky[key] = {"text": "", "ok": False, "msg": "Not yet run"}

cache = sc.sticky[key]


def get_github_commit_date(raw_url):
    """
    If raw_url is a raw.githubusercontent.com link, query the GitHub API
    for the last commit date touching that specific file path.
    Handles both URL styles:
      .../owner/repo/branch/path
      .../owner/repo/refs/heads/branch/path  (or refs/tags/tag/path)
    Returns a timezone-aware UTC datetime, or None if not applicable / lookup fails.
    """
    m = re.match(
        r"https?://raw\.githubusercontent\.com/([^/]+)/([^/]+)/refs/(?:heads|tags)/([^/]+)/(.+)",
        raw_url
    )
    if not m:
        m = re.match(
            r"https?://raw\.githubusercontent\.com/([^/]+)/([^/]+)/([^/]+)/(.+)",
            raw_url
        )
    if not m:
        return None

    owner, repo, branch, path = m.groups()
    api_url = "https://api.github.com/repos/{}/{}/commits?path={}&sha={}&per_page=1".format(
        owner, repo, path, branch
    )
    req = urllib.request.Request(api_url, headers={
        "User-Agent": "Mozilla/5.0",
        "Accept": "application/vnd.github+json"
    })
    with urllib.request.urlopen(req, timeout=10) as resp:
        data = json.loads(resp.read().decode("utf-8"))

    if isinstance(data, list) and len(data) > 0:
        date_str = data[0]["commit"]["committer"]["date"]  # e.g. "2026-09-29T01:10:00Z"
        utc_dt = datetime.datetime.strptime(date_str, "%Y-%m-%dT%H:%M:%SZ")
        utc_dt = utc_dt.replace(tzinfo=datetime.timezone.utc)
        return utc_dt
    return None


if trigger:
    try:
        separator = "&" if "?" in url else "?"
        fetch_url = url + separator + "cachebust=" + str(int(time.time()))

        req = urllib.request.Request(fetch_url, headers={"User-Agent": "Mozilla/5.0"})
        with urllib.request.urlopen(req, timeout=10) as response:
            decoded = response.read().decode("utf-8")

        cache["text"] = decoded
        cache["ok"] = True
        now_str = datetime.datetime.now().strftime("%Y-%m-%d %H:%M:%S")

        commit_date_str = None
        commit_lookup_error = None
        try:
            utc_dt = get_github_commit_date(url)
            if utc_dt:
                local_dt = utc_dt.astimezone()
                commit_date_str = local_dt.strftime("%Y-%m-%d %H:%M:%S")
        except urllib.error.HTTPError as e:
            if e.code == 403:
                commit_lookup_error = "rate-limited (403)"
            else:
                commit_lookup_error = "HTTP {}".format(e.code)
        except Exception as e:
            commit_lookup_error = str(e)

        if commit_date_str:
            cache["msg"] = "Fetched {} chars at {}. File last updated: {}".format(
                len(decoded), now_str, commit_date_str
            )
        elif commit_lookup_error:
            cache["msg"] = "Fetched {} chars at {}. File last updated: unknown ({})".format(
                len(decoded), now_str, commit_lookup_error
            )
        else:
            cache["msg"] = "Fetched {} chars at {}. File last updated: unknown".format(
                len(decoded), now_str
            )

    except urllib.error.URLError as e:
        cache["ok"] = False
        cache["msg"] = "URL error: {}".format(e.reason)
    except Exception as e:
        cache["ok"] = False
        cache["msg"] = "Error: {}".format(e)

sc.sticky[key] = cache

text = cache["text"].splitlines()
ok = cache["ok"]
msg = cache["msg"]
# ---------- end py3 ----------
py3_2 = Python3Script(url=panel, trigger=trigger)  # -> text, ok, msg; inputs url: String, trigger: Boolean; same code as py3
concat = Concatenate(FragmentA="Charlie : ", FragmentB=py3_2.msg, FragmentC="Darcey :", FragmentD=py3.msg)
panel_3 = Panel(py3_2.text)
panel_4 = Panel(py3_2.msg)
panel_5 = Panel(py3.text)
panel_6 = Panel(py3.msg)
panel_7 = Panel(concat)
custom_calibration_points = ClusterInput()
D = ClusterInput()
custom_calibration_points_2 = Data(custom_calibration_points)
x_distance_from_robot = ClusterInput()
fixtureheight_z = ClusterInput()
sept_24_2026_darcy = Panel(py3.text)

# ---- group: 4 point Calibration
custom_calibration_points_3 = Panel(custom_calibration_points_2)
_4_point_charlie_x_y_z = Panel("""338.99,226.76,6.95
665.22,225.90,8.43
665.40,-224.25,6.10
337.55,-224.68,4.65""")
G = ClusterInput()
filter = StreamFilter(Gate=G, Stream0=_4_point_charlie_x_y_z, Stream1=sept_24_2026_darcy, Stream2=custom_calibration_points_3)

# ----
retract_height = SplitTree(Data=D, Masks=flatten("{?;6}"))  # -> Positive, Negative
trim = TrimTree(Tree=retract_height.Positive, Depth=1)

pen_pressue = SplitTree(Data=D, Masks=flatten("{?;5}"))  # -> Positive, Negative
trim_2 = TrimTree(Tree=pen_pressue.Positive, Depth=1)

G_2 = ClusterInput()
length = ClusterInput()
height = ClusterInput()

# ---- group: Paper Size and position
fixtureheight_z_2 = Panel(fixtureheight_z)
x_distance_from_robot_2 = Panel(x_distance_from_robot)
dfl_paper_setup = DFLPaperSetup(A_2=length, A_3=height, X=x_distance_from_robot_2, A=fixtureheight_z_2)  # -> I_2, I, P

# ----
plfit = PlaneFit()  # -> Plane, Deviation
pt = Point(filter)
item = ListItem(List=filter, Index=0, Wrap=True)  # -> Item, Item1, Item2, Item3
plfit_2 = PlaneFit(Points=pt)  # -> Plane, Deviation
srf4pt = _4PointSurface(CornerA=item.Item, CornerB=item.Item1, CornerC=item.Item2, CornerD=item.Item3)
planar = IsPlanar(Surface=srf4pt, Interior=True)  # -> Planar, Plane
pl_origin = PlaneOrigin(Base=plfit_2.Plane, Origin=planar.Plane)
height_dom = ClusterOutput(dfl_paper_setup.I_2)
width_dom = ClusterOutput(dfl_paper_setup.I)
R = ClusterOutput(concat)

# ---- group: Paper Plane
ideal_paper_plane = Plane(dfl_paper_setup.P)

# ----
flippln = FlipPlane(Plane=pl_origin, Guide=ideal_paper_plane, FlipX=True, FlipY=True, FlipZ=True)  # -> Flipped, R
pln = Plane(flippln.Flipped)

# ---- group: Paper Plane (continued)
calibrated_plane = Plane(flippln.Flipped)
filter_2 = StreamFilter(Gate=G_2, Stream0=ideal_paper_plane, Stream1=calibrated_plane)

# ----
pln_2 = Plane(ideal_paper_plane)
pln_3 = Plane(filter_2)

# ---- group: Create Pressure planes
multiplication = Multiplication(A=trim_2, B=-1)
pl_offset = PlaneOffset(BasePlane=filter_2, Offset=multiplication)

# ---- group: Create Transfer Planes
pl_offset_2 = PlaneOffset(BasePlane=filter_2, Offset=trim)

# ----
paper_plane = ClusterOutput(pln_3)
pl = ClusterOutput(pl_offset_2)
pl_2 = ClusterOutput(pl_offset)

# ==== cluster Cluster_2
paintpot_offset = ClusterInput()
panel = Panel("-40")
multiplication = Multiplication(A="40", B=-1)
addition = Addition(A=paintpot_offset, B="40")
X = UnitX(Factor=paintpot_offset)
brep = Brep([<brep referenced from the Rhino model> x5])
Z = UnitZ(Factor="-16")
move = Move(Geometry=brep, Motion=X)  # -> Geometry, Transform

# ---- group: Set Paint Pot / Right Most paint pot
panel_2 = Panel("64")
pt = ConstructPoint(XCoordinate=addition, YCoordinate=multiplication, ZCoordinate=0)

# ---- group: Set Paint Pot / Left most paint pot
panel_3 = Panel("-15")
pt_2 = ConstructPoint(XCoordinate=addition, YCoordinate="40", ZCoordinate=0)

# ----
move_2 = Move(Geometry=move.Geometry, Motion=Z)  # -> Geometry, Transform

# ---- group: Set Paint Pot
paint_pots = Point([pt_2, pt])

# ----
G = ClusterOutput(move_2.Geometry)
paint_pots_2 = ClusterOutput(paint_pots)

# ==== cluster DRPathPlanning
D = ClusterInput()

contour_curves = SplitTree(Data=D, Masks=flatten("{?;3}"))  # -> Positive, Negative
trim = TrimTree(Tree=contour_curves.Positive, Depth=1)

relay = ClusterInput()

# ---- group: Move Drawing To Paper
# Path Planning
paper_plane = Plane(relay)
project = Project(Geometry=trim, Plane=paper_plane)  # -> Geometry, Transform
bbox = BoundingBox(Content=flatten(project.Geometry), Plane=paper_plane, UnionBox=True)  # -> Box, Box_2
area = Area(Geometry=bbox.Box)  # -> Area, Centroid
move2pt = MoveToPoint(Geometry=project.Geometry, PointA=area.Centroid, PointB=paper_plane)  # -> Moved, Vector, Transform

# ----
M = ClusterOutput(move2pt.Moved)
tollerance = ClusterInput()

# ---- group: Divide (Polyline)
dfl_curves_to_planes = DFLCrvToPln(B=relay, C=move2pt.Moved, td=tollerance)

# ---- group: Reorient Planes
pen_tilt = Slider(0, range=0..45)
list = ValueList({"0 deg": 0, "90 deg": 90, "180 deg": 180, "270 deg": 270, "360 deg": 360}, selected="180 deg")
list_2 = ValueList({"x": 0, "y": 1, "z": 2}, selected="x")

# ----
deplane = DeconstructPlane(Plane=dfl_curves_to_planes)  # -> Origin, XAxis, YAxis, ZAxis
filter = StreamFilter(Gate=list_2, Stream0=deplane.XAxis, Stream1=deplane.YAxis, Stream2=deplane.ZAxis)
amp = Amplitude(Vector=filter, Amplitude="1")
move = Move(Geometry=deplane.Origin, Motion=amp)  # -> Geometry, Transform
ln = Line(StartPoint=deplane.Origin, EndPoint=move.Geometry)
addition = Addition(A=pen_tilt, B=list)
rotax = RotateAxis(Geometry=dfl_curves_to_planes, Angle=degrees(addition), Axis=ln)  # -> Geometry, Transform

pen_tilt_2 = Slider(0, range=0..45)
list_3 = ValueList({"0 deg": 0, "90 deg": 90, "180 deg": 180, "270 deg": 270, "360 deg": 360}, selected="90 deg")
list_4 = ValueList({"x": 0, "y": 1, "z": 2}, selected="z")

deplane_2 = DeconstructPlane(Plane=rotax.Geometry)  # -> Origin, XAxis, YAxis, ZAxis
filter_2 = StreamFilter(Gate=list_4, Stream0=deplane_2.XAxis, Stream1=deplane_2.YAxis, Stream2=deplane_2.ZAxis)
amp_2 = Amplitude(Vector=filter_2, Amplitude="1")
move_2 = Move(Geometry=deplane_2.Origin, Motion=amp_2)  # -> Geometry, Transform
ln_2 = Line(StartPoint=deplane_2.Origin, EndPoint=move_2.Geometry)
addition_2 = Addition(A=pen_tilt_2, B=list_3)
rotax_2 = RotateAxis(Geometry=rotax.Geometry, Angle=degrees(addition_2), Axis=ln_2)  # -> Geometry, Transform

G = ClusterOutput(rotax_2.Geometry)

# ==== cluster DRRoboticMotions
pen_transfer_plane = ClusterInput()
relay = ClusterInput()
relay_2 = ClusterInput()
relay_3 = ClusterInput()
num = ClusterInput()
relay_4 = ClusterInput()
data = ClusterInput()
num_2 = ClusterInput()
num_3 = ClusterInput()

pot_location = SplitTree(Data=relay_4, Masks=flatten("{?;7}"))  # -> Positive, Negative
trim = TrimTree(Tree=pot_location.Positive, Depth=1)

# ---- group: Path Planning
pln = Plane(simplify(relay_2))

# ----
num_4 = Number(num)
num_5 = Number(num_3)
data_2 = Data(data)
paper_plane = Plane(relay)

tools = SplitTree(Data=relay_4, Masks=flatten("{?;1}"))  # -> Positive, Negative
trim_2 = TrimTree(Tree=tools.Positive, Depth=1)

pen_transfer_plane_2 = Plane(pen_transfer_plane)
instructions_for_ur_operator = Panel("Please ensure you Pen and paper is Correctly loaded, that DFL staff have set up the Robot, and that you have reviewed the simulation in Grasshopper or on the SmartPad")

# ---- group: Locate Paint pot at Pen Orientation
item = ListItem(List=flatten(pln), Index=-1, Wrap=True)  # -> flatten(Item)
move2pt = MoveToPoint(Geometry=item, PointA=item, PointB=trim)  # -> Moved, Vector, Transform
project = Project(Geometry=move2pt.Moved, Plane=item)  # -> Geometry, Transform

# ----
test_location_plane = ClusterInput()
program_name = ClusterInput()
pen_change_pose_av_degrees = Panel("""9
-50
-126
-37
83
0""")

# ---- group: Set Dip + Whipe
paint_pot_whipe_x = Panel("-100")
paint_pot_whipe_z = Panel("80")
paint_pot_z = Panel("-10")
vec = VectorXYZ(XComponent=paint_pot_whipe_x, YComponent=0, ZComponent=paint_pot_whipe_z)  # -> Vector, Length
Z = UnitZ(Factor=paint_pot_z)
move = Move(Geometry=project.Geometry, Motion=vec.Vector)  # -> Geometry, Transform
move_2 = Move(Geometry=project.Geometry, Motion=Z)  # -> Geometry, Transform

# ---- group: Lead In
py3 = Python3Script(A=trim_2, B=pln)  # -> out, R; inputs A: tree, B: tree
# ---------- py3: Python ----------
from Grasshopper import DataTree
from Grasshopper.Kernel.Data import GH_Path

def as_tree(x):
    """Return x as a DataTree; wrap as {0} if not already a tree."""
    if hasattr(x, "Paths"):
        return x
    T = DataTree[object]()
    try:
        for it in x:
            T.Add(it, GH_Path(0))
    except:
        T.Add(x, GH_Path(0))
    return T

def tool_for_top(A, top_idx):
    p = GH_Path(top_idx)
    if A.PathExists(p):
        br = A.Branch(p)
        if br: 
            return br[0]   # return the tool object itself
    # fallback: first available
    if A.Paths:
        br = A.Branch(A.Paths[0])
        if br: 
            return br[0]
    return None

A = as_tree(A)
B = as_tree(B)

R = DataTree[object]()
for p in B.Paths:
    n = len(B.Branch(p))
    top = p.Indices[0] if len(p.Indices) else 0
    tool = tool_for_top(A, top)
    for _ in range(n):
        R.Add(tool, p)
# ---------- end py3 ----------
item_2 = ListItem(List=py3.R, Index=0, Wrap=True)
item_3 = ListItem(List=pln, Index=0, Wrap=True)  # -> Item1, Item
project_2 = Project(Geometry=item_3.Item, Plane=pen_transfer_plane_2)  # -> Geometry, Transform
controlled_speed = Panel(num_5)

# ---- group: Set Safe Height
paint_pot_z_safe = Panel("80")
Z_2 = UnitZ(Factor=paint_pot_z_safe)
move_3 = Move(Geometry=project.Geometry, Motion=Z_2)  # -> Geometry, Transform

# ----
tool_names = SplitTree(Data=relay_4, Masks=flatten("{?;0}"))  # -> Positive, Negative
trim_3 = TrimTree(Tree=tool_names.Positive, Depth=1)

dfl_tool_test = DFLToolTest(
    data=relay_3,
    pln_2=relay_2,
    pln=test_location_plane,
    A=program_name,
    tool_name=trim_3,
    data_2=trim_2,
    robot_system=relay_3)

# ---- group: Pen Change
pen_change_pose_av_degrees_2 = Panel("""9
-50
-126
-37
83
0""")
concat = Concatenate(FragmentB=trim_3, FragmentC="_change")
concat_2 = Concatenate(FragmentA="Insert ", FragmentB=trim_3, FragmentC=" layer and click continue to resume")
popup_text = Panel(concat_2)
popup_title_no_spaces = Panel(concat)
degrees_to_radians = DegreesToRadians(Degrees=pen_change_pose_av_degrees, RobotSystem=relay_3, MechanicalGroup=0)
dfl_ur_custom_popup = DFLURCustomPopup(N=popup_title_no_spaces, B=popup_text)

# ----
program = ClusterOutput(dfl_tool_test)

popup_text_2 = Panel("Job Complete! Please put all the caps back on the pens and tidy up!")
popup_title_no_spaces_2 = Panel("Job_Done")
dfl_ur_custom_popup_2 = DFLURCustomPopup(N=popup_title_no_spaces_2, B=popup_text_2)

item_4 = ListItem(List=flatten(trim_2), Index=-1, Wrap=True)
list = ValueList({"Joint", "Linear", "Process"}, selected="Linear")
num_6 = Number(num_2)

# ---- group: Inital Pose
item_5 = ListItem(List=flatten(trim_2), Index=0, Wrap=True)
# Robotic Commands
popup_title_no_spaces_3 = Panel("Operator_Safety")
popup_text_3 = Panel(instructions_for_ur_operator)
dfl_ur_custom_popup_3 = DFLURCustomPopup(N=popup_title_no_spaces_3, B=popup_text_3)
createtarget = CreateTarget(Joints=data_2, Tool=item_5, Speed=num_6, Zone=num_4, Command=dfl_ur_custom_popup_3, IsCartesian=False)

# ----
list_2 = ValueList({"Joint", "Linear", "Process"}, selected="Joint")

# ---- group: Linear Movements
zone_accuracy = Panel(num_4)
controlled_speed_2 = Panel(num_5)

# ----
list_3 = ValueList({"Joint", "Linear", "Process"}, selected="Linear")
createtarget_2 = CreateTarget(Plane=project_2.Geometry, Motion=list, Tool=item_2, Speed=num_6, Zone=num_4, IsCartesian=True)
list_4 = ValueList({"Joint", "Linear", "Process"}, selected="Linear")
createtarget_3 = CreateTarget(Plane=pln, Motion=list_3, Tool=py3.R, Speed=controlled_speed_2, Zone=zone_accuracy, IsCartesian=True)

# ---- group: Lead Out
list_5 = ValueList({"Joint", "Linear"}, selected="Linear")
project_3 = Project(Geometry=item_3.Item1, Plane=pen_transfer_plane_2)  # -> Geometry, Transform

# ----
list_6 = ValueList({"Joint", "Linear", "Process"}, selected="Linear")
createtarget_4 = CreateTarget(Joints=data_2, Tool=item_4, Speed=num_6, Zone=num_4, Command=dfl_ur_custom_popup_2, IsCartesian=False)
createtarget_5 = CreateTarget(Joints=degrees_to_radians, Tool=trim_2, Speed=num_6, Zone=num_4, Command=dfl_ur_custom_popup, IsCartesian=False)
ins = InsertItems(List=createtarget_3, Item=createtarget_2, Indices=0, Wrap=True)
createtarget_6 = CreateTarget(Plane=project_3.Geometry, Motion=list_6, Tool=item_2, Speed=num_6, Zone=num_4, IsCartesian=True)
ins_2 = InsertItems(List=ins, Item=createtarget_6, Indices=-1, Wrap=True)  # -> simplify(List)
paint_strokes_per_refill = ClusterInput()
data_3 = Data(ins_2)

drawing_painting = SplitTree(Data=relay_4, Masks=flatten("{?;4}"))  # -> Positive, Negative
approach_choise_bool = TrimTree(Tree=drawing_painting.Positive, Depth=1)
more_than_1 = MoreThan1(T=relay_4)

# ---- group: Paint pot refil motions
paint_whipe_plane = Plane(move.Geometry)
paint_pot_safe_plane = Plane(move_3.Geometry)
paint_pot_plane = Plane(move_2.Geometry)
list_7 = ValueList({"Joint", "Linear"}, selected="Linear")
list_8 = ValueList({"Joint", "Linear"}, selected="Linear")

# ----
createtarget_7 = CreateTarget(Plane=paint_pot_plane, Motion=list_4, Tool=trim_2, Speed=num_5, Zone=num_4, IsCartesian=True)
createtarget_8 = CreateTarget(Plane=paint_pot_safe_plane, Motion=list_2, Tool=trim_2, Speed=num_6, Zone=num_4, IsCartesian=True)
createtarget_9 = CreateTarget(Plane=paint_whipe_plane, Motion=list_7, Tool=trim_2, Speed=num_5, Zone=num_4, IsCartesian=True)

# ---- group: Paint pot refil motions (continued)
merge = Merge(Data1=createtarget_8, Data2=createtarget_7, Data3=createtarget_9)

# ----
data_4 = Data(merge)
gtp5_py3_insert_strokes = Python3Script(A=data_3, B=data_4, C=paint_strokes_per_refill)  # -> out, R; inputs A: tree, B: tree
# ---------- gtp5_py3_insert_strokes: Python ----------
# Works for 1 or many tools; inserts dip at first stroke of each group, then every N
from Grasshopper import DataTree
from Grasshopper.Kernel.Data import GH_Path

def build_dip_map(B):
    # map: top index -> dip sequence (list); also default (first branch)
    dip_map = {}
    default_seq = []
    paths = list(B.Paths)
    if paths:
        default_seq = list(B.Branch(paths[0]))
    for p in paths:
        inds = list(p.Indices)
        top = inds[0] if inds else 0
        seq = dip_map.get(top, [])
        seq.extend(list(B.Branch(p)))
        dip_map[top] = seq
    return dip_map, default_seq

def pick(A, B, N):
    N = int(N) if (N and N > 0) else 1
    R = DataTree[object]()

    dip_map, default_seq = build_dip_map(B)
    has_multi_dip_groups = (len(dip_map) > 1)

    # per “group” counter (group = tool index when multiple tools; else single global)
    counters = {}

    for p in A.Paths:
        inds = list(p.Indices)

        # Group key:
        # - multi-tool: use first index of the stroke path (tool index)
        # - single-tool (or only one dip set): use fixed key 0 (one global counter)
        key = inds[0] if (has_multi_dip_groups and len(inds) >= 2) else 0

        count = counters.get(key, 0)
        dips = dip_map.get(key, default_seq)

        if dips and (count % N == 0):
            for d in dips:
                R.Add(d, p)

        # append stroke branch
        for it in A.Branch(p):
            R.Add(it, p)

        counters[key] = count + 1

    return R

R = pick(A, B, C)
# ---------- end gtp5_py3_insert_strokes ----------
dfl_weaver = DFLWeaver(
    relay_2=more_than_1,
    relay_3=createtarget_5,
    relay=ins_2,
    relay_4=gtp5_py3_insert_strokes.R,
    relay_5=approach_choise_bool)

# ---- group: Order Program
merge_2 = Merge(Data1=createtarget, Data2=flatten(dfl_weaver), Data3=createtarget_4)  # -> flatten(Result)

# ----
data_5 = Data(dfl_weaver)
grafted_drawing_commands = ClusterOutput(data_5)
R = ClusterOutput(merge_2)

# ==== cluster DFLURFixutres
number_slider = Slider(100, range=0..100)
F = ClusterInput()
mesh = Mesh(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)
X = UnitX(Factor=F)
turntablebase = Mesh(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)
move = Move(Geometry=mesh, Motion=X)  # -> Geometry, Transform
bbox = BoundingBox(Content=move.Geometry, Plane=PlaneXY(0, 0, 0))  # -> Box, Box_2
debrep = DeconstructBrep(Brep=bbox.Box)  # -> Faces, Edges, Vertices
area = Area(Geometry=debrep.Faces)  # -> Area, Centroid
mesh_2 = Mesh([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])
_140_circle_mount = Mesh(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)
pdecon = Deconstruct(Point=area.Centroid)  # -> XComponent, YComponent, ZComponent
item = ListItem(List=debrep.Faces, Index=Slider(4, range=0..10), Wrap=True)
extension_clay = Mesh(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)
sort = SortList(Keys=pdecon.ZComponent, ValuesA=area.Centroid)  # -> Keys, ValuesA
area_2 = Area(Geometry=item)  # -> Area, Centroid
_90_circle_mount = Mesh(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)
_50_riser_square = Mesh(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)
_100_plate_square = Mesh(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)
item_2 = ListItem(List=sort.ValuesA, Index=0, Wrap=True)
xy = XYPlane(Origin=Point(0, 0, 0))
extension = Mesh(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)
turntable = Mesh(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)
zoffset = Panel("24.5")
pdecon_2 = Deconstruct(Point=item_2)  # -> XComponent, YComponent, ZComponent
zoffset_2 = Panel("78")
mesh_3 = Mesh(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)
mjoin = MeshJoin(Meshes=[turntable, extension, _100_plate_square])
A = ClusterInput()
drawing_table = Mesh(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)
mjoin_2 = MeshJoin(Meshes=[turntable, extension, _50_riser_square])
zoffset_3 = Panel("19")
clay_cover = Mesh(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)
mjoin_3 = MeshJoin(Meshes=[turntable, clay_cover, mesh_2, _140_circle_mount])
mjoin_4 = MeshJoin(Meshes=[turntable, clay_cover, mesh_2])
mjoin_5 = MeshJoin(Meshes=[turntable, clay_cover])
zoffset_4 = Panel("-15")
zoffset_5 = Panel("3")
addition = Addition(A=zoffset, B=zoffset_2)
addition_2 = Addition(A=A, B=zoffset_4)
addition_3 = Addition(A=zoffset, B=zoffset_5)
addition_4 = Addition(A=addition_3, B=zoffset_2)
d2 = ClusterInput()
carttrack = Mesh([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])
carttabletop = Mesh(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)
merge = Merge(Data1=addition, Data2="500", Data3=turntablebase, Data4=mjoin_2)
tabletop = Mesh(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)
tabletrack = Mesh([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])
merge_2 = Merge(Data1=zoffset_3, Data2="500", Data3=drawing_table, Data4=mesh_3)
merge_3 = Merge(Data1=addition, Data2="500", Data3=turntablebase, Data4=mjoin)
merge_4 = Merge(Data1=zoffset, Data2="500", Data3=turntablebase, Data4=turntable)
merge_5 = Merge(Data1=addition_2, Data2=d2, Data3=mesh_3, Data4=mesh_3)
merge_6 = Merge(Data1=addition_3, Data2="500", Data3=turntablebase, Data4=mjoin_5)
merge_7 = Merge(Data1=addition_4, Data2="500", Data3=turntablebase, Data4=mjoin_3)
merge_8 = Merge(Data1="-7", Data2=flatten(pdecon_2.XComponent), Data3=flatten(move.Geometry))
merge_9 = Merge(Data1=carttabletop, Data2=flatten(carttrack))
merge_10 = Merge(Data1=tabletop, Data2=flatten(tabletrack))
i = ClusterInput()
merge_11 = Merge(Data1=graft(merge_9), Data2=graft(merge_10))
i_2 = ClusterInput()
merge_12 = Merge(
    Data1=graft(merge_5),
    Data2=graft(merge_2),
    Data3=graft(merge_4),
    Data4=graft(merge),
    Data5=graft(merge_3),
    Data6=graft(merge_6),
    Data7=graft(merge_7),
    Data8=graft(merge_8))
Y = UnitY(Factor=1)
move_2 = Move(Geometry=merge_12, Motion=Y)  # -> Geometry, Transform
item_3 = ListItem(List=merge_11, Index=i_2, Wrap=True)
item_4 = ListItem(List=merge_12, Index=i, Wrap=True)
A_2 = ClusterInput()
tabletop_2 = ListItem(List=flatten(item_3), Index=0, Wrap=True)
track = ListItem(List=flatten(item_3), Index=1, Wrap=True)
track_2 = ListItem(List=flatten(item_3), Index=2, Wrap=True)
tabletop_3 = ListItem(List=flatten(item_4), Index=0, Wrap=False)
track_3 = ListItem(List=flatten(item_4), Index=1, Wrap=False)
track_4 = ListItem(List=flatten(item_4), Index=2, Wrap=False)
track_5 = ListItem(List=flatten(item_4), Index=3, Wrap=False)
multiplication = Multiplication(A=A_2, B=-1)
pt = ConstructPoint(XCoordinate=multiplication, YCoordinate=0, ZCoordinate=0)
construct_point = ConstructPoint(XCoordinate=track_3, YCoordinate=0, ZCoordinate=tabletop_3)
i_3 = ClusterOutput(track_5)
adaptorplate = Mesh(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)
move_3 = Move(Geometry=tabletop_2, Motion=pt)  # -> Geometry, Transform
move_4 = Move(Geometry=[track, track_2], Motion=pt)  # -> Geometry, Transform
point = ClusterOutput(construct_point)
G = ClusterOutput(move_3.Geometry)
adaptorplate_2 = ClusterOutput(adaptorplate)
fixture_z = ClusterOutput(tabletop_3)
fixture_x = ClusterOutput(track_3)
G_2 = ClusterOutput(move_4.Geometry)
i_4 = ClusterOutput(track_4)

# ==== cluster IKEAPENCIL
pen_preview_colour = ColourSwatch(SwatchColor=RGB(120, 120, 120))
tool_name = Panel("ikea_pencil")
motion_type = ValueList({"Drawing": 0, "Painting": 1}, selected="Drawing")

pen_length = Slider(85.6, range=1..250)
pen_dia = Slider(7.5, range=6..16)
pen_weight_kg = Panel(".1")

use_calibrated_tcp = BooleanToggle(False)
pt = ConstructPoint(XCoordinate="0.33", YCoordinate="5.33", ZCoordinate="180.22")

paint_pot = ValueList({"1": 0, "2": 1}, selected="1")
drawing_curve = ClusterInput()
tool_pressue = ClusterInput()
tool_retract = ClusterInput()
new_pen_holder = BooleanToggle(True)
dfl_dr2_tool = DFLDR2Tool(
    relay_4=tool_name,
    relay_6=pen_preview_colour,
    relay_5=drawing_curve,
    new_pen_holder=new_pen_holder,
    A=pen_length,
    A_2=pen_dia,
    B=pen_weight_kg,
    G=use_calibrated_tcp,
    pt=pt,
    relay_3=motion_type,
    i=paint_pot,
    relay=tool_pressue,
    relay_2=tool_retract)  # -> tool, tcp, R
tool_centre_point = Panel(dfl_dr2_tool.tcp)
tcp = ClusterOutput(dfl_dr2_tool.tcp)
drawing_data = ClusterOutput(dfl_dr2_tool.R)

# ==== cluster DRPreview
T = ClusterInput()
D = ClusterInput()
deconstructtarget = DeconstructTarget(Target=T)  # -> Joints, Plane
preview_colours = SplitTree(Data=D, Masks=flatten("{?;2}"))  # -> Positive, Negative
clean = CleanTree(RemoveNulls=True, RemoveInvalid=True, RemoveEmpty=True, Tree=deconstructtarget.Plane)
G = ClusterInput()
pt = Point(Point(0, 0, 0.5))
trim = TrimTree(Tree=preview_colours.Positive, Depth=1)
pline = PolyLine(Vertices=clean, Closed=False)
move = Move(Geometry=G, Motion=pt)  # -> Geometry, Transform
col = Colour(trim)
G_2 = ClusterInput()
explode = Explode(Curve=pline, Recursive=True)  # -> Segments, Vertices
col_2 = ClusterOutput(col)
move_2 = Move(Geometry=explode.Segments, Motion=pt)  # -> Geometry, Transform
filter = StreamFilter(Gate=G_2, Stream0=move.Geometry, Stream1=move_2.Geometry)
s_0 = ClusterOutput(filter)

# ==== cluster DFLDR2Tool_2
new_pen_holder = ClusterInput()
new_pen_holder_2 = Number(new_pen_holder)
A = ClusterInput()
A_2 = ClusterInput()
B = ClusterInput()
pt = ClusterInput()
L = ClusterInput()
i = ClusterInput()
relay = ClusterInput()
relay_2 = ClusterInput()
relay_3 = ClusterInput()
relay_4 = ClusterInput()
relay_5 = ClusterInput()
relay_6 = ClusterInput()
G = ClusterInput()
pt_2 = Point(pt)
item = ListItem(List=L, Index=i, Wrap=True)
penholder1 = Cluster_3(A_2=A, B=B, A=A_2)  # -> R, i, flatten(R_2)
penholder2 = PenHolder2(A_2=A, A=A_2, B=B)  # -> R, G, simplify(mesh_4)
cluster = Cluster_3(A_2=A, B=B, A=A_2)  # -> R, i, R_2
filter = StreamFilter(Gate=new_pen_holder_2, Stream0=penholder1.R_2, Stream1=penholder2.mesh_4)
filter_2 = StreamFilter(Gate=new_pen_holder_2, Stream0=penholder1.R, Stream1=penholder2.R)
filter_3 = StreamFilter(Gate=new_pen_holder_2, Stream0=penholder1.i, Stream1=penholder2.G)
pln = Plane(flatten(filter_3))
num = Number(filter_2)
pl_origin = PlaneOrigin(Base=pln, Origin=pt_2)
filter_4 = StreamFilter(Gate=G, Stream0=pln, Stream1=pl_origin)
merge = Merge(Data1=pt_2, Data2=pln)
item_2 = ListItem(List=merge, Index=0, Wrap=True)
mesh = Mesh(filter)
create_tool = CreateTool(Name=flatten(relay_4), TCP=flatten(filter_4), Weight=flatten(num), Mesh=flatten(mesh))  # -> Tool, TCP
entwine = Entwine(
    Branch00=relay_4,
    Branch01=create_tool.Tool,
    Branch02=relay_6,
    Branch03=relay_5,
    Branch04=relay_3,
    Branch05=relay,
    Branch06=relay_2,
    Branch07=item,
    FlattenInputs=True)  # -> simplify(Result)
tool = ClusterOutput(create_tool.Tool)
tcp = ClusterOutput(create_tool.TCP)
R = ClusterOutput(entwine)

# ==== cluster DFLSTABILO
preview_colour = ClusterInput()
drawing_curve = ClusterInput()
tool_pressue = ClusterInput()
tool_name = Panel("Stabilo")
motion_type = ValueList({"Drawing": 0, "Painting": 1}, selected="Drawing")
pen_length = Slider(107, range=1..250)
pen_dia = Slider(7.5, range=6..16)
pen_weight_kg = Panel(".1")

use_calibrated_tcp = BooleanToggle(False)
pt = ConstructPoint(XCoordinate="0", YCoordinate="0", ZCoordinate="0")

paint_pot = ValueList({"1": 0, "2": 1}, selected="1")
retract = Slider(8, range=0..8)
new_pen_holder = BooleanToggle(True)
dfl_dr2_tool = DFLDR2Tool_2(
    relay_4=tool_name,
    relay_6=preview_colour,
    relay_5=drawing_curve,
    new_pen_holder=new_pen_holder,
    A=pen_length,
    A_2=pen_dia,
    B=pen_weight_kg,
    G=use_calibrated_tcp,
    pt=pt,
    relay_3=motion_type,
    i=paint_pot,
    relay=tool_pressue,
    relay_2=retract)  # -> tool, tcp, R
tool_centre_point = Panel(dfl_dr2_tool.tcp)
drawing_data = ClusterOutput(dfl_dr2_tool.R)

# ==== cluster DFLPAINTBRUSH
tool_name = Panel("DFL_PaintBrush")
motion_type = ValueList({"Drawing": 0, "Painting": 1}, selected="Painting")
brush_length = Slider(121, range=1..250)
brush_dia = Slider(6, range=6..16)
pen_weight_kg = Panel(".1")
use_calibrated_tcp = BooleanToggle(False)
pt = ConstructPoint(XCoordinate="0", YCoordinate="0", ZCoordinate="0")
preview_colour = ClusterInput()
drawing_curve = ClusterInput()
paint_pots = ClusterInput()
paint_pot_choice = ClusterInput()
tool_pressue = ClusterInput()
tool_retract = ClusterInput()
new_pen_holder = BooleanToggle(True)
dfl_dr2_tool = DFLDR2Tool_2(
    relay_4=tool_name,
    relay_6=preview_colour,
    relay_5=drawing_curve,
    new_pen_holder=new_pen_holder,
    A=brush_length,
    A_2=brush_dia,
    B=pen_weight_kg,
    G=use_calibrated_tcp,
    pt=pt,
    relay_3=motion_type,
    L=paint_pots,
    i=paint_pot_choice,
    relay=tool_pressue,
    relay_2=tool_retract)  # -> tool, tcp, R
tool_centre_point = Panel(dfl_dr2_tool.tcp)
drawing_data = ClusterOutput(dfl_dr2_tool.R)

# ==== cluster RBBoundingHatch
G = ClusterInput()
A = ClusterInput()
rotate = Rotate(Geometry=G, Angle=degrees(A), Plane=PlaneXY(0, 0, 0))  # -> Geometry, Transform
E = ClusterInput()
shift = ClusterInput()
G_2 = ClusterOutput(rotate.Geometry)
boundary = BoundarySurfaces(Edges=E)
brec = BoundingRectangle(Geometry=boundary, Plane=rotate.Geometry, Axis=0, Slide=0, Union=True)  # -> Bounding, DimensionX, DimensionY
offset = OffsetCurve(Curve=brec.Bounding, Distance=shift, Plane=G, Corners=1)
explode = Explode(Curve=offset, Recursive=True)  # -> Segments, Vertices
D = ClusterInput()
item = ListItem(List=explode.Segments, Index=0, Wrap=True)  # -> Item, Item1, Item2
crv = Curve(item.Item)
Z = UnitZ(Factor=D)
divdist = DivideDistance(Curve=item.Item1, Distance=D)  # -> Points, Tangents, Parameters
item_2 = ListItem(List=divdist.Points, Index=0, Wrap=True)
extr = Extrude(Base=boundary, Direction=Z)
move = Move(Geometry=extr, Motion=expr("-x/2", Z))  # -> Geometry, Transform
move2pt = MoveToPoint(Geometry=crv, PointA=item_2, PointB=divdist.Points)  # -> Moved, Vector, Transform
M = ClusterOutput(move2pt.Moved)
G_3 = ClusterOutput(move.Geometry)

# ==== cluster DFLPaperSetup
A = ClusterInput()
A_2 = ClusterInput()
A_3 = ClusterInput()
X = ClusterInput()
subtraction = Subtraction(A=A, B=15)
multiplication = Multiplication(A=A_3, B=-0.5)
multiplication_2 = Multiplication(A=A_3, B=0.5)
multiplication_3 = Multiplication(A=A_2, B=-0.5)
multiplication_4 = Multiplication(A=A_2, B=0.5)
pt = ConstructPoint(XCoordinate=X, YCoordinate=0, ZCoordinate=subtraction)
dom = ConstructDomain(DomainStart=multiplication, DomainEnd=multiplication_2)
dom_2 = ConstructDomain(DomainStart=multiplication_3, DomainEnd=multiplication_4)
xy = XYPlane(Origin=pt)
I = ClusterOutput(dom)
I_2 = ClusterOutput(dom_2)
P = ClusterOutput(xy)

# ==== cluster DFLCrvToPln: Turns Curves to Polylines, then divides Curved Sections Basesd on a tollarance input, Positions a plane at each point
C = ClusterInput()
td = ClusterInput()
topoly = CurveToPolyline(Curve=C, ToleranceDistance=td, ToleranceAngle=0)  # -> Polyline, Segments
cp = ControlPoints(Curve=topoly.Polyline)  # -> Points, Weights, Knots
B = ClusterInput()
pl_origin = PlaneOrigin(Base=B, Origin=cp.Points)
pl = ClusterOutput(pl_origin)

# ==== cluster DFLToolTest
data = ClusterInput()
pln = ClusterInput()
pln_2 = ClusterInput()
tool_name = ClusterInput()
data_2 = ClusterInput()
data_3 = Data(data)
pln_3 = Plane(pln)
pln_4 = Plane(pln_2)
data_4 = Data(data_2)
item = ListItem(List=flatten(pln_4), Index=0, Wrap=True)
Z = UnitZ(Factor="20")
Z_2 = UnitZ(Factor="0")
inital_pose_axis_values_in_degrees = Panel("""0
-90
0
-90
0
0""")
pen_change_pose_av_degrees = Panel("""9
-50
-126
-37
83
0""")
move = Move(Geometry=pln_3, Motion=Z_2)  # -> Geometry, Transform
pln_5 = Plane(item)
move_2 = Move(Geometry=pln_3, Motion=Z)  # -> Geometry, Transform
pln_6 = Plane(item)
pl_origin = PlaneOrigin(Base=pln_5, Origin=move.Geometry)
pl_origin_2 = PlaneOrigin(Base=pln_6, Origin=move_2.Geometry)

# ---- group: Linear Movements
controlled_speed = Panel("100")
list = ValueList({"Joint", "Linear"}, selected="Linear")
createtarget = CreateTarget(Plane=pl_origin_2, Motion=list, Tool=data_4, Speed=controlled_speed, Zone="0.1", IsCartesian=True)

# ----
degrees_to_radians = DegreesToRadians(Degrees=inital_pose_axis_values_in_degrees, RobotSystem=data_3, MechanicalGroup=0)
degrees_to_radians_2 = DegreesToRadians(Degrees=pen_change_pose_av_degrees, RobotSystem=data_3, MechanicalGroup=0)
popup_title_no_spaces = Panel("Adjust_pen")
Z_3 = UnitZ(Factor="41")
popup_title_no_spaces_2 = Panel("Adjust pen height so pen tip lightly rests on spacer")
popup_title_no_spaces_3 = Panel("Insert_Spacer")
popup_title_no_spaces_4 = Panel("press continue to lower to 20mm slowly")
item_2 = ListItem(List=flatten(data_4), Index=0, Wrap=True)
move_3 = Move(Geometry=pln_3, Motion=Z_3)  # -> Geometry, Transform
pln_7 = Plane(item)
item_3 = ListItem(List=flatten(data_4), Index=-1, Wrap=True)
concat = Concatenate(FragmentA="Insert ", FragmentB=tool_name, FragmentC=" and Click continue to resume")

# ---- group: Pen Change
pen_change_pose_av_degrees_2 = Panel("""24.38
-106.28
-87.02
-168.27
24.22
46.25""")
popup_title_no_spaces_5 = Panel("Insert_pen")
popup_text = Panel(concat)
degrees_to_radians_3 = DegreesToRadians(Degrees=pen_change_pose_av_degrees_2, RobotSystem=data_3, MechanicalGroup=0)
dfl_ur_custom_popup = DFLURCustomPopup(N=popup_title_no_spaces_5, B=popup_text)
createtarget_2 = CreateTarget(
    Joints=degrees_to_radians_2,
    Tool=data_4,
    Speed=controlled_speed,
    Zone="0.1",
    Command=dfl_ur_custom_popup,
    IsCartesian=False)

# ----
pl_origin_3 = PlaneOrigin(Base=pln_7, Origin=move_3.Geometry)
panel = Panel("Please ensurethat DFL staff have set up the Robot, and that you have reviewed the simulation in Grasshopper or on the SmartPad")

# ---- group: Inital Pose
# Robotic Commands
popup_title_no_spaces_6 = Panel("Operator_Safety_Pen_test")
dfl_ur_custom_popup_2 = DFLURCustomPopup(N=popup_title_no_spaces_6, B=panel)
create_target = CreateTarget(IsCartesian=False)

# ----
dfl_ur_custom_popup_3 = DFLURCustomPopup(N=popup_title_no_spaces, B=popup_title_no_spaces_2)
dfl_ur_custom_popup_4 = DFLURCustomPopup(N=popup_title_no_spaces_3, B=popup_title_no_spaces_4)

popup_title_no_spaces_7 = Panel("Job_Done")
popup_text_2 = Panel("Job Complete! Please put all the caps back on the pens and tidy up!")
dfl_ur_custom_popup_5 = DFLURCustomPopup(N=popup_title_no_spaces_7, B=popup_text_2)
createtarget_3 = CreateTarget(
    Joints=degrees_to_radians_2,
    Tool=item_3,
    Speed=controlled_speed,
    Zone="0.1",
    Command=[dfl_ur_custom_popup_2, dfl_ur_custom_popup_5],
    IsCartesian=False)

# ---- group: Linear Movements
controlled_speed_2 = Panel("2")
list_2 = ValueList({"Joint", "Linear"}, selected="Linear")
createtarget_4 = CreateTarget(
    Plane=pl_origin,
    Motion=list_2,
    Tool=data_4,
    Speed=controlled_speed_2,
    Zone="0.1",
    Command=dfl_ur_custom_popup_3,
    IsCartesian=True)

list_3 = ValueList({"Joint", "Linear"}, selected="Linear")
createtarget_5 = CreateTarget(Plane=pl_origin_3, Motion=list_3, Tool=data_4, Speed=controlled_speed, Zone="0.1", IsCartesian=True)

# ----
createtarget_6 = CreateTarget(
    Joints=degrees_to_radians,
    Tool=item_2,
    Speed=controlled_speed,
    Zone="0.1",
    Command=dfl_ur_custom_popup_2,
    IsCartesian=False)

# ---- group: Order Program
weave = Weave(
    Pattern=[0, 1, 2, 3],
    Stream0=createtarget_2,
    Stream1=createtarget,
    Stream2=createtarget_4,
    Stream3=createtarget_5,
    NullGaps=False)
merge = Merge(Data1=flatten(weave), Data2=createtarget_3)  # -> flatten(Result)

# ----
panel_2 = Panel(merge)
robot_system = ClusterInput()
A = ClusterInput()
concat_2 = Concatenate(FragmentA=A, FragmentB="_pentest")
create_program = CreateProgram(Name=concat_2, RobotSystem=robot_system, Targets=merge, StepSize=1)  # -> Program, Code, Duration, Warnings, Errors
program = ClusterOutput(create_program.Program)

# ==== cluster DFLWeaver
relay = ClusterInput()
relay_2 = ClusterInput()
relay_3 = ClusterInput()
relay_4 = ClusterInput()
relay_5 = ClusterInput()
drawing_motions = TrimTree(Tree=relay, Depth=1)
paint_motions = TrimTree(Tree=relay_4, Depth=1)
filter = StreamFilter(Gate=relay_2, Stream0=relay, Stream1=drawing_motions)
filter_2 = StreamFilter(Gate=relay_2, Stream0=relay_4, Stream1=paint_motions)
gtp5_py3_sel_branch = Python3Script(A=filter, B=filter_2, M=relay_5)  # -> D, R; inputs A: tree, B: tree, M: tree
# ---------- gtp5_py3_sel_branch: Python ----------
# Drop-in: choose Drawing vs Painting per branch using a mask tree.
# Works with masks at {tool} or deeper (e.g. {tool;stroke}); mask prefixes apply to subpaths.
# Keeps original GH_Goo types (no unwrapping).

from Grasshopper import DataTree
from Grasshopper.Kernel.Data import GH_Path
from Grasshopper.Kernel.Types import GH_Boolean, GH_Number, GH_Integer, GH_String

def to_paths(T):
    try: return list(T.Paths)
    except: return []

def unwrap_bool(v):
    # Accept GH_* wrappers and plain types/strings
    if isinstance(v, GH_Boolean): return bool(v.Value)
    if isinstance(v, (GH_Number, GH_Integer)): return v.Value != 0
    if isinstance(v, GH_String):
        s = v.Value.strip().lower()
        if s in ("true","t","yes","y","on","1"): return True
        if s in ("false","f","no","n","off","0"): return False
        try: return float(s) != 0.0
        except: return False
    if isinstance(v, bool): return v
    if isinstance(v, (int, float)): return v != 0
    if isinstance(v, str):
        s = v.strip().lower()
        if s in ("true","t","yes","y","on","1"): return True
        if s in ("false","f","no","n","off","0"): return False
        try: return float(s) != 0.0
        except: return False
    return False

def starts_with(full_path, prefix_path):
    # Allow mask {0} to match {0;*}; longest prefix (deepest) will win.
    fi = list(full_path.Indices)
    pi = list(prefix_path.Indices)
    if len(pi) > len(fi): return False
    for i in range(len(pi)):
        if fi[i] != pi[i]: return False
    return True

def build_mask_pairs(M):
    # Collect (mask_path, bool), sort deepest first so longest prefix wins
    pairs = []
    for mp in to_paths(M):
        br = M.Branch(mp)
        if br and br[0] is not None:
            pairs.append((mp, unwrap_bool(br[0])))
    pairs.sort(key=lambda t: len(t[0].Indices), reverse=True)
    return pairs

def choose_source_for_path(p, mask_pairs, A, B):
    # Default to DRAW(A); apply first (deepest) matching mask prefix
    paint = False
    for mp, val in mask_pairs:
        if starts_with(p, mp):
            paint = val
            break
    return (B if paint else A), ("PAINT(B)" if paint else "DRAW(A)")

def pick_whole_branches_keep_types(A, B, M):
    D = []
    R = DataTree[object]()
    mask_pairs = build_mask_pairs(M)

    # If mask empty, default to DRAW(A) for everything
    if not mask_pairs:
        for p in to_paths(A):
            for it in A.Branch(p): R.Add(it, p)
        D.append("Mask empty → using DRAW(A) for all branches")
        return R, D

    D.append("Mask pairs (deepest-first): %s" % ["%s=%s"%(mp, v) for mp,v in mask_pairs])

    # Union of paths from A and B so we preserve any branches present in either
    union_paths = []
    for p in to_paths(A):
        if p not in union_paths: union_paths.append(p)
    for p in to_paths(B):
        if p not in union_paths: union_paths.append(p)

    D.append("Paths: A=%d, B=%d, union=%d" % (len(to_paths(A)), len(to_paths(B)), len(union_paths)))

    for p in union_paths:
        src, label = choose_source_for_path(p, mask_pairs, A, B)
        if src.PathExists(p):
            br = src.Branch(p)
            D.append("%s -> %s  items=%d" % (p, label, len(br)))
            for it in br:
                R.Add(it, p)  # keep original GH_Goo/Target types
        else:
            # Chosen source lacks this branch; skip but log it
            D.append("%s -> %s  (chosen source has no branch)" % (p, label))

    return R, D

R, D = pick_whole_branches_keep_types(A, B, M)
# ---------- end gtp5_py3_sel_branch ----------
filter_3 = StreamFilter(Gate=relay_5, Stream0=filter, Stream1=filter_2)
filter_4 = StreamFilter(Gate=relay_2, Stream0=filter_3, Stream1=gtp5_py3_sel_branch.R)
merge = Merge(Data1=relay_3, Data2=filter_4)
weave = Weave(Pattern=[0, 1], Stream0=relay_3, Stream1=filter_4, NullGaps=False)
filter_5 = StreamFilter(Gate=relay_2, Stream0=merge, Stream1=weave)
s_0 = ClusterOutput(filter_5)

# ==== cluster MoreThan1
T = ClusterInput()
trim = TrimTree(Tree=T, Depth=1)
tstat = TreeStatistics(Tree=trim)  # -> Paths, Length, Count
lng = ListLength(List=tstat.Paths)
larger = LargerThan(FirstNumber=lng, SecondNumber="1")  # -> LargerThan, OrEqualTo
bool = Boolean(larger.LargerThan)
bool_2 = ClusterOutput(bool)

# ==== cluster DFLDR2Tool
new_pen_holder = ClusterInput()
new_pen_holder_2 = Number(new_pen_holder)
A = ClusterInput()
A_2 = ClusterInput()
B = ClusterInput()
pt = ClusterInput()
L = ClusterInput()
i = ClusterInput()
relay = ClusterInput()
relay_2 = ClusterInput()
relay_3 = ClusterInput()
relay_4 = ClusterInput()
relay_5 = ClusterInput()
relay_6 = ClusterInput()
G = ClusterInput()
pt_2 = Point(pt)
item = ListItem(List=L, Index=i, Wrap=True)
penholder1 = Cluster_3(A_2=A, B=B, A=A_2)  # -> R, i, flatten(R_2)
penholder2 = PenHolder2(A_2=A, A=A_2, B=B)  # -> R, G, simplify(mesh_4)
cluster = Cluster_3(A_2=A, B=B, A=A_2)  # -> R, i, R_2
filter = StreamFilter(Gate=new_pen_holder_2, Stream0=penholder1.R_2, Stream1=penholder2.mesh_4)
filter_2 = StreamFilter(Gate=new_pen_holder_2, Stream0=penholder1.R, Stream1=penholder2.R)
filter_3 = StreamFilter(Gate=new_pen_holder_2, Stream0=penholder1.i, Stream1=penholder2.G)
num = Number(filter_2)
pln = Plane(flatten(filter_3))
pl_origin = PlaneOrigin(Base=pln, Origin=pt_2)
filter_4 = StreamFilter(Gate=G, Stream0=pln, Stream1=pl_origin)
merge = Merge(Data1=pt_2, Data2=pln)
item_2 = ListItem(List=merge, Index=0, Wrap=True)
mesh = Mesh(filter)
create_tool = CreateTool(Name=flatten(relay_4), TCP=flatten(filter_4), Weight=flatten(num), Mesh=flatten(mesh))  # -> Tool, TCP
entwine = Entwine(
    Branch00=relay_4,
    Branch01=create_tool.Tool,
    Branch02=relay_6,
    Branch03=relay_5,
    Branch04=relay_3,
    Branch05=relay,
    Branch06=relay_2,
    Branch07=item,
    FlattenInputs=True)  # -> simplify(Result)
tool = ClusterOutput(create_tool.Tool)
tcp = ClusterOutput(create_tool.TCP)
R = ClusterOutput(entwine)

# ==== cluster DFLURCustomPopup
N = ClusterInput()
B = ClusterInput()
concat = Concatenate(
    FragmentA="popup (\"",
    FragmentB=B,
    FragmentC="\", title=\"",
    FragmentD=N,
    FragmentE="\", warning=False, error=False, blocking=True)")
customcmd = CustomCommand(Name=N, Manufacturer="UR", Code=concat)
C = ClusterOutput(customcmd)

# ==== cluster Cluster_3
A = ClusterInput()
mesh = Mesh(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)
pen_length_offset = Panel("-1")
pen_v_block_offset_mm = Panel("16")
holder_weight = Panel(".133")
division = Division(A=Slider(10, range=0..10), B=2)
pt = ConstructPoint(XCoordinate=division, YCoordinate=division, ZCoordinate=0)
B = ClusterInput()
addition = Addition(A=holder_weight, B=B)
xy = XYPlane(Origin=pt)
A_2 = ClusterInput()
R = ClusterOutput(addition)
cir = Circle(Plane=xy, Radius=division)
pt_2 = Point(Point(0, 0, 0))
subtraction = Subtraction(A=A_2, B=pen_length_offset)
pt_3 = ConstructPoint(XCoordinate=0, YCoordinate=0, ZCoordinate="1")
ln = Line(StartPoint=pt_2, EndPoint=pt_3)
rotax = RotateAxis(Geometry=cir, Angle=degrees("45"), Axis=ln)  # -> Geometry, Transform
pt_4 = ConstructPoint(XCoordinate="1", YCoordinate=0, ZCoordinate=0)
ln_2 = Line(StartPoint=pt_2, EndPoint=pt_4)
rotax_2 = RotateAxis(Geometry=rotax.Geometry, Angle=degrees("90"), Axis=ln_2)  # -> Geometry, Transform
pt_5 = ConstructPoint(XCoordinate=0, YCoordinate=subtraction, ZCoordinate=pen_v_block_offset_mm)
merge = Merge(Data1=division, Data2=division)
move = Move(Geometry=rotax_2.Geometry, Motion=pt_5)  # -> Geometry, Transform
pt_6 = ConstructPoint(XCoordinate=0, YCoordinate=0, ZCoordinate="1")
lng = ListLength(List=merge)
ln_3 = Line(StartPoint=pt_2, EndPoint=pt_6)
range = Range(Domain="0 to 1", Steps=expr("x-1", lng))
rotax_3 = RotateAxis(Geometry=move.Geometry, Angle=degrees("-45"), Axis=ln_3)  # -> Geometry, Transform
pen_visulaization_hack = GraphMapper(range, x0=0, x1=1, y0=0, y1=1, container_name="Bezier", cpx=[0, 0.1894655079, 0, 1], cpy=[0, 0.6900714636, 1, 1])
area = Area(Geometry=rotax_3.Geometry)  # -> Area, Centroid
pdecon = Deconstruct(Point=area.Centroid)  # -> XComponent, YComponent, ZComponent
pt_7 = ConstructPoint(XCoordinate=0, YCoordinate=0, ZCoordinate=pdecon.ZComponent)
ln_4 = Line(StartPoint=pt_7, EndPoint=area.Centroid)
vpipe = PipeVariable(Curve=ln_4, Parameters=pen_visulaization_hack, Radii=merge, Caps=2)
mesh_2 = MeshBrep(
    Brep=vpipe,
    Settings={GridMaxCount=0, GridMinCount=16, JaggedSeams=False, MaxEdgeLength=0, MinEdgeLength=0.0001, MinTolerance=0, Refine=True, RefineAngle=0, RelativeTolerance=0.65, SimplePlanes=True, Tolerance=0})
pframes = PerpFrames(Curve=ln_4, Count="1", Align=True)  # -> Frames, Parameters
munion = MeshUnion(Meshes=flatten([mesh, mesh_2]))
R_2 = ClusterOutput(munion)
item = ListItem(List=pframes.Frames, Index=1, Wrap=True)
i = ClusterOutput(item)

# ==== cluster PenHolder2
pen_v_block_offset_mm = Panel("50")
pen_length_offset = Panel("-2")
holder_weight = Panel(".133")
mesh = Mesh(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)
B = ClusterInput()
addition = Addition(A=holder_weight, B=B)
A = ClusterInput()
A_2 = ClusterInput()
division = Division(A=A, B=2)
subtraction = Subtraction(A="10.1", B=division)
R = ClusterOutput(addition)
pt = ConstructPoint(XCoordinate=subtraction, YCoordinate=0, ZCoordinate=0)
multiplication = Multiplication(A=subtraction, B="0.9")
addition_2 = Addition(A=pen_v_block_offset_mm, B=pen_length_offset)
addition_3 = Addition(A=A_2, B=addition_2)
pt_2 = ConstructPoint(XCoordinate=pt, YCoordinate=0, ZCoordinate=pen_v_block_offset_mm)
pt_3 = ConstructPoint(XCoordinate=pt, YCoordinate=0, ZCoordinate=addition_3)
merge = Merge(Data1=division, Data2=division)
ln = Line(StartPoint=pt_2, EndPoint=pt_3)
lng = ListLength(List=merge)
range = Range(Domain="0 to 1", Steps=expr("x-1", lng))
pen_visulaization_hack = GraphMapper(
    range,
    x0=0,
    x1=1,
    y0=0,
    y1=1,
    container_name="Bezier",
    cpx=[0, 0.1894655079, 0.002457328374, 1],
    cpy=[0, 0.6900714636, 1, 1])
subtraction_2 = Subtraction(A=division, B=1)
vpipe = PipeVariable(Curve=ln, Parameters=pen_visulaization_hack, Radii=merge, Caps=0, FitRail=False)
cap = CapHoles(Brep=vpipe)
filedge = FilletEdge(Shape=cap, Blend=1, Metric=0, Edges=2, Radii=subtraction_2)
pframes = PerpFrames(Curve=ln, Count="1", Align=True)  # -> Frames, Parameters
mesh_2 = MeshBrep(
    Brep=filedge,
    Settings={GridMaxCount=0, GridMinCount=16, JaggedSeams=False, MaxEdgeLength=0, MinEdgeLength=0.0001, MinTolerance=0, Refine=True, RefineAngle=0, RelativeTolerance=0.65, SimplePlanes=True, Tolerance=0})  # -> flatten(Mesh)
munion = MeshUnion(Meshes=[mesh, mesh_2])
item = ListItem(List=pframes.Frames, Index=1, Wrap=True)
mesh_3 = Mesh(munion)
rot3d = Rotate3D(Geometry=item, Angle=degrees("180"), Center=pt_2, Axis=Vector(0, 0, 1))  # -> Geometry, Transform
mesh_4 = ClusterOutput(mesh_3)
G = ClusterOutput(rot3d.Geometry)
