# Grasshopper definition DFLUR5_HW_T32026.gh (Grasshopper 1.0.8)
# plug-ins: Robots, Bifocals

# ---- group: Setup Fixture
# DFL HW - Drawing and Painting
# info: Written by Richard Blackwell and Charlotte firth for the Design Futures Lab and BENV2001
fixture_in_use = ValueList({"Custom Fixture": 0, "Draw Table": 1, "Turn Table": 2, "Turn Riser (60)": 3, "Turn Riser (90)": 4}, selected="Turn Riser (60)")
robot_placement = ValueList({"Cart": 0, "Table": 1}, selected="Cart")
adaptor_distance_from_table_edge = Slider(74, range=0..600)

# ----
# Foam Stock Dims
length_x = Slider(100, range=0..420)
width_y = Slider(100, range=0..420)
height_z = Slider(300, range=0..420)

# ----
# Calibrated Offsets
z_shift = Slider(0, range=-5..5)

list = RobotsLibrary(
    {"AA-KR60", "AA-KR30", "AA-KR60_KR30", "UR3e", "UR5e", "UR10e", "UR16e", "UR3", "UR5", "UR10", "UR20", "UR30"}, selected="UR5",
    Type=0)
# Robot Setup
loadrobot = LoadRobotSystem(Name=list, Base=PlaneXY(0, 0, 0))

controlled_speed = Slider(10, range=1..100)
zone_accuracy = Slider(1, range=-0.01..2)
transfer_speed = Slider(100, range=1..100)

# ---- group: Srf Input
srf = Surface(<surface referenced from the Rhino model>)

# ----
number_of_points = Slider(70, range=0..100)
Z = UnitZ(Factor="10")

robot_tilt_y = Slider(-37, range=-60..60)

# ---- group: Save URP
select_a_directory = FilePath("/Volumes/DFL 3DP/")
set_as_your_usb_drive = Panel(select_a_directory)

# ---- group: Save URP / Project Name
project_name_no_spaces = Panel("BENV2001HW")

# ----
initial_plane_z = Slider(50, range=0..100)
model_cutoff_offset = Slider(8, range=2..100)
safe_distance = Slider(30, range=0..100)
get_latest_calibration_data = Button()
robot_in_use = ValueList({"Charlie": 0, "Darcy": 1}, selected="Charlie")

silluete_resolution = Slider(15, range=1..101)
num = Number(model_cutoff_offset)
start_z_offset = Slider(10, range=1..100)
zsafe_height = Panel(num)
list_2 = ValueList({"Cut Whole": 0, "Cut Half": 1}, selected="Cut Whole")

# ----
# Foam Setup
foam_stock = ColourSwatch(SwatchColor=RGB(0, 217, 255))
cluster = Cluster_3(
    G=fixture_in_use,
    panel_5=robot_in_use,
    A=length_x,
    A_2=width_y,
    F_3=height_z,
    F_2=safe_distance,
    F=z_shift,
    trigger=get_latest_calibration_data)  # -> P, flatten(geometry), flatten(G_2), G_3, flatten(P_2), custom_calib_msg

panel = Panel(cluster.custom_calib_msg)

# ---- group: End Effector
cutting_direction = ValueList({"Outward": 0, "Inward": 1}, selected="Outward")
hw_tilt_y = Slider(24, range=-60..60)
opperation = ValueList({"HW1 Single Curve": 0, "HW2 Ruled Srf": 1, "HW3 Sillouette": 2}, selected="HW2 Ruled Srf")
tool = ValueList({"HW cutter Wide": 0, "HW cutter Narrow": 1}, selected="HW cutter Narrow")
robot_initial_pose = RobotInitialPose(A=degrees(hw_tilt_y), G=cluster.G_3, F=initial_plane_z)
tool_2 = Tool(i=tool)  # -> tool, tcp
num_2 = Number(opperation)

# ---- group: Move from zero
xy = XYPlane(Origin=Point(0, 0, 0))
orient = Orient(Source=xy, Target=cluster.geometry)  # -> Geometry, Transform

xy_2 = XYPlane(Origin=Point(0, 0, 0))
orient_2 = Orient(Source=xy_2, Target=cluster.geometry)  # -> Geometry, Transform

# ----
guide = Guide(G=cutting_direction)
robot_initial_plane = Plane(robot_initial_pose)

# ---- group: Orient Planes
base_plane = Plane(cluster.geometry)
yz = YZPlane(Origin=Point(0, 0, 0))
rotate = Rotate(Geometry=base_plane, Angle=degrees("180"), Plane=yz)  # -> Geometry, Transform
hw_tilt_y_deg = Panel(hw_tilt_y)
xz = XZPlane(Origin=Point(0, 0, 0))
rotate_2 = Rotate(Geometry=rotate.Geometry, Angle=degrees(hw_tilt_y_deg), Plane=xz)  # -> Geometry, Transform
pln = Plane(rotate_2.Geometry)

# ----
cutting_guide_crv = Curve(guide)

yz_2 = YZPlane(Origin=Point(0, 0, 0))
base_plane_2 = Plane(cluster.geometry)
rotate_3 = Rotate(Geometry=base_plane_2, Angle=degrees("180"), Plane=yz_2)  # -> Geometry, Transform

multiplication = Multiplication(A=robot_tilt_y, B=-1)
xz_2 = XZPlane(Origin=Point(0, 0, 0))
rotate_4 = Rotate(Geometry=rotate_3.Geometry, Angle=degrees(multiplication), Plane=xz_2)  # -> Geometry, Transform

# ---- group: Setup Fixture
# Fixture Setup
dfl_ur_fixutres = DFLURFixutres(A=adaptor_distance_from_table_edge, i=robot_placement, panel=cluster.P, i_2=fixture_in_use)  # -> G, adaptorplate_2, i_4, i_3
table = ColourSwatch(SwatchColor=RGB(217, 185, 126))
table_2 = CustomPreview(Geometry=dfl_ur_fixutres.G, Material=table)
mounts = CustomPreview(Geometry=dfl_ur_fixutres.adaptorplate_2, Material=ColourSwatch(SwatchColor=RGBA(152, 149, 158, 165)))

# ---- group: DEMO
hw2_ruled_srf_edge_crv = Curve(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)
hw2_ruled_srf_edge_crv_2 = Curve(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)
h1_cutting_curves = Curve(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)

# ---- group: Rules Srf from curves
hw2_ruled_srf_edge_crv_3 = Curve(hw2_ruled_srf_edge_crv_2)
hw2_ruled_srf_edge_crv_4 = Curve(hw2_ruled_srf_edge_crv)
cutting_guide_crv_2 = Curve(guide)
ruled_srf_guide_curve = RuledSrfGuideCurve(C_2=hw2_ruled_srf_edge_crv_3, C=hw2_ruled_srf_edge_crv_4, relay=cutting_guide_crv_2)

# ----
hw1_cutting_curves = Curve(h1_cutting_curves)
safe_radial_planes = Plane(cluster.P_2)

merge = Merge(Data1=ruled_srf_guide_curve)

# ---- group: Sort Curves
cutting_guide_crv_3 = Curve(guide)
flip = FlipCurve(Curve=hw1_cutting_curves, Guide=cutting_guide_crv_3)  # -> Curve, Flag
sort_top_to_bottom = SortTopToBottom(surface=flip.Curve)
foam_stock_2 = Brep(cluster.G_2)
ruled_srf_profile = RuledSrfProfile(relay=hw1_cutting_curves, L=safe_radial_planes)
split_for_lowest = SplitForLowest(B=foam_stock_2, C=ruled_srf_profile)  # -> flatten(i)

# ---- group: Split stock by ruled srf
foam_stock_3 = Brep(cluster.G_2)
sort_top_to_bottom_2 = SortTopToBottom(surface=merge)
split_for_lowest_2 = SplitForLowest(B=foam_stock_3, C=sort_top_to_bottom_2)  # -> flatten(i)

# ---- group: Trim Edge Curves to stock
edges = BrepEdges(Brep=split_for_lowest_2)  # -> Naked, Interior, NonManifold
curvepoint = PointOnCurve(edges.Naked, parameter=0.5)
item = ListItem(List=cluster.P_2, Index=1, Wrap=True)  # -> Item, Item1, Item2
dist = Distance(PointA=curvepoint, PointB=item.Item2)
dist_2 = Distance(PointA=curvepoint, PointB=item.Item)
sort = SortList(Keys=dist, ValuesA=edges.Naked)  # -> Keys, ValuesA
sort_2 = SortList(Keys=dist_2, ValuesA=edges.Naked)  # -> Keys, ValuesA
item_2 = ListItem(List=sort_2.ValuesA, Index=0, Wrap=True)
item_3 = ListItem(List=sort.ValuesA, Index=0, Wrap=True)

# ----
bypass_curve_trimming = BooleanToggle(True)
hw2_ruled_srf_edge_crv_5 = Curve(hw2_ruled_srf_edge_crv)
hw2_ruled_srf_edge_crv_6 = Curve(hw2_ruled_srf_edge_crv_2)

# ---- group: Convert to planes
topoly = CurveToPolyline(Curve=sort_top_to_bottom, ToleranceDistance=Slider(0.8, range=0..10), ToleranceAngle=0)  # -> Polyline, Segments
cp = ControlPoints(Curve=topoly.Polyline)  # -> Points, Weights, Knots
pl_origin = PlaneOrigin(Base=pln, Origin=cp.Points)

# ----
filter = StreamFilter(Gate=bypass_curve_trimming, Stream0=item_2, Stream1=hw2_ruled_srf_edge_crv_6)
filter_2 = StreamFilter(Gate=bypass_curve_trimming, Stream0=item_3, Stream1=hw2_ruled_srf_edge_crv_5)
flip_2 = FlipCurve(Curve=filter_2, Guide=cutting_guide_crv)  # -> Curve, Flag
flip_3 = FlipCurve(Curve=filter, Guide=cutting_guide_crv)  # -> Curve, Flag
tweencrv = TweenCurve(CurveA=flip_3.Curve, CurveB=flip_2.Curve, Factor=0.5, BlendType=0)
divide = DivideCurve(Curve=tweencrv, Count=number_of_points, Kinks=False)  # -> simplify(Points), Tangents, Parameters
divide_2 = DivideCurve(Curve=flip_3.Curve, Count=number_of_points, Kinks=False)  # -> simplify(Points), Tangents, Parameters
move = Move(Geometry=divide.Points, Motion=Z)  # -> Geometry, Transform
pl_3pt = Plane3Pt(PointA=divide.Points, PointB=divide_2.Points, PointC=move.Geometry)
rotate_5 = Rotate(Geometry=pl_3pt, Angle=degrees("90"), Plane=pl_3pt)  # -> Geometry, Transform

# ---- group: Reorient Planes
list_3 = ValueList({"0 deg": 0, "90 deg": 90, "180 deg": 180, "270 deg": 270, "360 deg": 360}, selected="270 deg")
list_4 = ValueList({"x": 0, "y": 1, "z": 2}, selected="y")
dfl_re_orient_planes = DFLReOrientPlanes(planes=rotate_5.Geometry, rotation_axis=list_4, quad_rotate=list_3)

list_5 = ValueList({"0 deg": 0, "90 deg": 90, "180 deg": 180, "270 deg": 270, "360 deg": 360}, selected="180 deg")
list_6 = ValueList({"x": 0, "y": 1, "z": 2}, selected="z")
dfl_re_orient_planes_2 = DFLReOrientPlanes(planes=dfl_re_orient_planes, rotation_axis=list_6, quad_rotate=list_5)

# ----
turn_table_rotations = ValueList({"0 (0 Deg)": 0, "1 (22.5 Deg)": 1, "2 (45 Deg)": 2, "3 (67.5 Deg)": 3, "4 (90 Deg)": 4, "5 (112.5 Deg)": 5, "6 (135 Deg)": 6, "7 (157.5 Deg)": 7, "8 (180 Deg)": 8}, selected=["0 (0 Deg)", "4 (90 Deg)"])
turn_table_rotations_2 = ValueList({"0 (0 Deg)": 0, "1 (22.5 Deg)": 1, "2 (45 Deg)": 2, "3 (67.5 Deg)": 3, "4 (90 Deg)": 4, "5 (112.5 Deg)": 5, "6 (135 Deg)": 6, "7 (157.5 Deg)": 7, "8 (180 Deg)": 8}, selected=["0 (0 Deg)", "1 (22.5 Deg)", "2 (45 Deg)", "3 (67.5 Deg)", "4 (90 Deg)", "5 (112.5 Deg)", "6 (135 Deg)", "7 (157.5 Deg)", "8 (180 Deg)"])
cluster_2 = Cluster_4(
    P=cluster.geometry,
    kn_fixture_mesh=dfl_ur_fixutres.i_3,
    stock_brep=cluster.G_2,
    z_plane=cluster.G_3,
    radial_planes=cluster.P_2,
    initial_plane=robot_initial_plane,
    i=turn_table_rotations_2)  # -> rotated_tt_guide, rotated_workplane, rotated_fixture, rotated_stock_2, rotated_z_safe_plane, rotated_radial_planes_2, rotated_radial_planes, num_2
pln_2 = Plane(cluster_2.rotated_workplane)
pln_3 = Plane(cluster_2.rotated_radial_planes_2)
pln_4 = Plane(cluster_2.rotated_radial_planes)
pln_5 = Plane(cluster_2.rotated_z_safe_plane)
example_cone = Cone(Base=PlaneXY(0, 0, 0), Radius=expr("x/2", length_x), Length=height_z)  # -> Cone, Tip

# ---- group: Turntable Rotate Preview
crv = Curve()
filter_3 = StreamFilter(Gate=num_2, Stream0=crv, Stream1=crv, Stream2=cluster_2.rotated_tt_guide)
tt_guide = CustomPreview(Geometry=filter_3, Material=ColourSwatch(SwatchColor=RGB(0, 0, 0)))

# ---- group: Handy NU Scaling
scale_nu = ScaleNU(Plane=pln_2, ScaleX=1, ScaleY=1, ScaleZ=".95")  # -> Geometry, Transform

# ---- group: DEMO (continued)
brep = Brep(example_cone.Cone)

# ----
hw3_brep = Brep(brep)
cap = CapHoles(Brep=hw3_brep)

move_to_turntable = MoveToTurntable(relay_2=pln_2, relay=cap, F=zsafe_height)
cutting_region = CuttingRegion(C=move_to_turntable, P=pln_2, l0=start_z_offset, type=list_2)  # -> full_region, chosen_region
make_silluettes = MakeSilluettes(M=move_to_turntable, B=cutting_region.full_region, N=silluete_resolution)
trim = TrimWithBrep(Curve=make_silluettes, Brep=cutting_region.chosen_region)  # -> simplify(Inside), Outside
filter_4 = StreamFilter(Gate=list_2, Stream0=make_silluettes, Stream1=trim.Inside)
join = JoinCurves(Curves=filter_4, Preserve=False)

filter_5 = StreamFilter(Gate=num_2, Stream2=join)

# ---- group: 'Unrotate' Turntable and Geo
pln_6 = Plane(pln_2)
base_plane_3 = Plane(cluster.geometry)
lng = ListLength(List=pln_6)
dup = DuplicateData(Data=base_plane_3, Number=lng, Order=True)
cutting_guide_crv_4 = Curve(guide)
orient_3 = Orient(Geometry=flatten(join), Source=pln_6, Target=dup)  # -> Geometry, Transform
flip_4 = FlipCurve(Curve=orient_3.Geometry, Guide=cutting_guide_crv_4)  # -> Curve, Flag

# ---- group: Rotated Preview
preview = CustomPreview(Geometry=filter_5, Material=ColourSwatch(SwatchColor=RGB(252, 104, 30)))

# ----
topoly_2 = CurveToPolyline(Curve=flip_4.Curve, ToleranceDistance=Slider(0, range=0..10), ToleranceAngle=0)  # -> Polyline, Segments
cp_2 = ControlPoints(Curve=topoly_2.Polyline)  # -> Points, Weights, Knots
pln_7 = Plane(rotate_4.Geometry)
pl_origin_2 = PlaneOrigin(Base=pln_7, Origin=cp_2.Points)

# ---- group: Simulate
filter_6 = StreamFilter(Gate=num_2, Stream0="0", Stream1="0", Stream2=cluster_2.num_2)
zone_accuracy_2 = Panel(zone_accuracy)
controlled_speed_2 = Panel(controlled_speed)
transfer_speed_2 = Panel(transfer_speed)
filter_7 = StreamFilter(Gate=num_2, Stream0=pl_origin, Stream1=dfl_re_orient_planes_2, Stream2=pl_origin_2)
num_3 = Number(model_cutoff_offset)
pln_8 = Plane(cluster.P_2)
num_4 = Number(filter_6)
pln_9 = Plane(cluster.geometry)
pln_10 = Plane(cluster.G_3)
pln_11 = Plane(robot_initial_plane)
tool_3 = ToolParameter(tool_2.tool)
hw_motions = HWMotions(
    inital_pose_plane=pln_11,
    tool=tool_3,
    base_plane=pln_9,
    num=num_4,
    safe_z_plane=pln_10,
    pln=pln_8,
    cutoff_height=num_3,
    controlled_speed=controlled_speed_2,
    transfer_speed=transfer_speed_2,
    zone_accuracy=zone_accuracy_2,
    cutting_planes=filter_7)  # -> s_1, cuttoff_script

# ----
lng_2 = ListLength(List=move_to_turntable)

# ---- group: Simulate
# Analisis
sim_slider = Slider(1e-05, range=1e-05..1)
filter_8 = StreamFilter(Gate=num_2, Stream0=sort_top_to_bottom, Stream1=tweencrv, Stream2=orient_3.Geometry)
preview_transitions = BooleanToggle(True)
live_toolpath = ColourSwatch(SwatchColor=RGBA(96, 11, 153, 147))
robot = ColourSwatch(SwatchColor=RGBA(93, 116, 120, 159))
cluster_3 = Cluster_2(col=ColourSwatch(SwatchColor=RGB(0, 25, 255)), G=filter_8, G_2=preview_transitions, T=hw_motions.s_1)  # -> s_1, col_3
finished_preview = ColourSwatch(SwatchColor=RGBA(69, 255, 236, 53))
preview_2 = CustomPreview(Geometry=cluster_3.s_1, Material=cluster_3.col_3)

# ----
fancy_preview = FancyPreview(L_2=cluster_2.rotated_stock_2, L=move_to_turntable, sim_slider=sim_slider)

filter_9 = StreamFilter(Gate=num_2, Stream0=cluster.G_2, Stream1=cluster.G_2, Stream2=fancy_preview)
edges_2 = BrepEdges(Brep=filter_9)  # -> Naked, Interior, NonManifold
foam_preview = CustomPreview(Geometry=edges_2.Interior, Material=foam_stock)

fancy_preview_2 = FancyPreview_2(data=cluster_2.rotated_fixture, sim_slider=sim_slider)
filter_10 = StreamFilter(Gate=num_2, Stream0=dfl_ur_fixutres.i_3, Stream1=dfl_ur_fixutres.i_3, Stream2=fancy_preview_2)

# ---- group: Setup Fixture (continued)
fixture = CustomPreview(Geometry=[filter_10, dfl_ur_fixutres.i_4], Material=ColourSwatch(SwatchColor=RGB(214, 214, 214)))

# ----
sim_slider_2 = Data(sim_slider)
multiplication_2 = Multiplication(A=lng_2, B=sim_slider_2)
round = Round(Number=multiplication_2)  # -> Nearest, Floor, Ceiling
item_4 = ListItem(List=move_to_turntable, Index=expr("x-1", round.Ceiling), Wrap=False)

# ---- group: Simulate (continued)
filter_11 = StreamFilter(Gate=num_2, Stream0=split_for_lowest, Stream1=split_for_lowest_2, Stream2=item_4)
finished_preview_2 = CustomPreview(Geometry=filter_11, Material=finished_preview)

# ---- group: Save URP
# Save
# Saving Instrucitons: Please set your Project Name without spaces
# Right-click 'Select a Directory' and choose a location on your USB drive
# Click 'Save as URP' (if the icon flashes red, the directory is not set or the USB is not mounted)
# Files must have unique names on the controller. A Data Recorder appends a number to each saved file
# To reset the counter, click the X on the 'click counter' Data Recorder
save_as_urp = Button()
click_counter = DataRecorder(save_as_urp, DataLimit=-10, RecordData=True)
cluster_4 = Cluster(T=project_name_no_spaces, L=click_counter)
dispatch = Dispatch(List=set_as_your_usb_drive, DispatchPattern=save_as_urp)  # -> ListA, ListB
unique_file_name = Panel(cluster_4)

# ---- group: CALIBRATION SCRIPT / Cluster
dfl_hw_calibration = DFLHWCalibration(
    unique_file_name=unique_file_name,
    tool=tool_3,
    robot_initial_plane=pln_11,
    controlled_speed=controlled_speed_2,
    transfer_speed=transfer_speed_2,
    zone_accuracy=zone_accuracy_2,
    safe_distance=safe_distance,
    safe_z_plane=pln_10,
    robot_system=loadrobot)  # -> program, warnings, errors

# ---- group: CALIBRATION SCRIPT
# CALIBRATION
warnings = Panel(dfl_hw_calibration.warnings)
errors = Panel(dfl_hw_calibration.errors)

# ---- group: Simulate (continued)
create_program = CreateProgram(Name=unique_file_name, RobotSystem=loadrobot, Targets=hw_motions.s_1, StepSize=1)  # -> Program, Code, Duration, Warnings, Errors
expression = Expression(x=create_program.Duration, Expression="Floor(x/60)")
scr_preview = Panel(create_program.Code)
any_program_warnings = Panel(create_program.Warnings)
any_program_errors = Panel(create_program.Errors)
duration_minutes = Panel(expression)
program_simulation = ProgramSimulation(Program=create_program.Program, Time=sim_slider, Normalized=True)  # -> SystemMeshes, JointRotations, Plane, Index, Time, flatten(Program), Errors
degrees = Degrees(Radians=graft(program_simulation.JointRotations))  # -> simplify(Degrees)
each_axis_rotation_analysis = Panel(degrees)
custom_preview = CustomPreview(Geometry=program_simulation.SystemMeshes, Material=robot)

# ---- group: Simulate / Colour Swatch
trail = SimpleTrail(Program=program_simulation.Program, Length=500, MechanicalGroup=0)

# ---- group: Simulate (continued)
preview_3 = CustomPreview(Geometry=trail, Material=live_toolpath)

# ---- group: Double Check screws
include_cuttoff_script = BooleanToggle(False)
data = Data(create_program.Program)
cluster_5 = Cluster_5(G=include_cuttoff_script, relay=data, A=unique_file_name, robot_system=loadrobot, T=hw_motions.cuttoff_script)

# ---- group: Save URP (continued)
# Robotic Commands
# Paint Brush additions
saveprog = SaveProgram(Program=[dfl_hw_calibration.program, cluster_5], Folder=dispatch.ListA)

# ==== cluster DFLURFixutres
turntable = Mesh(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)
mesh = Mesh(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)
mesh_2 = Mesh(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)
get_top_center = GetTopCenter(C=turntable)
panel = ClusterInput()
mesh_3 = Mesh(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)
xy = XYPlane(Origin=get_top_center)
panel_2 = Panel(panel)
fixture_z_offset = Panel("-19")
turntable_z_offset = Panel("-19")
turntable_z_offset_2 = Panel("Draw Table Offset")
riser_offset = Panel("-50")
planeref = Point(panel)
addition = Addition(A=riser_offset, B=turntable_z_offset)
addition_2 = Addition(A=addition, B=fixture_z_offset)
turntablebase = Mesh(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)
Z = UnitZ(Factor=riser_offset)
Z_2 = UnitZ(Factor=addition)
Z_3 = UnitZ(Factor=addition_2)
drawing_table = Mesh(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)
move = Move(Geometry=planeref, Motion=Z_3)  # -> Geometry, Transform
move_2 = Move(Geometry=planeref, Motion=Z)  # -> Geometry, Transform
orient = Orient(Geometry=mesh_2, Source=xy, Target=move_2.Geometry)  # -> Geometry, Transform
orient_2 = Orient(Geometry=mesh_3, Source=xy, Target=move_2.Geometry)  # -> Geometry, Transform
orient_3 = Orient(Geometry=mesh, Source=xy, Target=move_2.Geometry)  # -> Geometry, Transform
orient_4 = Orient(Geometry=turntable, Source=xy, Target=move_2.Geometry)  # -> Geometry, Transform
mesh_4 = Mesh(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)
move_3 = Move(Geometry=planeref, Motion=Z_2)  # -> Geometry, Transform
mjoin = MeshJoin(Meshes=[orient_4.Geometry, orient_3.Geometry, orient_2.Geometry])
mjoin_2 = MeshJoin(Meshes=[orient_4.Geometry, orient_3.Geometry, orient.Geometry])
merge = Merge(Data1=mesh_4, Data2=drawing_table, Data3=mesh_4)
merge_2 = Merge(Data1=mesh_4, Data2=turntablebase, Data3=orient_4.Geometry)  # -> flatten(Result)
no_fixture = Merge(Data1=mesh_4, Data2=mesh_4, Data3=mesh_4)
merge_3 = Merge(Data1=mesh_4, Data2=turntablebase, Data3=mjoin_2)  # -> flatten(Result)
i = ClusterInput()
carttrack = Mesh([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])
carttabletop = Mesh(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)
tabletop = Mesh(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)
merge_4 = Merge(Data1=mesh_4, Data2=turntablebase, Data3=mjoin)  # -> flatten(Result)
tabletrack = Mesh([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])
merge_5 = Merge(Data1=carttabletop, Data2=flatten(carttrack))
merge_6 = Merge(Data1=tabletop, Data2=flatten(tabletrack))
fixture_in_use = ValueList({"Custom Fixture": 0, "Draw Table": 1, "Turn Table": 2, "Turn Riser (60)": 3, "Turn Riser (90)": 4}, selected="Turn Riser (90)")
merge_7 = Merge(Data1=graft(no_fixture), Data2=graft(merge), Data3=graft(merge_2), Data4=graft(merge_3), Data5=graft(merge_4))
i_2 = ClusterInput()
merge_8 = Merge(Data1=graft(merge_5), Data2=graft(merge_6))
item = ListItem(List=merge_7, Index=i_2, Wrap=True)
item_2 = ListItem(List=merge_8, Index=i, Wrap=True)
A = ClusterInput()
tabletop_2 = ListItem(List=flatten(item_2), Index=0, Wrap=True)
track = ListItem(List=flatten(item_2), Index=1, Wrap=True)
track_2 = ListItem(List=flatten(item_2), Index=2, Wrap=True)
track_3 = ListItem(List=flatten(item), Index=1, Wrap=False)
track_4 = ListItem(List=flatten(item), Index=2, Wrap=False)
multiplication = Multiplication(A=A, B=-1)
adaptorplate = Mesh(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)
i_3 = ClusterOutput(track_4)
i_4 = ClusterOutput(track_3)
pt = ConstructPoint(XCoordinate=multiplication, YCoordinate=0, ZCoordinate=0)
move_4 = Move(Geometry=tabletop_2, Motion=pt)  # -> Geometry, Transform
move_5 = Move(Geometry=[track, track_2], Motion=pt)  # -> Geometry, Transform
mesh_5 = Mesh(move_5.Geometry)
adaptorplate_2 = ClusterOutput([adaptorplate, mesh_5])
mesh_6 = Mesh(track_3)
G = ClusterOutput(move_4.Geometry)
mesh_7 = Mesh(track_4)

# ==== cluster Cluster
L = ClusterInput()
lng = ListLength(List=L)
addition = Addition(A=lng, B=1)
T = ClusterInput()
division = Division(A=addition, B=2)
rep = ReplaceText(Text=T, Find=" ", Replace="_", RecursiveReplace=False)
round = Round(Number=division)  # -> Nearest, Floor, Ceiling
concat = Concatenate(FragmentA=rep, FragmentC="_", FragmentB=round.Ceiling)
R = ClusterOutput(concat)

# ==== cluster Cluster_2
col = ClusterInput()
T = ClusterInput()
deconstructtarget = DeconstructTarget(Target=T)  # -> Joints, Plane
G = ClusterInput()
pt = Point(Point(0, 0, 0.5))
G_2 = ClusterInput()
move = Move(Geometry=G, Motion=pt)  # -> Geometry, Transform
col_2 = Colour(col)
pline = PolyLine(Vertices=deconstructtarget.Plane, Closed=False)
move_2 = Move(Geometry=pline, Motion=pt)  # -> Geometry, Transform
filter = StreamFilter(Gate=G_2, Stream0=move.Geometry, Stream1=move_2.Geometry)
s_1 = ClusterOutput(filter)
col_3 = ClusterOutput(col_2)

# ==== cluster Cluster_3
panel = Panel("https://raw.githubusercontent.com/designfutureslab/DR/refs/heads/main/CharlieHWCalib.txt")
F = ClusterInput()
panel_2 = Panel("https://raw.githubusercontent.com/designfutureslab/DR/refs/heads/main/DarcyHWCalib.txt")
F_2 = ClusterInput()
A = ClusterInput()
A_2 = ClusterInput()
F_3 = ClusterInput()
trigger = ClusterInput()
multiplication = Multiplication(A=A_2, B=-0.5)
multiplication_2 = Multiplication(A=A_2, B=0.5)
multiplication_3 = Multiplication(A=A, B=-0.5)
multiplication_4 = Multiplication(A=A, B=0.5)
dom = ConstructDomain(DomainStart=multiplication, DomainEnd=multiplication_2)
dom_2 = ConstructDomain(DomainStart=multiplication_3, DomainEnd=multiplication_4)
py3 = Python3Script(url=panel, trigger=trigger)  # -> text, ok, msg; inputs url: String, trigger: Boolean
# ---------- py3: Python ----------
"""
General-purpose: fetches any text file from a URL whenever `trigger` goes True.
Also looks up the file's last GitHub commit date (if it's a raw.githubusercontent.com URL)
and appends it to the status message, converted to local time.

Safe for multiple instances of this component on the same canvas: the cache
is keyed by the URL itself, so separate components with separate URLs never
collide or overwrite each other's stored result.

Inputs:
    url     : str  - full URL to the text file (raw.githubusercontent.com works best)
    trigger : bool - fires the fetch on True
Outputs:
    text    : list of str - the file's contents, one line per list item
    ok      : bool - True if fetch succeeded
    msg     : str  - status message, including last GitHub commit date if available
"""

import urllib.request
import urllib.error
import datetime
import time
import json
import re
import scriptcontext as sc

# Key the cache by URL so multiple instances of this component (e.g. one per robot)
# never stomp on each other's stored result.
key = "url_fetch_cache::" + str(url)

if key not in sc.sticky:
    sc.sticky[key] = {"text": "", "ok": False, "msg": "Not yet run"}

cache = sc.sticky[key]


def get_github_commit_date(raw_url):
    """
    If raw_url is a raw.githubusercontent.com link, query the GitHub API
    for the last commit date touching that specific file path.
    Handles both URL styles:
      .../owner/repo/branch/path
      .../owner/repo/refs/heads/branch/path  (or refs/tags/tag/path)
    Returns a timezone-aware UTC datetime, or None if not applicable / lookup fails.
    """
    m = re.match(
        r"https?://raw\.githubusercontent\.com/([^/]+)/([^/]+)/refs/(?:heads|tags)/([^/]+)/(.+)",
        raw_url
    )
    if not m:
        m = re.match(
            r"https?://raw\.githubusercontent\.com/([^/]+)/([^/]+)/([^/]+)/(.+)",
            raw_url
        )
    if not m:
        return None

    owner, repo, branch, path = m.groups()
    api_url = "https://api.github.com/repos/{}/{}/commits?path={}&sha={}&per_page=1".format(
        owner, repo, path, branch
    )
    req = urllib.request.Request(api_url, headers={
        "User-Agent": "Mozilla/5.0",
        "Accept": "application/vnd.github+json"
    })
    with urllib.request.urlopen(req, timeout=10) as resp:
        data = json.loads(resp.read().decode("utf-8"))

    if isinstance(data, list) and len(data) > 0:
        date_str = data[0]["commit"]["committer"]["date"]  # e.g. "2026-09-29T01:10:00Z"
        utc_dt = datetime.datetime.strptime(date_str, "%Y-%m-%dT%H:%M:%SZ")
        utc_dt = utc_dt.replace(tzinfo=datetime.timezone.utc)
        return utc_dt
    return None


if trigger:
    try:
        separator = "&" if "?" in url else "?"
        fetch_url = url + separator + "cachebust=" + str(int(time.time()))

        req = urllib.request.Request(fetch_url, headers={"User-Agent": "Mozilla/5.0"})
        with urllib.request.urlopen(req, timeout=10) as response:
            decoded = response.read().decode("utf-8")

        cache["text"] = decoded
        cache["ok"] = True
        now_str = datetime.datetime.now().strftime("%Y-%m-%d %H:%M:%S")

        commit_date_str = None
        commit_lookup_error = None
        try:
            utc_dt = get_github_commit_date(url)
            if utc_dt:
                local_dt = utc_dt.astimezone()
                commit_date_str = local_dt.strftime("%Y-%m-%d %H:%M:%S")
        except urllib.error.HTTPError as e:
            if e.code == 403:
                commit_lookup_error = "rate-limited (403)"
            else:
                commit_lookup_error = "HTTP {}".format(e.code)
        except Exception as e:
            commit_lookup_error = str(e)

        if commit_date_str:
            cache["msg"] = "Fetched {} chars at {}. File last updated: {}".format(
                len(decoded), now_str, commit_date_str
            )
        elif commit_lookup_error:
            cache["msg"] = "Fetched {} chars at {}. File last updated: unknown ({})".format(
                len(decoded), now_str, commit_lookup_error
            )
        else:
            cache["msg"] = "Fetched {} chars at {}. File last updated: unknown".format(
                len(decoded), now_str
            )

    except urllib.error.URLError as e:
        cache["ok"] = False
        cache["msg"] = "URL error: {}".format(e.reason)
    except Exception as e:
        cache["ok"] = False
        cache["msg"] = "Error: {}".format(e)

sc.sticky[key] = cache

text = cache["text"].splitlines()
ok = cache["ok"]
msg = cache["msg"]
# ---------- end py3 ----------
py3_2 = Python3Script(url=panel_2, trigger=trigger)  # -> text, ok, msg; inputs url: String, trigger: Boolean; same code as py3
Z = UnitZ(Factor=F_3)
panel_3 = Panel(py3_2.text)
concat = Concatenate(FragmentB=py3.msg, FragmentD=py3_2.msg)
panel_4 = Panel(concat)
Z_2 = UnitZ(Factor=F)
pt = Point(py3_2.text)
panel_5 = ClusterInput()
pt_2 = Point(py3.text)
pt_3 = Point("507.71, -9.96,73.21")
filter = StreamFilter(Gate=panel_5, Stream0=pt_2, Stream1=pt)
is_empty = Python3Script(x=filter)  # -> a; inputs x: list
# ---------- is_empty: Python ----------
# x = input (List Access), a = output
a = x is None or len([i for i in x if i is not None]) == 0
# ---------- end is_empty ----------
G = ClusterInput()
panel_6 = Panel(is_empty)
filter_2 = StreamFilter(Gate=is_empty, Stream0=filter, Stream1=pt_3)
turntable_z_offset = Panel("Draw Table Offset")
fixture_z_offset = Panel("-19")
turntable_z_offset_2 = Panel("-19")
riser_offset = Panel("-50")
addition = Addition(A=riser_offset, B=turntable_z_offset_2)
addition_2 = Addition(A=addition, B=fixture_z_offset)
xy = XYPlane(Origin=filter_2)
planeref = Point(xy)
panel_7 = Panel(panel_5)
Z_3 = UnitZ(Factor=riser_offset)
Z_4 = UnitZ(Factor=addition)
Z_5 = UnitZ(Factor=addition_2)
custom_calib_msg = ClusterOutput(concat)
move = Move(Geometry=planeref, Motion=Z_3)  # -> Geometry, Transform
move_2 = Move(Geometry=planeref, Motion=Z_5)  # -> Geometry, Transform
move_3 = Move(Geometry=planeref, Motion=Z_4)  # -> Geometry, Transform
# Custom Fixture  = 0
# Draw Table      = 1
# Turn Table      = 2
# Turn Riser (60) = 3
# Turn Riser (90) = 4
filter_3 = StreamFilter(Gate=G, Stream0=move_2.Geometry, Stream1=move_3.Geometry, Stream2=move.Geometry, Stream3=planeref, Stream4=planeref)
move_4 = Move(Geometry=filter_3, Motion=Z_2)  # -> Geometry, Transform
xy_2 = XYPlane(Origin=move_4.Geometry)
rectangle = Rectangle(Plane=xy_2, XSize=dom, YSize=dom_2, Radius=0)  # -> Rectangle, Length
extr = Extrude(Base=rectangle.Rectangle, Direction=Z)
cap = CapHoles(Brep=extr)
brep = Brep(cap)
ideal_paper_plane = Plane(xy_2)
orient = Orient(Geometry=brep, Source=ideal_paper_plane, Target=move_4.Geometry)  # -> Geometry, Transform
geometry = ClusterOutput(move_4.Geometry)
P = ClusterOutput(xy)
G_2 = ClusterOutput(orient.Geometry)
hw_safe_height = HWSafeHeight(B=orient.Geometry, F=F_2)  # -> z_plane, all_planes
G_3 = ClusterOutput(hw_safe_height.z_plane)
P_2 = ClusterOutput(hw_safe_height.all_planes)

# ==== cluster Tool
i = ClusterInput()

# ---- group: Set up End Effector
dfl_hot_wire_cutters = DFLHotWireCutters(i=i)  # -> i_3, i_2, i_4, i_5
weight = Panel(dfl_hot_wire_cutters.i_4)
name_of_tool = Panel(dfl_hot_wire_cutters.i_3)
tool_centre_point = Panel(dfl_hot_wire_cutters.i_2)
end_effectror_mesh = Mesh(dfl_hot_wire_cutters.i_5)

# ----
xy = XYPlane(Origin=tool_centre_point)
rot3d = Rotate3D(Geometry=xy, Angle=degrees("180"), Center=xy, Axis=Vector(0, 0, 1))  # -> Geometry, Transform

# ---- group: Set up End Effector (continued)
create_tool = CreateTool(Name=name_of_tool, TCP=rot3d.Geometry, Weight=weight, Mesh=end_effectror_mesh)  # -> Tool, TCP

# ----
tcp = ClusterOutput(create_tool.TCP)
tool = ClusterOutput(create_tool.Tool)

# ==== cluster HWMotions
inital_pose_plane = ClusterInput()
tool = ClusterInput()
num = ClusterInput()
safe_z_plane = ClusterInput()
pln = ClusterInput()
cutoff_height = ClusterInput()
controlled_speed = ClusterInput()
transfer_speed = ClusterInput()
zone_accuracy = ClusterInput()
cutting_planes = ClusterInput()
base_plane = ClusterInput()
num_2 = Number(cutoff_height)
pln_2 = Plane(base_plane)
pln_3 = Plane(safe_z_plane)
data = Data(tool)
num_3 = Number(num)
pln_4 = Plane(pln)
pln_5 = Plane(simplify(cutting_planes))
Z = UnitZ(Factor=num_2)
item = ListItem(List=pln_5, Index=0, Wrap=True)  # -> Item1, Item

# ---- group: Linear Movements
list = ValueList({"Joint", "Linear"}, selected="Linear")
zone_accuracy_2 = Panel(zone_accuracy)
controlled_speed_2 = Panel(controlled_speed)
create_target = CreateTarget(IsCartesian=True)

# ----
project_to_safe_radial = ProjectToSafePlane(P=pln_4, relay=item.Item)
move = Move(Geometry=pln_2, Motion=Z)  # -> Geometry, Transform

item_2 = ListItem(List=pln_5, Index=0, Wrap=True)  # -> Item1, Item
project_to_safe_radial_2 = ProjectToSafePlane(P=pln_4, relay=item_2.Item)
pln_6 = Plane(project_to_safe_radial_2)
project_to_safe_plane = ProjectToSafePlane(P=pln_4, relay=item_2.Item1)
pln_7 = Plane(project_to_safe_plane)

project = Project(Geometry=project_to_safe_radial, Plane=move.Geometry)  # -> Geometry, Transform
pln_8 = Plane(project_to_safe_radial)
createtarget = CreateTarget(Plane=pln_5, Motion=list, Tool=data, Speed=controlled_speed_2, Zone=zone_accuracy_2, IsCartesian=True)

# ---- group: Inital Pose
instructions_for_ur_operator = Panel("Please Rotate Turntable to Position ")
popup_title_no_spaces = Panel("RotateTurntable_")
concat = Concatenate(FragmentA=instructions_for_ur_operator, FragmentB=num_3)
concat_2 = Concatenate(FragmentA=popup_title_no_spaces, FragmentB=num_3)
dfl_ur_custom_popup = DFLURCustomPopup(N=concat_2, B=flatten(concat))
list_2 = ValueList({"Joint", "Linear"}, selected="Joint")
create_target_2 = CreateTarget(IsCartesian=True)

# ----
popup_text = Panel("Job Complete! Please put all the caps back on the pens and tidy up!")
popup_title_no_spaces_2 = Panel("Job_Done")
dfl_ur_custom_popup_2 = DFLURCustomPopup(N=popup_title_no_spaces_2, B=popup_text)

# ---- group: Inital Pose
instructions_for_ur_operator_2 = Panel("Please ensure your tool and foam are correctly loaded, and that DFL staff have set up the Robot, and that you have reviewed the simulation in Grasshopper or on the SmartPad")
popup_title_no_spaces_3 = Panel("Operator_Safety")
dfl_ur_custom_popup_3 = DFLURCustomPopup(N=popup_title_no_spaces_3, B=instructions_for_ur_operator_2)
list_3 = ValueList({"Joint", "Linear"}, selected="Joint")
create_target_3 = CreateTarget(IsCartesian=True)

# ----
move_2 = Move(Geometry=pln_2, Motion=Z)  # -> Geometry, Transform
project_to_safe_plane_2 = ProjectToSafePlane(P=pln_4, relay=item.Item1)
project_2 = Project(Geometry=project_to_safe_plane_2, Plane=move_2.Geometry)  # -> Geometry, Transform

# ---- group: Linear Movements
merge = Merge(Data1=project.Geometry, Data2=project_2.Geometry)
list_4 = ValueList({"Joint", "Linear"}, selected="Linear")
zone_accuracy_3 = Panel(zone_accuracy)
controlled_speed_3 = Panel(controlled_speed)
create_target_4 = CreateTarget(IsCartesian=True)

# ----
createtarget_2 = CreateTarget(Plane=merge, Motion=list_4, Tool=data, Speed=controlled_speed_3, Zone=zone_accuracy_3, IsCartesian=True)
createtarget_3 = CreateTarget(IsCartesian=True)

list_5 = ValueList({"Joint", "Linear"}, selected="Joint")

createtarget_4 = CreateTarget(
    Plane=inital_pose_plane,
    Motion=list_5,
    Tool=data,
    Speed=transfer_speed,
    Zone=zone_accuracy,
    Command=dfl_ur_custom_popup_2,
    IsCartesian=True)
pln_9 = Plane(project_to_safe_plane_2)
createtarget_5 = CreateTarget(Plane=inital_pose_plane, Motion=list_3, Tool=data, Speed=transfer_speed, Command=dfl_ur_custom_popup_3, IsCartesian=True)
createtarget_6 = CreateTarget(Plane=inital_pose_plane, Motion=list_2, Tool=data, Speed=transfer_speed, Command=dfl_ur_custom_popup, IsCartesian=True)
createtarget_7 = CreateTarget(IsCartesian=True)
createtarget_8 = CreateTarget(IsCartesian=True)

list_6 = ValueList({"Joint", "Linear"}, selected="Linear")
create_target_5 = CreateTarget(IsCartesian=True)

createtarget_9 = CreateTarget(Plane=pln_8, Motion=list_6, Tool=data, Speed=transfer_speed, Zone=zone_accuracy, IsCartesian=True)

ins = InsertItems(List=createtarget_2, Item=createtarget_9, Indices=0, Wrap=True)

list_7 = ValueList({"Joint", "Linear"}, selected="Linear")
create_target_6 = CreateTarget(IsCartesian=True)

createtarget_10 = CreateTarget(Plane=pln_6, Motion=list_7, Tool=data, Speed=transfer_speed, Zone=zone_accuracy, IsCartesian=True)

ins_2 = InsertItems(List=createtarget, Item=createtarget_10, Indices=0, Wrap=True)

# ---- group: Lead In
project_3 = Project(Geometry=pln_8, Plane=pln_3)  # -> Geometry, Transform
pl_origin = PlaneOrigin(Base=pln_8, Origin=project_3.Geometry)
list_8 = ValueList({"Joint", "Linear"}, selected="Linear")
create_target_7 = CreateTarget(IsCartesian=True)

# ----
createtarget_11 = CreateTarget(Plane=pl_origin, Motion=list_8, Tool=data, Speed=transfer_speed, Zone=zone_accuracy, IsCartesian=True)

# ---- group: Lead In (continued)
ins_3 = InsertItems(List=ins, Item=createtarget_11, Indices=0, Wrap=True)

project_4 = Project(Geometry=pln_6, Plane=pln_3)  # -> Geometry, Transform
pl_origin_2 = PlaneOrigin(Base=pln_6, Origin=project_4.Geometry)
list_9 = ValueList({"Joint", "Linear"}, selected="Linear")
create_target_8 = CreateTarget(IsCartesian=True)

# ----
createtarget_12 = CreateTarget(Plane=pl_origin_2, Motion=list_9, Tool=data, Speed=transfer_speed, Zone=zone_accuracy, IsCartesian=True)

# ---- group: Lead In (continued)
ins_4 = InsertItems(List=ins_2, Item=createtarget_12, Indices=0, Wrap=True)

# ----
list_10 = ValueList({"Joint", "Linear"}, selected="Linear")
createtarget_13 = CreateTarget(Plane=pln_7, Motion=list_10, Tool=data, Speed=controlled_speed, Zone=zone_accuracy, IsCartesian=True)
ins_5 = InsertItems(List=ins_4, Item=createtarget_13, Indices=-1, Wrap=True)

list_11 = ValueList({"Joint", "Linear"}, selected="Linear")
create_target_9 = CreateTarget(IsCartesian=True)

createtarget_14 = CreateTarget(Plane=pln_9, Motion=list_11, Tool=data, Speed=controlled_speed, Zone=zone_accuracy, IsCartesian=True)
createtarget_15 = CreateTarget(Plane=pln_9, Motion=list_11, Tool=data, Speed=controlled_speed, Zone=zone_accuracy, IsCartesian=True)

ins_6 = InsertItems(List=ins_3, Item=createtarget_14, Indices=-1, Wrap=True)

# ---- group: Lead Out
project_5 = Project(Geometry=pln_9, Plane=pln_3)  # -> Geometry, Transform
list_12 = ValueList({"Joint", "Linear"}, selected="Linear")
pl_origin_3 = PlaneOrigin(Base=inital_pose_plane, Origin=project_5.Geometry)

# ----
createtarget_16 = CreateTarget(Plane=pl_origin_3, Motion=list_12, Tool=data, Speed=transfer_speed, IsCartesian=True)

# ---- group: Lead Out (continued)
ins_7 = InsertItems(List=ins_6, Item=createtarget_16, Indices=-1, Wrap=True)  # -> simplify(List)

# ----
merge_2 = Merge(Data1=createtarget_5, Data2=flatten(ins_7), Data3=createtarget_4)  # -> flatten(Result)
cuttoff_script = ClusterOutput(merge_2)

# ---- group: Lead Out
project_6 = Project(Geometry=pln_7, Plane=pln_3)  # -> Geometry, Transform
list_13 = ValueList({"Joint", "Linear"}, selected="Linear")
pl_origin_4 = PlaneOrigin(Base=inital_pose_plane, Origin=project_6.Geometry)
create_target_10 = CreateTarget(IsCartesian=True)

# ----
createtarget_17 = CreateTarget(Plane=pl_origin_4, Motion=list_13, Tool=data, Speed=transfer_speed, IsCartesian=True)

# ---- group: Lead Out (continued)
ins_8 = InsertItems(List=ins_5, Item=createtarget_17, Indices=-1, Wrap=True)  # -> simplify(List)

# ---- group: Order Program
lng = ListLength(List=num_3)
weave = Weave(Pattern=[0, 1], Stream0=graft(createtarget_6), Stream1=ins_8, NullGaps=False)
expression = Expression(x=lng, Expression="if(x > 0, 1, 0)")
merge_3 = Merge(Data1=createtarget_5, Data2=flatten(weave), Data3=createtarget_4)  # -> flatten(Result)
merge_4 = Merge(Data1=createtarget_5, Data2=flatten(ins_8), Data3=createtarget_4)  # -> flatten(Result)
filter = StreamFilter(Gate=expression, Stream0=merge_4, Stream1=merge_3)

# ----
s_1 = ClusterOutput(filter)

# ==== cluster DFLReOrientPlanes
planes = ClusterInput()
rotation_axis = ClusterInput()  # X=0 Y=1 Z=2
quad_rotate = ClusterInput()

deplane = DeconstructPlane(Plane=planes)  # -> Origin, XAxis, YAxis, ZAxis
filter = StreamFilter(Gate=rotation_axis, Stream0=deplane.XAxis, Stream1=deplane.YAxis, Stream2=deplane.ZAxis)
amp = Amplitude(Vector=filter, Amplitude="1")
move = Move(Geometry=deplane.Origin, Motion=amp)  # -> Geometry, Transform
ln = Line(StartPoint=deplane.Origin, EndPoint=move.Geometry)
rotax = RotateAxis(Geometry=planes, Angle=degrees(quad_rotate), Axis=ln)  # -> Geometry, Transform

rotated_planes = ClusterOutput(rotax.Geometry)

# ==== cluster RuledSrfGuideCurve
relay = ClusterInput()
C = ClusterInput()
C_2 = ClusterInput()
flip = FlipCurve(Curve=C, Guide=relay)  # -> Curve, Flag
flip_2 = FlipCurve(Curve=C_2, Guide=relay)  # -> Curve, Flag
rulesrf = RuledSurface(CurveA=flip_2.Curve, CurveB=flip.Curve)
S = ClusterOutput(rulesrf)

# ==== cluster Guide
G = ClusterInput()
X = UnitX(Factor=expr("-x", "100"))
xy = XYPlane(Origin=Point(0, 0, 0))
X_2 = UnitX(Factor="100")
filter = StreamFilter(Gate=G, Stream0=X_2, Stream1=X)
xy_2 = XYPlane(Origin=filter)
ln = Line(StartPoint=xy, EndPoint=xy_2)
L = ClusterOutput(ln)

# ==== cluster SplitForLowest
B = ClusterInput()
C = ClusterInput()
brep = Brep(C)
split = SplitBrep(Brep=B, Cutter=C)
bbox = BoundingBox(Content=split, Plane=PlaneXY(0, 0, 0))  # -> Box, Box_2
area = Area(Geometry=bbox.Box)  # -> Area, Centroid
pdecon = Deconstruct(Point=area.Centroid)  # -> XComponent, YComponent, ZComponent
sort = SortList(Keys=pdecon.ZComponent, ValuesA=split)  # -> Keys, ValuesA
item = ListItem(List=sort.ValuesA, Index=0, Wrap=True)
i = ClusterOutput(item)

# ==== cluster SortTopToBottom
surface = ClusterInput()
bbox = BoundingBox(Content=surface, Plane=PlaneXY(0, 0, 0))  # -> Box, Box_2
area = Area(Geometry=bbox.Box)  # -> Area, Centroid
pdecon = Deconstruct(Point=area.Centroid)  # -> XComponent, YComponent, ZComponent
sort = SortList(Keys=pdecon.ZComponent, ValuesA=surface)  # -> Keys, ValuesA
rev = ReverseList(List=sort.ValuesA)
L = ClusterOutput(rev)

# ==== cluster Cluster_4
i = ClusterInput()
kn_fixture_mesh = ClusterInput()
radial_planes = ClusterInput()
initial_plane = ClusterInput()
stock_brep = ClusterInput()
P = ClusterInput()
z_plane = ClusterInput()
stock_brep_2 = Brep(stock_brep)
initial_plane_2 = Plane(initial_plane)
radial_planes_2 = Plane(radial_planes)
base_plane = Plane(P)
turntable_guide = TurntableGuide(relay=base_plane)
z_plane_2 = Plane(z_plane)
kn_fixture_mesh_2 = Mesh(kn_fixture_mesh)
entwine = Entwine(
    Branch00=base_plane,
    Branch01=kn_fixture_mesh_2,
    Branch02=turntable_guide,
    Branch03=stock_brep_2,
    Branch04=z_plane_2,
    Branch05=radial_planes_2,
    Branch06=initial_plane_2,
    FlattenInputs=True)
num = Number(i)
series = Series(Start="0", Step="22.5", Count="16")
rotate = Rotate(Geometry=graft(entwine), Angle=expr("-x", degrees(series)), Plane=P)  # -> simplify(Geometry), Transform
item = ListItem(List=rotate.Geometry, Index=i, Wrap=True)  # -> simplify(Item)
trim = TrimTree(Tree=item, Depth=1)
panel = Panel(trim)
num_2 = ClusterOutput(num)
rotated_safe_radial_planes = TreeBranch(Tree=trim, Path="{6}", MaintainPaths=True)
rotated_safe_radial_planes_2 = TreeBranch(Tree=trim, Path="{5}", MaintainPaths=True)
rotated_kin_fixture = TreeBranch(Tree=trim, Path="{1}", MaintainPaths=True)
rotated_safe_z_plane = TreeBranch(Tree=trim, Path="{4}", MaintainPaths=True)
rotated_stock = TreeBranch(Tree=trim, Path="{3}", MaintainPaths=True)
tree_branch = TreeBranch(Tree=trim, Path="{0}", MaintainPaths=True)
rotated_turntable_guide = TreeBranch(Tree=trim, Path="{2}", MaintainPaths=True)
rotated_stock_2 = ClusterOutput(rotated_stock)
rotated_fixture = ClusterOutput(rotated_kin_fixture)
rotated_radial_planes = ClusterOutput(rotated_safe_radial_planes)
rotated_z_safe_plane = ClusterOutput(rotated_safe_z_plane)
rotated_workplane = ClusterOutput(tree_branch)
rotated_radial_planes_2 = ClusterOutput(rotated_safe_radial_planes_2)
rotated_tt_guide = ClusterOutput(rotated_turntable_guide)

# ==== cluster MoveToTurntable
relay = ClusterInput()
relay_2 = ClusterInput()
bbox = BoundingBox(Content=relay, Plane=PlaneXY(0, 0, 0), UnionBox=True)  # -> Box, Box_2
debrep = DeconstructBrep(Brep=bbox.Box)  # -> Faces, Edges, Vertices
item = ListItem(List=debrep.Faces, Index="4", Wrap=True)
planar = IsPlanar(Surface=item, Interior=True)  # -> Planar, Plane
flippln = FlipPlane(Plane=planar.Plane, FlipX=False, FlipY=False, FlipZ=True)  # -> Flipped, R
pl_origin = PlaneOrigin(Base=planar.Plane, Origin=relay_2)
F = ClusterInput()
orient = Orient(Geometry=relay, Source=flippln.Flipped, Target=relay_2)  # -> Geometry, Transform
Z = UnitZ(Factor=F)
move = Move(Geometry=orient.Geometry, Motion=Z)  # -> Geometry, Transform
G = ClusterOutput(move.Geometry)

# ==== cluster CuttingRegion
P = ClusterInput()
C = ClusterInput()
bbox = BoundingBox(Content=graft(C), Plane=graft(P))  # -> Box, Box_2
type = ClusterInput()
debrep = DeconstructBrep(Brep=bbox.Box)  # -> Faces, Edges, Vertices
item = ListItem(List=debrep.Faces, Index=5, Wrap=True)
item_2 = ListItem(List=debrep.Edges, Index=9, Wrap=True)
l0 = ClusterInput()
offset = OffsetCurve(Curve=item, Distance=10, Corners=1)
ext = ExtendCurve(Curve=item_2, Type=0, Start=expr("-x", l0), End=0)
swp1 = Sweep1(Rail=ext, Sections=offset, Miter=1)
debrep_2 = DeconstructBrep(Brep=swp1)  # -> Faces, Edges, Vertices
item_3 = ListItem(List=debrep_2.Faces, Index=1, Wrap=True)
area = Area(Geometry=item_3)  # -> Area, Centroid
area_2 = Area(Geometry=swp1)  # -> Area, Centroid
orient = Orient(Geometry=item_3, Source=area.Centroid, Target=area_2.Centroid)  # -> Geometry, Transform
cap = CapHoles(Brep=swp1)
split = SplitBrep(Brep=cap, Cutter=orient.Geometry)
cap_2 = CapHoles(Brep=split)
item_4 = ListItem(List=cap_2, Index=0, Wrap=True)
filter = StreamFilter(Gate=type, Stream0=cap, Stream1=item_4)
brep = Brep(filter)
full_region = ClusterOutput(cap)
chosen_region = ClusterOutput(brep)

# ==== cluster RobotInitialPose
F = ClusterInput()
G = ClusterInput()
Z = UnitZ(Factor=F)
pl = ConstructPlane(Origin=Point(0, 0, 0), XAxis="1,-0,0", YAxis="0,-1,-0")
A = ClusterInput()
xz = XZPlane(Origin=Point(0, 0, 0))
move = Move(Geometry=G, Motion=Z)  # -> Geometry, Transform
rotate = Rotate(Geometry=pl, Angle=degrees(A), Plane=xz)  # -> Geometry, Transform
pl_origin = PlaneOrigin(Base=rotate.Geometry, Origin=move.Geometry)
pl_2 = ClusterOutput(pl_origin)

# ==== cluster RuledSrfProfile
L = ClusterInput()
relay = ClusterInput()
item = ListItem(List=L, Index=0, Wrap=True)  # -> Item, Item1, Item2, Item3
pln = Plane(item.Item1)
pln_2 = Plane(item.Item3)
project = Project(Geometry=relay, Plane=pln)  # -> Geometry, Transform
project_2 = Project(Geometry=relay, Plane=pln_2)  # -> Geometry, Transform
rulesrf = RuledSurface(CurveA=project.Geometry, CurveB=project_2.Geometry)
S = ClusterOutput(rulesrf)

# ==== cluster MakeSilluettes
B = ClusterInput()
debrep = DeconstructBrep(Brep=simplify(B))  # -> Faces, Edges, Vertices
item = ListItem(List=debrep.Edges, Index=4, Wrap=True)
N = ClusterInput()
item_2 = ListItem(List=debrep.Faces, Index=2, Wrap=True)
divide = DivideCurve(Curve=item, Count=2, Kinks=False)  # -> simplify(Points), Tangents, Parameters
divide_2 = DivideCurve(Curve=item, Count=N, Kinks=False)  # -> simplify(Points), Tangents, Parameters
item_3 = ListItem(List=divide.Points, Index=0, Wrap=True)  # -> Item, Item1
planar = IsPlanar(Surface=item_2, Interior=True)  # -> Planar, Plane
pln = Plane(item_3.Item1)
M = ClusterInput()
trim = TrimTree(Tree=planar.Plane, Depth=1)
move2pt = MoveToPoint(Geometry=planar.Plane, PointA=item_3.Item, PointB=divide_2.Points)  # -> Moved, Vector, Transform
sec = MeshPlane(Mesh=M, Plane=move2pt.Moved)  # -> simplify(Curves)
move2pt_2 = MoveToPoint(Geometry=trim, PointA=item_3.Item, PointB=item_3.Item1)  # -> Moved, Vector, Transform
move2pt_3 = MoveToPoint(Geometry=item_2, PointA=item_3.Item, PointB=item_3.Item1)  # -> Moved, Vector, Transform
move2pt_4 = MoveToPoint(Geometry=sec, PointA=graft(move2pt.Moved), PointB=graft(move2pt_2.Moved))  # -> simplify(Moved), Vector, Transform
trim_2 = TrimTree(Tree=move2pt_4.Moved, Depth=1)
runion = RegionUnion(Curves=trim_2, Plane=move2pt_2.Moved)
trim_3 = TrimWithRegion(Curve=runion, Region=move2pt_3.Moved, Plane=move2pt_2.Moved)  # -> Inside, Outside
ci = ClusterOutput(trim_3.Inside)

# ==== cluster Cluster_5
A = ClusterInput()
robot_system = ClusterInput()
T = ClusterInput()
concat = Concatenate(FragmentA=A, FragmentB="_cuttoff")
relay = ClusterInput()
create_program = CreateProgram(Name=concat, RobotSystem=robot_system, Targets=T, StepSize=1)  # -> Program, Code, Duration, Warnings, Errors
G = ClusterInput()
filter = StreamFilter(Gate=G, Stream0=relay, Stream1=[relay, create_program.Program])
data = Data(filter)
data_2 = ClusterOutput(data)

# ==== cluster DFLHWCalibration: Creates a calibration script based on the foam stock dims
unique_file_name = ClusterInput()
robot_initial_plane = ClusterInput()
controlled_speed = ClusterInput()
safe_distance = ClusterInput()
transfer_speed = ClusterInput()
zone_accuracy = ClusterInput()
safe_z_plane = ClusterInput()
tool = ClusterInput()
robot_initial_plane_2 = Plane(robot_initial_plane)
number = Number(controlled_speed)
number_2 = Number(zone_accuracy)
safe_distance_2 = Number(safe_distance)
safe_z_plane_2 = Plane(safe_z_plane)
unique_file_name_2 = Panel(unique_file_name)
tool_2 = ToolParameter(tool)
number_3 = Number(transfer_speed)
flip_plane = FlipPlane(Plane=safe_z_plane_2, FlipX=False, FlipY=False, FlipZ=True)  # -> Flipped, ResultBoolean
rotate = Rotate(Geometry=flip_plane.Flipped, Angle=degrees(90), Plane=flip_plane.Flipped)  # -> Geometry, Transform
instructions_for_ur_operator = Panel("Please measure the Z and X offset")
instructions_for_ur_operator_2 = Panel("Please confirm the Z offset, and measure the Y offset")
popup_title_no_spaces = Panel("CALIBRATION")
popup_title_no_spaces_2 = Panel("CALIBRATION")
unit_z = UnitZ(Factor=expr("-x", safe_distance_2))
unit_z_2 = UnitZ(Factor=expr("-x", safe_distance_2))
dfl_ur_custom_popup = DFLURCustomPopup(N=popup_title_no_spaces_2, B=instructions_for_ur_operator)
dfl_ur_custom_popup_2 = DFLURCustomPopup(N=popup_title_no_spaces, B=instructions_for_ur_operator_2)
move = Move(Geometry=rotate.Geometry, Motion=unit_z)  # -> Geometry, Transform
move_2 = Move(Geometry=flip_plane.Flipped, Motion=unit_z_2)  # -> Geometry, Transform
zone_accuracy_2 = Panel(number_2)
zone_accuracy_3 = Panel(number_2)
zone_accuracy_4 = Panel(number_2)
zone_accuracy_5 = Panel(number_2)
zone_accuracy_6 = Panel(number_2)
transfer_speed_2 = Panel(number_3)
transfer_speed_3 = Panel(number_3)
controlled_speed_2 = Panel(number)
controlled_speed_3 = Panel(number)
transfer_speed_4 = Panel(number_3)
list = ValueList({"Joint", "Linear"}, selected="Linear")
list_2 = ValueList({"Joint", "Linear"}, selected="Linear")
list_3 = ValueList({"Joint", "Linear"}, selected="Linear")
list_4 = ValueList({"Joint", "Linear"}, selected="Linear")
list_5 = ValueList({"Joint", "Linear"}, selected="Linear")
createtarget = CreateTarget(Plane=flip_plane.Flipped, Motion=list_4, Tool=tool_2, Speed=transfer_speed_4, Zone=zone_accuracy_5, IsCartesian=True)
createtarget_2 = CreateTarget(Plane=robot_initial_plane_2, Motion=list, Tool=tool_2, Speed=transfer_speed_2, Zone=zone_accuracy_2, IsCartesian=True)
createtarget_3 = CreateTarget(
    Plane=move_2.Geometry,
    Motion=list_5,
    Tool=tool_2,
    Speed=controlled_speed_3,
    Zone=zone_accuracy_6,
    Command=dfl_ur_custom_popup_2,
    IsCartesian=True)
createtarget_4 = CreateTarget(
    Plane=move.Geometry,
    Motion=list_3,
    Tool=tool_2,
    Speed=controlled_speed_2,
    Zone=zone_accuracy_4,
    Command=dfl_ur_custom_popup,
    IsCartesian=True)
createtarget_5 = CreateTarget(Plane=rotate.Geometry, Motion=list_2, Tool=tool_2, Speed=transfer_speed_3, Zone=zone_accuracy_3, IsCartesian=True)
merge = Merge(Data1=createtarget_2, Data2=createtarget_5, Data3=createtarget_4, Data4=createtarget, Data5=createtarget_3)  # -> flatten(Result)
robot_system = ClusterInput()
concat = Concatenate(FragmentA=unique_file_name_2, FragmentB="_CB")
create_program = CreateProgram(Name=concat, RobotSystem=robot_system, Targets=merge, StepSize=1)  # -> Program, Code, Duration, Warnings, Errors
warnings = ClusterOutput(create_program.Warnings)

# ---- group: Unresolved Proxy / Cluster Output
program = ClusterOutput(create_program.Program)

# ----
errors = ClusterOutput(create_program.Errors)

# ==== cluster FancyPreview
L = ClusterInput()
sim_slider = ClusterInput()
lng = ListLength(List=L)
sim_slider_2 = Data(sim_slider)
multiplication = Multiplication(A=lng, B=sim_slider_2)
L_2 = ClusterInput()
round = Round(Number=multiplication)  # -> Nearest, Floor, Ceiling
item = ListItem(List=L_2, Index=expr("x-1", round.Ceiling), Wrap=False)
i = ClusterOutput(item)

# ==== cluster FancyPreview_2
data = ClusterInput()
sim_slider = ClusterInput()

data_2 = Data(data)
sim_slider_2 = Data(sim_slider)
lng = ListLength(List=data_2)
multiplication = Multiplication(A=lng, B=sim_slider_2)
round = Round(Number=multiplication)  # -> Nearest, Floor, Ceiling
item = ListItem(List=data_2, Index=expr("x-1", round.Ceiling), Wrap=False)

i = ClusterOutput(item)

# ==== cluster GetTopCenter
C = ClusterInput()

bbox = BoundingBox(Content=C, Plane=PlaneXY(0, 0, 0))  # -> Box, Box_2
debrep = DeconstructBrep(Brep=bbox.Box)  # -> Faces, Edges, Vertices
area = Area(Geometry=debrep.Faces)  # -> Area, Centroid
pdecon = Deconstruct(Point=area.Centroid)  # -> XComponent, YComponent, ZComponent
sort = SortList(Keys=pdecon.ZComponent, ValuesA=area.Centroid)  # -> Keys, ValuesA
item = ListItem(List=sort.ValuesA, Index="-1", Wrap=True)

i = ClusterOutput(item)

# ==== cluster HWSafeHeight
B = ClusterInput()
debrep = DeconstructBrep(Brep=B)  # -> Faces, Edges, Vertices
item = ListItem(List=debrep.Faces, Index=4, Wrap=True)
F = ClusterInput()
offset = OffsetSurface(Surface=debrep.Faces, Distance=F, Retrim=True)
planar = IsPlanar(Surface=item, Interior=True)  # -> Planar, Plane
split = SplitList(List=offset, Index=5)  # -> ListA, ListB
Z = UnitZ(Factor=F)
move = Move(Geometry=planar.Plane, Motion=Z)  # -> Geometry, Transform
srf = Surface(split.ListA)
planar_2 = IsPlanar(Surface=srf, Interior=True)  # -> Planar, Plane
z_plane = ClusterOutput(move.Geometry)
all_planes = ClusterOutput(planar_2.Plane)

# ==== cluster DFLHotWireCutters
weight_of_the_tool = Panel("1.2")
tool_centre_point = Panel("0,0,385")
weight_of_the_tool_2 = Panel("0.8")
tool_centre_point_2 = Panel("0,0,240")
name_of_tool = Panel("HWcutterNarrow")
name_of_tool_2 = Panel("HWcutterWide")
hw_wide_mesh = Mesh(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)
i = ClusterInput()
hw_narrow_mesh = Mesh(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)
merge = Merge(Data1=name_of_tool_2, Data2=tool_centre_point_2, Data3=weight_of_the_tool, Data4=hw_wide_mesh)
merge_2 = Merge(Data1=name_of_tool, Data2=tool_centre_point, Data3=weight_of_the_tool_2, Data4=hw_narrow_mesh)
merge_3 = Merge(Data1=graft(merge), Data2=graft(merge_2))
item = ListItem(List=merge_3, Index=i, Wrap=True)
name = ListItem(List=flatten(item), Index=0, Wrap=True)  # -> flatten(Item)
centre_point = ListItem(List=flatten(item), Index=1, Wrap=True)
panel = Panel(centre_point)
wieght = ListItem(List=flatten(item), Index=2, Wrap=True)
mesh = ListItem(List=flatten(item), Index=3, Wrap=True)
i_2 = ClusterOutput(centre_point)
i_3 = ClusterOutput(name)
i_4 = ClusterOutput(wieght)
i_5 = ClusterOutput(mesh)

# ==== cluster DFLURCustomPopup
N = ClusterInput()
B = ClusterInput()
concat = Concatenate(
    FragmentA="popup (\"",
    FragmentB=B,
    FragmentC="\", title=\"",
    FragmentD=N,
    FragmentE="\", warning=False, error=False, blocking=True)")
customcmd = CustomCommand(Name=N, Manufacturer="UR", Code=concat)
C = ClusterOutput(customcmd)

# ==== cluster ProjectToSafePlane
relay = ClusterInput()
P = ClusterInput()
project = Project(Geometry=relay, Plane=P)  # -> Geometry, Transform
pl_origin = PlaneOrigin(Base=relay, Origin=project.Geometry)
ln = Line(StartPoint=relay, EndPoint=pl_origin)
len = Length(Curve=ln)
sort = SortList(Keys=len, ValuesA=pl_origin)  # -> Keys, ValuesA
item = ListItem(List=sort.ValuesA, Index=0, Wrap=True)
i = ClusterOutput(item)

# ==== cluster TurntableGuide
relay = ClusterInput()
X = UnitX(Factor="-300")
X_2 = UnitX(Factor="-200")
move = Move(Geometry=relay, Motion=X)  # -> Geometry, Transform
move_2 = Move(Geometry=relay, Motion=X_2)  # -> Geometry, Transform
ln = Line(StartPoint=move_2.Geometry, EndPoint=move.Geometry)
rotate = Rotate(Geometry=ln, Angle=degrees(45), Plane=relay)  # -> Geometry, Transform
G = ClusterOutput(rotate.Geometry)
