# Grasshopper definition DFLUR5_DR1_T32026_CALIB_tidy.gh (Grasshopper 1.0.8)
# plug-ins: Robots, Pufferfish, Bifocals

# ---- group: RB Drawing Cleanup / Set Minimum Crv Length
input_curves = Curve()
number_slider = Slider(55, range=0..1000)
len = Length(Curve=input_curves)
sort = SortList(Keys=len, ValuesA=input_curves)  # -> Keys, ValuesA
split = SplitList(List=sort.ValuesA, Index=number_slider)  # -> ListA, ListB
item = ListItem(List=sort.Keys, Index=number_slider, Wrap=False)
smallest_crv_length = Panel(item)
join = JoinCurves(Curves=split.ListB, Preserve=False)

# ---- group: RB Drawing Cleanup / Set Minimum Feature Area
brec = BoundingRectangle(Geometry=graft(join), Plane=PlaneXY(0, 0, 0), Axis=0, Slide=0, Union=True)  # -> Bounding, DimensionX, DimensionY
area = Area(Geometry=brec.Bounding)  # -> Area, Centroid
sort_2 = SortList(Keys=flatten(area.Area), ValuesA=join)  # -> Keys, ValuesA
item_2 = ListItem(List=sort_2.Keys, Index=Slider(83, range=0..1000), Wrap=False)
split_2 = SplitList(List=sort_2.ValuesA, Index=item_2)  # -> ListA, ListB
minimum_area = Panel(item_2)

# ---- group: RB HATCH 2025
y_shift = Slider(8, range=0..10)
hatch_type = ValueList({"Straight": 0, "Zig Zag": 1, "2 Deg Zag": 2}, selected="Straight")
hatch_gap = Panel("1")
shift_count = Slider(12, range=1..20)
input_edge_crvs = Curve()
xy = XYPlane(Origin=Point(0, 0, 0))
rb_hatch_2025 = RBHATCH2025(
    G=hatch_type,
    edge_curves=input_edge_crvs,
    base_plane=xy,
    hatch_angle=degrees(Slider(45, range=0..90)),
    hatch_gap=hatch_gap,
    Y=y_shift,
    N=shift_count)  # -> flatten(ci)
crv = Curve(rb_hatch_2025)

# ---- group: RB Drawing Cleanup
reb = RebuildCurve(Curve=split_2.ListB, Degree="3", Count="20", Tangents=False)
crv_2 = Curve(reb)

# ---- group: Student Calibration Test Results
# Training A student tool: Measure the diameter and length of your tool
# Insert pen and run 4-point TCP calibration with DFL staff
# Enter resulting X, Y, Z values
# Click Toggle to activate the student pen
# Preview will appear in red to confirm activation
panel = Panel("0")
# DFL DR1 - Drawing and Painting
# info: Written by Richard Blackwell and Charlotte firth for the Design Futures Lab and BENV2001
# Grasshopper Instructions: --- First Time Use ---
# Find the Load Robot System Component in the Robot Setup Group
# Click 'Libraries'
# Select the Universal Robot's Library and click "Install"
# --- Student Tool Calibration Exercise ---
# Run Student Pen Calibration with Lab Technicians on the UR
# Edit Student Tool with TCP value
# Click Toggle Bool to activate, you will see the color change to red in the preview when it is activated
# --- General Use ---
# Clear Example Data from 'Input Curves'
# Set your Input Curves for drawing
# Click Data Dam "Play" button to generate Toolpath
# View/Test Simulation
# Optional: Adjust 'Pen Tilt' to avoid singularities
# Set File Path for USB Drive
# Name Project
# Click Save Button
# Eject Drive and load onto Robot
# Click File → Load Program
# Select filename.URP file on USB drive
panel_2 = Panel("0")
pt = ConstructPoint(XCoordinate=panel_2, YCoordinate=panel, ZCoordinate="0")

# ----
crv_3 = Curve([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])

# ---- group: Drawing Examples
calibration_test_curves = Curve([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])
dfl_logo_curves = Curve([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])

# ---- group: Make Custom Tool
motion_type = ValueList({"Drawing": 0, "Painting": 1}, selected="Drawing")
retract = Slider(8, range=0..8)
paint_pot = ValueList({"1": 0, "2": 1}, selected="1")
pressure = Slider(1, range=0..8)

use_calibrated_tcp = BooleanToggle(False)
pt_2 = ConstructPoint(XCoordinate="0", YCoordinate="0", ZCoordinate="0")

pen_length = Slider(107, range=1..250)
pen_dia = Slider(7.5, range=6..16)
pen_weight_kg = Panel(".1")

# ---- group: DFL PAINT BRUSH
paint_pot_2 = ValueList({"1": 0, "2": 1}, selected="1")
retract_2 = Slider(8, range=0..8)
pressure_2 = Slider(3, range=0..8)

# ---- group: DFL FULL TOOL
pressure_3 = Slider(1, range=0..8)
pen_preview_colour = ColourSwatch(SwatchColor=RGB(53, 196, 156))
pen_drawing = Curve(flatten(crv_3))
dfl_stabilo = DFLSTABILO(drawing_curve=pen_drawing, preview_colour=pen_preview_colour, tool_pressure=pressure_3)

# ---- group: DFL IKEA PENCIL
pressure_4 = Slider(1.4, range=0..8)
retract_3 = Slider(8, range=0..8)

# Note about pencils: Pencils need sharpening and will blunt over time, always run the pencil calibration script between drawings
pencil_drawing = Curve(flatten(calibration_test_curves))
ikea_pencil = IKEAPENCIL(drawing_curve=pencil_drawing, tool_pressure=pressure_4, tool_retract=retract_3)  # -> tcp, drawing_data

# ----
robot_placement = ValueList({"Cart": 0, "Table": 1}, selected="Cart")
sandbox_x_gap = Slider(155, range=0..200)
all_fixtures = ValueList({"Custom Fixture": 0, "Draw Table": 1, "Turntable": 2, "Turntable With riser": 3, "Turntable With large": 4, "Clay Cover": 5, "Clay Riser": 6, "Sand Box": 7}, selected="Draw Table")
addition = Addition(A=sandbox_x_gap, B=90)

# ----
# Fixture Setup
number_slider_2 = Slider(780, range=0..1000)
dfl_ur_fixtures = DFLURFixtures(x_distance_from_edge=56, robot_cart_selection=robot_placement, d2="500", F=addition, fixture_selection=all_fixtures)  # -> table_mesh, adaptorplate_2, fixture_track_mesh, fixture_z, fixture_base_plane, fixture_x, fixture_mesh, fixture_kinematics_mesh
cluster = Cluster_2(paintpot_offset=number_slider_2)  # -> G, paint_pots_2
table = ColourSwatch(SwatchColor=RGB(217, 185, 126))
mounts = CustomPreview(
    Geometry=[dfl_ur_fixtures.adaptorplate_2, dfl_ur_fixtures.fixture_track_mesh],
    Material=ColourSwatch(SwatchColor=RGBA(152, 149, 158, 165)))
table_2 = CustomPreview(Geometry=dfl_ur_fixtures.table_mesh, Material=table)
fixture = CustomPreview(
    Geometry=[dfl_ur_fixtures.fixture_mesh, dfl_ur_fixtures.fixture_kinematics_mesh, cluster.G],
    Material=ColourSwatch(SwatchColor=RGB(214, 214, 214)))

# ---- group: Make Custom Tool
pen_preview_colour_2 = ColourSwatch(SwatchColor=RGB(196, 53, 53))
tool_name = Panel("Custom_Tool")
input_curves_2 = Curve()
new_pen_holder = BooleanToggle(True)
dfl_dr2_tool = DFLDR2Tool_2(
    new_pen_holder=new_pen_holder,
    tool_length=pen_length,
    tool_dia=pen_dia,
    tool_weight=pen_weight_kg,
    use_calibrated=use_calibrated_tcp,
    tool_name=tool_name,
    preview_colour=pen_preview_colour_2,
    calibrated_tcp=pt_2,
    drawing_curve=input_curves_2,
    motion_type=motion_type,
    paint_pots=cluster.paint_pots_2,
    paint_pot_choice=paint_pot,
    tool_pressure=pressure,
    tool_retract=retract)  # -> tool, tcp, drawing_data
tool_centre_point = Panel(dfl_dr2_tool.tcp)

# ---- group: DFL PAINT BRUSH
pen_preview_colour_3 = ColourSwatch(SwatchColor=RGB(196, 53, 192))
painting = Curve(flatten([<curve referenced from the Rhino model> x53]))
dfl_paint_brush = DFLPAINTBRUSH(
    preview_colour=pen_preview_colour_3,
    drawing_curve=painting,
    paint_pots=cluster.paint_pots_2,
    paint_pot_choice=paint_pot_2,
    tool_pressure=pressure_2,
    tool_retract=retract_2)

# ----
get_latest_calibration_data = Button()

# ---- group: Drawing Layers / Collate Drawing Steps / Entwine
# Layers
# Insert the drawing data (from the tools) in the order that you want the drawing to take place, Click the data dam (play button) to regenerate any changes
entwine = Entwine(Branch0X=dfl_stabilo, FlattenInputs=False)

# ---- group: Drawing Layers / Collate Drawing Steps / Entwine / Re Calculate
dam = DataDam(DataA=entwine, BufferDelay=2500000, BufferMode=1)

# ---- group: Drawing Layers
# Drawing Setup
_4_pt_plane_in_use = ValueList({"Charlie (pre calibrated)": 0, "Darcy (pre calibrated)": 1, "Custom Calibration": 2}, selected="Charlie (pre calibrated)")
paper_length_x = Slider(297, range=0..420)
paper_width_y = Slider(420, range=0..420)
use_4_pt_calibrated_plane = BooleanToggle(True)
custom_calibration = Panel("")
dr_drawing_setup = DRDrawingSetup(
    drawing_data=dam,
    robot_choice=_4_pt_plane_in_use,
    use_calibrated_plane=use_4_pt_calibrated_plane,
    custom_calibration_points=custom_calibration,
    trigger=get_latest_calibration_data,
    length=paper_length_x,
    height=paper_width_y,
    x_distance_from_robot=dfl_ur_fixtures.fixture_x,
    fixtureheight_z=dfl_ur_fixtures.fixture_z)  # -> transfer_plane, pen_pressed_plane, paper_plane, custom_calib_msg, height_dom, width_dom
panel_4 = Panel(dr_drawing_setup.custom_calib_msg)
paper_outline = ColourSwatch(SwatchColor=RGB(0, 0, 0))
pln = Plane(dr_drawing_setup.pen_pressed_plane)
rectangle = Rectangle(Plane=dr_drawing_setup.paper_plane, XSize=dr_drawing_setup.height_dom, YSize=dr_drawing_setup.width_dom, Radius=0)  # -> Rectangle, Length
pln_2 = Plane(dr_drawing_setup.paper_plane)
pln_3 = Plane(dr_drawing_setup.transfer_plane)
paper_outline_2 = CustomPreview(Geometry=rectangle.Rectangle, Material=paper_outline)

# ---- group: Number of planes (should not exceed 40,000)
# Path Planning
number_slider_3 = Slider(0.1, range=0..10)
dr_path_planning = DRPathPlanning(pressure_plane=pln, tolerance=number_slider_3, drawing_data=dam)  # -> oriented_planes, positioned_curves
lng = ListLength(List=flatten(dr_path_planning.oriented_planes))
number_of_planes_should_not_exceed_40_00 = Panel(lng)  # "Number of Planes (should not exceed 40,000)"

# ---- group: Robot Setup + initial pose
controlled_speed = Slider(30, range=1..100)
transfer_speed = Slider(100, range=1..100)
zone_accuracy = Slider(0.5, range=-0.01..2)

# ---- group: Save URP
select_a_directory = FilePath("/Volumes/UR20/")
set_as_your_usb_drive = Panel(select_a_directory)

# ---- group: Robot Setup + initial pose
# Robot Setup
list = RobotsLibrary(
    {"AA-KR60", "AA-KR30", "AA-KR60_KR30", "UR3e", "UR5e", "UR10e", "UR16e", "UR3", "UR5", "UR10", "UR20", "UR30"}, selected="UR5",
    Type=0)
loadrobot = LoadRobotSystem(Name=list, Base=PlaneXY(0, 0, 0))
strokes_per_refill = Slider(6, range=1..10)
pen_change_pose_av_degrees = Panel("""9
-50
-126
-37
83
0""")
degrees_to_radians = DegreesToRadians(Degrees=pen_change_pose_av_degrees, RobotSystem=loadrobot, MechanicalGroup=0)

# ----
# Simulate
# Analysis
sim_slider = Slider(0.51983, range=0..1)
preview_transitions = BooleanToggle(False)
live_toolpath = ColourSwatch(SwatchColor=RGBA(96, 11, 153, 147))
robot = ColourSwatch(SwatchColor=RGBA(93, 116, 120, 159))

# ---- group: Save URP
# Save
# Saving Instructions: Please set your Project Name without spaces
# Right-click 'Select a Directory' and choose a location on your USB drive
# Click 'Save as URP' (if the icon flashes red, the directory is not set or the USB is not mounted)
# Files must have unique names on the controller. A Data Recorder appends a number to each saved file
# To reset the counter, click the X on the 'click counter' Data Recorder
project_name = Panel("demo1")
save_as_urp = Button()
include_pen_test_script = BooleanToggle(True)
click_counter = DataRecorder(save_as_urp, DataLimit=-10, RecordData=False)
cluster_2 = Cluster(project_name=project_name, click_log=click_counter)
dispatch = Dispatch(List=set_as_your_usb_drive, DispatchPattern=save_as_urp)  # -> ListA, ListB
unique_file_name = Panel(cluster_2)

# ---- group: Robot Setup + initial pose (continued)
dr_robotic_motions = DRRoboticMotions(
    robot_system=loadrobot,
    initial_pose_d=degrees_to_radians,
    drawing_speed=controlled_speed,
    transfer_speed=transfer_speed,
    zone_accuracy=zone_accuracy,
    drawing_data=dam,
    pen_transfer_plane=pln_3,
    paper_plane=pln_2,
    oriented_planes=dr_path_planning.oriented_planes,
    paint_strokes_per_refill=strokes_per_refill,
    test_location_plane=dr_drawing_setup.paper_plane,
    program_name=unique_file_name)  # -> flattened_targets, grafted_drawing_commands, tool_test_program

# ----
create_program = CreateProgram(Name=unique_file_name, RobotSystem=loadrobot, Targets=dr_robotic_motions.flattened_targets, StepSize=1)  # -> Program, Code, Duration, Warnings, Errors
any_program_errors = Panel(create_program.Errors)
any_program_warnings = Panel(create_program.Warnings)
scr_preview = Panel(create_program.Code)
expression = Expression(x=create_program.Duration, Expression="Floor(x/60)")
duration_minutes = Panel(expression)
program_simulation = ProgramSimulation(Program=create_program.Program, Time=sim_slider, Normalized=True)  # -> SystemMeshes, JointRotations, Plane, Index, Time, flatten(Program), Errors
degrees = Degrees(Radians=graft(program_simulation.JointRotations))  # -> simplify(Degrees)
each_axis_rotation_analysis = Panel(degrees)
dr_preview = DRPreview(D=dam, G=preview_transitions, G_2=dr_path_planning.positioned_curves, T=dr_robotic_motions.grafted_drawing_commands)  # -> col_2, s_0
preview = CustomPreview(Geometry=dr_preview.s_0, Material=dr_preview.col_2)
custom_preview = CustomPreview(Geometry=program_simulation.SystemMeshes, Material=robot)

# ---- group: Colour Swatch
trail = SimpleTrail(Program=program_simulation.Program, Length=500, MechanicalGroup=0)

# ----
preview_2 = CustomPreview(Geometry=trail, Material=live_toolpath)

# ---- group: Save URP (continued)
filter = StreamFilter(
    Gate=include_pen_test_script,
    Stream0=create_program.Program,
    Stream1=[create_program.Program, dr_robotic_motions.tool_test_program])
# Paint Brush additions
saveprog = SaveProgram(Program=filter, Folder=dispatch.ListA)

# ==== cluster Cluster
click_log = ClusterInput()
lng = ListLength(List=click_log)
addition = Addition(A=lng, B=1)
project_name = ClusterInput()
division = Division(A=addition, B=2)
rep = ReplaceText(Text=project_name, Find=" ", Replace="_", RecursiveReplace=False)
round = Round(Number=division)  # -> Nearest, Floor, Ceiling
concat = Concatenate(FragmentA=rep, FragmentC="_", FragmentB=round.Ceiling)
iterative_name = ClusterOutput(concat)

# ==== cluster RBHATCH2025
G = ClusterInput()
edge_curves = ClusterInput()
base_plane = ClusterInput()
hatch_angle = ClusterInput()
hatch_gap = ClusterInput()
Y = ClusterInput()
N = ClusterInput()
rb_bounding_hatch = RBBoundingHatch(shift=Y, base_plane=base_plane, hatch_angle=degrees(hatch_angle), E=edge_curves, hatch_gap=hatch_gap)  # -> rotated_plane, hatches, region_breps
xy = XYPlane(Origin=Point(0, 0, 0))
vec = VectorXYZ(XComponent=0, YComponent=Y, ZComponent=0)  # -> Vector, Length
dispatch = Dispatch(List=rb_bounding_hatch.hatches, DispatchPattern=[True, False])  # -> ListA, ListB
pln = Plane(rb_bounding_hatch.rotated_plane)
move = Move(Geometry=xy, Motion=vec.Vector)  # -> Geometry, Transform
flip = FlipCurve(Curve=dispatch.ListB)  # -> Curve, Flag
weave = Weave(Pattern=[0, 1], Stream0=dispatch.ListA, Stream1=flip.Curve, NullGaps=False)
divide = DivideCurve(Curve=weave, Count=N, Kinks=False)  # -> Points, Tangents, Parameters
dispatch_2 = Dispatch(List=divide.Points, DispatchPattern=[True, False])  # -> ListA, ListB
pl_origin = PlaneOrigin(Base=pln, Origin=dispatch_2.ListB)
pl_origin_2 = PlaneOrigin(Base=pln, Origin=dispatch_2.ListA)
orient = Orient(Geometry=move.Geometry, Source=xy, Target=pl_origin_2)  # -> Geometry, Transform
weave_2 = Weave(Pattern=[0, 1], Stream0=orient.Geometry, Stream1=pl_origin, NullGaps=False)
pline = PolyLine(Vertices=weave_2, Closed=False)
reb = RebuildCurve(Curve=pline, Degree="2", Count=expr("X*2", N), Tangents=False)
crv = Curve(flatten(pline))
filter = StreamFilter(Gate=G, Stream0=weave, Stream1=pline, Stream2=reb)
crv_2 = Curve(flatten(filter))
trim = TrimWithBrep(Curve=crv_2, Brep=graft(rb_bounding_hatch.region_breps))  # -> simplify(Inside), Outside
ci = ClusterOutput(trim.Inside)

# ==== cluster DRDrawingSetup
drawing_data = ClusterInput()
use_calibrated_plane = ClusterInput()
custom_calibration_points = ClusterInput()
length = ClusterInput()
height = ClusterInput()
x_distance_from_robot = ClusterInput()
fixtureheight_z = ClusterInput()
panel = Panel("https://raw.githubusercontent.com/designfutureslab/DR/refs/heads/main/CharlieDrawCalib.txt")
get_latest_calibration_data = Button()
panel_2 = Panel("https://raw.githubusercontent.com/designfutureslab/DR/refs/heads/main/DarcyDrawCalib.txt")
trigger = ClusterInput()

retract_height = SplitTree(Data=drawing_data, Masks=flatten("{?;6}"))  # -> Positive, Negative
trim = TrimTree(Tree=retract_height.Positive, Depth=1)

pen_pressure = SplitTree(Data=drawing_data, Masks=flatten("{?;5}"))  # -> Positive, Negative
trim_2 = TrimTree(Tree=pen_pressure.Positive, Depth=1)

custom_calibration_points_2 = Data(custom_calibration_points)
py3 = Python3Script(url=panel, trigger=trigger)  # -> text, ok, msg; inputs url: String, trigger: Boolean
# ---------- py3: Python ----------
"""
General-purpose: fetches any text file from a URL whenever `trigger` goes True.
Also looks up the file's last GitHub commit date (if it's a raw.githubusercontent.com URL)
and appends it to the status message, converted to local time.

Safe for multiple instances of this component on the same canvas: the cache
is keyed by the URL itself, so separate components with separate URLs never
collide or overwrite each other's stored result.

Inputs:
    url     : str  - full URL to the text file (raw.githubusercontent.com works best)
    trigger : bool - fires the fetch on True
Outputs:
    text    : list of str - the file's contents, one line per list item
    ok      : bool - True if fetch succeeded
    msg     : str  - status message, including last GitHub commit date if available
"""

import urllib.request
import urllib.error
import datetime
import time
import json
import re
import scriptcontext as sc

# Key the cache by URL so multiple instances of this component (e.g. one per robot)
# never stomp on each other's stored result.
key = "url_fetch_cache::" + str(url)

if key not in sc.sticky:
    sc.sticky[key] = {"text": "", "ok": False, "msg": "Not yet run"}

cache = sc.sticky[key]


def get_github_commit_date(raw_url):
    """
    If raw_url is a raw.githubusercontent.com link, query the GitHub API
    for the last commit date touching that specific file path.
    Handles both URL styles:
      .../owner/repo/branch/path
      .../owner/repo/refs/heads/branch/path  (or refs/tags/tag/path)
    Returns a timezone-aware UTC datetime, or None if not applicable / lookup fails.
    """
    m = re.match(
        r"https?://raw\.githubusercontent\.com/([^/]+)/([^/]+)/refs/(?:heads|tags)/([^/]+)/(.+)",
        raw_url
    )
    if not m:
        m = re.match(
            r"https?://raw\.githubusercontent\.com/([^/]+)/([^/]+)/([^/]+)/(.+)",
            raw_url
        )
    if not m:
        return None

    owner, repo, branch, path = m.groups()
    api_url = "https://api.github.com/repos/{}/{}/commits?path={}&sha={}&per_page=1".format(
        owner, repo, path, branch
    )
    req = urllib.request.Request(api_url, headers={
        "User-Agent": "Mozilla/5.0",
        "Accept": "application/vnd.github+json"
    })
    with urllib.request.urlopen(req, timeout=10) as resp:
        data = json.loads(resp.read().decode("utf-8"))

    if isinstance(data, list) and len(data) > 0:
        date_str = data[0]["commit"]["committer"]["date"]  # e.g. "2026-09-29T01:10:00Z"
        utc_dt = datetime.datetime.strptime(date_str, "%Y-%m-%dT%H:%M:%SZ")
        utc_dt = utc_dt.replace(tzinfo=datetime.timezone.utc)
        return utc_dt
    return None


if trigger:
    try:
        separator = "&" if "?" in url else "?"
        fetch_url = url + separator + "cachebust=" + str(int(time.time()))

        req = urllib.request.Request(fetch_url, headers={"User-Agent": "Mozilla/5.0"})
        with urllib.request.urlopen(req, timeout=10) as response:
            decoded = response.read().decode("utf-8")

        cache["text"] = decoded
        cache["ok"] = True
        now_str = datetime.datetime.now().strftime("%Y-%m-%d %H:%M:%S")

        commit_date_str = None
        commit_lookup_error = None
        try:
            utc_dt = get_github_commit_date(url)
            if utc_dt:
                local_dt = utc_dt.astimezone()
                commit_date_str = local_dt.strftime("%Y-%m-%d %H:%M:%S")
        except urllib.error.HTTPError as e:
            if e.code == 403:
                commit_lookup_error = "rate-limited (403)"
            else:
                commit_lookup_error = "HTTP {}".format(e.code)
        except Exception as e:
            commit_lookup_error = str(e)

        if commit_date_str:
            cache["msg"] = "Fetched {} chars at {}. File last updated: {}".format(
                len(decoded), now_str, commit_date_str
            )
        elif commit_lookup_error:
            cache["msg"] = "Fetched {} chars at {}. File last updated: unknown ({})".format(
                len(decoded), now_str, commit_lookup_error
            )
        else:
            cache["msg"] = "Fetched {} chars at {}. File last updated: unknown".format(
                len(decoded), now_str
            )

    except urllib.error.URLError as e:
        cache["ok"] = False
        cache["msg"] = "URL error: {}".format(e.reason)
    except Exception as e:
        cache["ok"] = False
        cache["msg"] = "Error: {}".format(e)

sc.sticky[key] = cache

text = cache["text"].splitlines()
ok = cache["ok"]
msg = cache["msg"]
# ---------- end py3 ----------
py3_2 = Python3Script(url=panel_2, trigger=trigger)  # -> text, ok, msg; inputs url: String, trigger: Boolean; same code as py3

# ---- group: Paper Size and position
fixtureheight_z_2 = Panel(fixtureheight_z)
x_distance_from_robot_2 = Panel(x_distance_from_robot)
dfl_paper_setup = DFLPaperSetup(length=length, height=height, X=x_distance_from_robot_2, Z=fixtureheight_z_2)  # -> height_dom, width_dom, P

# ----
panel_3 = Panel(py3.text)
panel_4 = Panel(py3.msg)
concat = Concatenate(FragmentA="Charlie : ", FragmentB=py3.msg, FragmentC="Darcey :", FragmentD=py3_2.msg)
sept_24_2026_darcy = Panel(py3_2.text)
panel_5 = Panel(py3_2.text)
panel_6 = Panel(py3_2.msg)

# ---- group: 4 point Calibration
custom_calibration_points_3 = Panel(custom_calibration_points_2)
_4_point_charlie_x_y_z = Panel("""338.99,226.76,6.95
665.22,225.90,8.43
665.40,-224.25,6.10
337.55,-224.68,4.65""")
robot_choice = ClusterInput()
filter = StreamFilter(Gate=robot_choice, Stream0=_4_point_charlie_x_y_z, Stream1=sept_24_2026_darcy, Stream2=custom_calibration_points_3)

# ----
panel_7 = Panel(concat)
plfit = PlaneFit()  # -> Plane, Deviation
pt = Point(filter)
item = ListItem(List=filter, Index=0, Wrap=True)  # -> Item, Item1, Item2, Item3
srf4pt = _4PointSurface(CornerA=item.Item, CornerB=item.Item1, CornerC=item.Item2, CornerD=item.Item3)
plfit_2 = PlaneFit(Points=pt)  # -> Plane, Deviation
planar = IsPlanar(Surface=srf4pt, Interior=True)  # -> Planar, Plane
pl_origin = PlaneOrigin(Base=plfit_2.Plane, Origin=planar.Plane)
custom_calib_msg = ClusterOutput(concat)
height_dom = ClusterOutput(dfl_paper_setup.height_dom)
width_dom = ClusterOutput(dfl_paper_setup.width_dom)

# ---- group: Paper Plane
ideal_paper_plane = Plane(dfl_paper_setup.P)

# ----
flippln = FlipPlane(Plane=pl_origin, Guide=ideal_paper_plane, FlipX=True, FlipY=True, FlipZ=True)  # -> Flipped, R

# ---- group: Paper Plane (continued)
calibrated_plane = Plane(flippln.Flipped)
filter_2 = StreamFilter(Gate=use_calibrated_plane, Stream0=ideal_paper_plane, Stream1=calibrated_plane)

# ----
pln = Plane(flippln.Flipped)

# ---- group: Create Transfer Planes
pl_offset = PlaneOffset(BasePlane=filter_2, Offset=trim)

# ---- group: Create Pressure planes
multiplication = Multiplication(A=trim_2, B=-1)
pl_offset_2 = PlaneOffset(BasePlane=filter_2, Offset=multiplication)

# ----
pln_2 = Plane(ideal_paper_plane)
pln_3 = Plane(filter_2)
transfer_plane = ClusterOutput(pl_offset)
pen_pressed_plane = ClusterOutput(pl_offset_2)
paper_plane = ClusterOutput(pln_3)

# ==== cluster Cluster_2
paintpot_offset = ClusterInput()
Z = UnitZ(Factor="-16")
brep = Brep([<brep referenced from the Rhino model> x5])
X = UnitX(Factor=paintpot_offset)
addition = Addition(A=paintpot_offset, B="40")
panel = Panel("-40")
multiplication = Multiplication(A="40", B=-1)
move = Move(Geometry=brep, Motion=X)  # -> Geometry, Transform

# ---- group: Set Paint Pot / Left most paint pot
panel_2 = Panel("-15")
pt = ConstructPoint(XCoordinate=addition, YCoordinate="40", ZCoordinate=0)

# ---- group: Set Paint Pot / Right Most paint pot
panel_3 = Panel("64")
pt_2 = ConstructPoint(XCoordinate=addition, YCoordinate=multiplication, ZCoordinate=0)

# ----
move_2 = Move(Geometry=move.Geometry, Motion=Z)  # -> Geometry, Transform

# ---- group: Set Paint Pot
paint_pots = Point([pt, pt_2])

# ----
G = ClusterOutput(move_2.Geometry)
paint_pots_2 = ClusterOutput(paint_pots)

# ==== cluster DRPathPlanning
drawing_data = ClusterInput()

contour_curves = SplitTree(Data=drawing_data, Masks=flatten("{?;3}"))  # -> Positive, Negative
trim = TrimTree(Tree=contour_curves.Positive, Depth=1)

pressure_plane = ClusterInput()

# ---- group: Move Drawing To Paper
# Path Planning
paper_plane = Plane(pressure_plane)
project = Project(Geometry=trim, Plane=paper_plane)  # -> Geometry, Transform
bbox = BoundingBox(Content=flatten(project.Geometry), Plane=paper_plane, UnionBox=True)  # -> Box, Box_2
area = Area(Geometry=bbox.Box)  # -> Area, Centroid
move2pt = MoveToPoint(Geometry=project.Geometry, PointA=area.Centroid, PointB=paper_plane)  # -> Moved, Vector, Transform

# ----
positioned_curves = ClusterOutput(move2pt.Moved)
tolerance = ClusterInput()

# ---- group: Divide (Polyline)
dfl_curves_to_planes = DFLCrvToPln(P=pressure_plane, C=move2pt.Moved, td=tolerance)

# ---- group: Reorient Planes
pen_tilt = Slider(0, range=0..45)
list = ValueList({"0 deg": 0, "90 deg": 90, "180 deg": 180, "270 deg": 270, "360 deg": 360}, selected="180 deg")
list_2 = ValueList({"x": 0, "y": 1, "z": 2}, selected="x")
dfl_re_orient_planes = DFLReOrientPlanes(planes=dfl_curves_to_planes, rotation_axis=list_2, fine_adjustment=pen_tilt, quad_rotate=list)

# ----
pen_tilt_2 = Slider(0, range=0..45)
list_3 = ValueList({"0 deg": 0, "90 deg": 90, "180 deg": 180, "270 deg": 270, "360 deg": 360}, selected="90 deg")
list_4 = ValueList({"x": 0, "y": 1, "z": 2}, selected="z")
dfl_re_orient_planes_2 = DFLReOrientPlanes(planes=dfl_re_orient_planes, rotation_axis=list_4, fine_adjustment=pen_tilt_2, quad_rotate=list_3)

oriented_planes = ClusterOutput(dfl_re_orient_planes_2)

# ==== cluster DRRoboticMotions
pen_transfer_plane = ClusterInput()
paper_plane = ClusterInput()
oriented_planes = ClusterInput()
robot_system = ClusterInput()
zone_accuracy = ClusterInput()
drawing_data = ClusterInput()
initial_pose_d = ClusterInput()
transfer_speed = ClusterInput()
drawing_speed = ClusterInput()

pot_location = SplitTree(Data=drawing_data, Masks=flatten("{?;7}"))  # -> Positive, Negative
trim = TrimTree(Tree=pot_location.Positive, Depth=1)

# ---- group: Path Planning
pln = Plane(simplify(oriented_planes))

# ----
num = Number(zone_accuracy)
num_2 = Number(drawing_speed)
data = Data(initial_pose_d)
paper_plane_2 = Plane(paper_plane)

tools = SplitTree(Data=drawing_data, Masks=flatten("{?;1}"))  # -> Positive, Negative
trim_2 = TrimTree(Tree=tools.Positive, Depth=1)

pen_transfer_plane_2 = Plane(pen_transfer_plane)
instructions_for_ur_operator = Panel("Please ensure you Pen and paper is Correctly loaded, that DFL staff have set up the Robot, and that you have reviewed the simulation in Grasshopper or on the SmartPad")

# ---- group: Locate Paint pot at Pen Orientation
item = ListItem(List=flatten(pln), Index=-1, Wrap=True)  # -> flatten(Item)
move2pt = MoveToPoint(Geometry=item, PointA=item, PointB=trim)  # -> Moved, Vector, Transform
project = Project(Geometry=move2pt.Moved, Plane=item)  # -> Geometry, Transform

# ----
test_location_plane = ClusterInput()
program_name = ClusterInput()
pen_change_pose_av_degrees = Panel("""9
-50
-126
-37
83
0""")

# ---- group: Set Dip + Wipe
paint_pot_wipe_x = Panel("-100")
paint_pot_wipe_z = Panel("80")
paint_pot_z = Panel("-10")
vec = VectorXYZ(XComponent=paint_pot_wipe_x, YComponent=0, ZComponent=paint_pot_wipe_z)  # -> Vector, Length
Z = UnitZ(Factor=paint_pot_z)
move = Move(Geometry=project.Geometry, Motion=vec.Vector)  # -> Geometry, Transform
move_2 = Move(Geometry=project.Geometry, Motion=Z)  # -> Geometry, Transform

# ---- group: Lead In
py3 = Python3Script(A=trim_2, B=pln)  # -> out, R; inputs A: tree, B: tree
# ---------- py3: Python ----------
from Grasshopper import DataTree
from Grasshopper.Kernel.Data import GH_Path

def as_tree(x):
    """Return x as a DataTree; wrap as {0} if not already a tree."""
    if hasattr(x, "Paths"):
        return x
    T = DataTree[object]()
    try:
        for it in x:
            T.Add(it, GH_Path(0))
    except:
        T.Add(x, GH_Path(0))
    return T

def tool_for_top(A, top_idx):
    p = GH_Path(top_idx)
    if A.PathExists(p):
        br = A.Branch(p)
        if br: 
            return br[0]   # return the tool object itself
    # fallback: first available
    if A.Paths:
        br = A.Branch(A.Paths[0])
        if br: 
            return br[0]
    return None

A = as_tree(A)
B = as_tree(B)

R = DataTree[object]()
for p in B.Paths:
    n = len(B.Branch(p))
    top = p.Indices[0] if len(p.Indices) else 0
    tool = tool_for_top(A, top)
    for _ in range(n):
        R.Add(tool, p)
# ---------- end py3 ----------
item_2 = ListItem(List=py3.R, Index=0, Wrap=True)
item_3 = ListItem(List=pln, Index=0, Wrap=True)  # -> Item1, Item
project_2 = Project(Geometry=item_3.Item, Plane=pen_transfer_plane_2)  # -> Geometry, Transform
controlled_speed = Panel(num_2)

# ---- group: Set Safe Height
paint_pot_z_safe = Panel("80")
Z_2 = UnitZ(Factor=paint_pot_z_safe)
move_3 = Move(Geometry=project.Geometry, Motion=Z_2)  # -> Geometry, Transform

# ----
tool_names = SplitTree(Data=drawing_data, Masks=flatten("{?;0}"))  # -> Positive, Negative
trim_3 = TrimTree(Tree=tool_names.Positive, Depth=1)

dfl_tool_test = DFLToolTest(
    robot=robot_system,
    tool_name=trim_3,
    tool=trim_2,
    correctly_oriented_plane_s=oriented_planes,
    test_location_plane=test_location_plane,
    program_name=program_name,
    robot_system=robot_system)

# ---- group: Pen Change
pen_change_pose_av_degrees_2 = Panel("""9
-50
-126
-37
83
0""")
concat = Concatenate(FragmentB=trim_3, FragmentC="_change")
concat_2 = Concatenate(FragmentA="Insert ", FragmentB=trim_3, FragmentC=" layer and click continue to resume")
popup_text = Panel(concat_2)
popup_title_no_spaces = Panel(concat)
degrees_to_radians = DegreesToRadians(Degrees=pen_change_pose_av_degrees, RobotSystem=robot_system, MechanicalGroup=0)
dfl_ur_custom_popup = DFLURCustomPopup(N=popup_title_no_spaces, popup_text=popup_text)

# ----
tool_test_program = ClusterOutput(dfl_tool_test)

popup_text_2 = Panel("Job Complete! Please put all the caps back on the pens and tidy up!")
popup_title_no_spaces_2 = Panel("Job_Done")
dfl_ur_custom_popup_2 = DFLURCustomPopup(N=popup_title_no_spaces_2, popup_text=popup_text_2)

item_4 = ListItem(List=flatten(trim_2), Index=-1, Wrap=True)
list = ValueList({"Joint", "Linear", "Process"}, selected="Linear")
num_3 = Number(transfer_speed)

# ---- group: Initial Pose
item_5 = ListItem(List=flatten(trim_2), Index=0, Wrap=True)
# Robotic Commands
popup_title_no_spaces_3 = Panel("Operator_Safety")
popup_text_3 = Panel(instructions_for_ur_operator)
dfl_ur_custom_popup_3 = DFLURCustomPopup(N=popup_title_no_spaces_3, popup_text=popup_text_3)
createtarget = CreateTarget(Joints=data, Tool=item_5, Speed=num_3, Zone=num, Command=dfl_ur_custom_popup_3, IsCartesian=False)

# ----
list_2 = ValueList({"Joint", "Linear", "Process"}, selected="Joint")

# ---- group: Linear Movements
zone_accuracy_2 = Panel(num)
controlled_speed_2 = Panel(num_2)

# ----
list_3 = ValueList({"Joint", "Linear", "Process"}, selected="Linear")
createtarget_2 = CreateTarget(Plane=project_2.Geometry, Motion=list, Tool=item_2, Speed=num_3, Zone=num, IsCartesian=True)
list_4 = ValueList({"Joint", "Linear", "Process"}, selected="Linear")
createtarget_3 = CreateTarget(Plane=pln, Motion=list_3, Tool=py3.R, Speed=controlled_speed_2, Zone=zone_accuracy_2, IsCartesian=True)

# ---- group: Lead Out
list_5 = ValueList({"Joint", "Linear"}, selected="Linear")
project_3 = Project(Geometry=item_3.Item1, Plane=pen_transfer_plane_2)  # -> Geometry, Transform

# ----
list_6 = ValueList({"Joint", "Linear", "Process"}, selected="Linear")
createtarget_4 = CreateTarget(Joints=data, Tool=item_4, Speed=num_3, Zone=num, Command=dfl_ur_custom_popup_2, IsCartesian=False)
createtarget_5 = CreateTarget(Joints=degrees_to_radians, Tool=trim_2, Speed=num_3, Zone=num, Command=dfl_ur_custom_popup, IsCartesian=False)
ins = InsertItems(List=createtarget_3, Item=createtarget_2, Indices=0, Wrap=True)
createtarget_6 = CreateTarget(Plane=project_3.Geometry, Motion=list_6, Tool=item_2, Speed=num_3, Zone=num, IsCartesian=True)
ins_2 = InsertItems(List=ins, Item=createtarget_6, Indices=-1, Wrap=True)  # -> simplify(List)
paint_strokes_per_refill = ClusterInput()
data_2 = Data(ins_2)

drawing_painting = SplitTree(Data=drawing_data, Masks=flatten("{?;4}"))  # -> Positive, Negative
approach_choice_bool = TrimTree(Tree=drawing_painting.Positive, Depth=1)
more_than_1 = MoreThan1(T=drawing_data)

# ---- group: Paint pot refill motions
paint_wipe_plane = Plane(move.Geometry)
paint_pot_safe_plane = Plane(move_3.Geometry)
paint_pot_plane = Plane(move_2.Geometry)
list_7 = ValueList({"Joint", "Linear"}, selected="Linear")
list_8 = ValueList({"Joint", "Linear"}, selected="Linear")

# ----
createtarget_7 = CreateTarget(Plane=paint_pot_plane, Motion=list_4, Tool=trim_2, Speed=num_2, Zone=num, IsCartesian=True)
createtarget_8 = CreateTarget(Plane=paint_pot_safe_plane, Motion=list_2, Tool=trim_2, Speed=num_3, Zone=num, IsCartesian=True)
createtarget_9 = CreateTarget(Plane=paint_wipe_plane, Motion=list_7, Tool=trim_2, Speed=num_2, Zone=num, IsCartesian=True)

# ---- group: Paint pot refill motions (continued)
merge = Merge(Data1=createtarget_8, Data2=createtarget_7, Data3=createtarget_9)

# ----
data_3 = Data(merge)
gtp5_py3_insert_strokes = Python3Script(A=data_2, B=data_3, C=paint_strokes_per_refill)  # -> out, R; inputs A: tree, B: tree
# ---------- gtp5_py3_insert_strokes: Python ----------
# Works for 1 or many tools; inserts dip at first stroke of each group, then every N
from Grasshopper import DataTree
from Grasshopper.Kernel.Data import GH_Path

def build_dip_map(B):
    # map: top index -> dip sequence (list); also default (first branch)
    dip_map = {}
    default_seq = []
    paths = list(B.Paths)
    if paths:
        default_seq = list(B.Branch(paths[0]))
    for p in paths:
        inds = list(p.Indices)
        top = inds[0] if inds else 0
        seq = dip_map.get(top, [])
        seq.extend(list(B.Branch(p)))
        dip_map[top] = seq
    return dip_map, default_seq

def pick(A, B, N):
    N = int(N) if (N and N > 0) else 1
    R = DataTree[object]()

    dip_map, default_seq = build_dip_map(B)
    has_multi_dip_groups = (len(dip_map) > 1)

    # per “group” counter (group = tool index when multiple tools; else single global)
    counters = {}

    for p in A.Paths:
        inds = list(p.Indices)

        # Group key:
        # - multi-tool: use first index of the stroke path (tool index)
        # - single-tool (or only one dip set): use fixed key 0 (one global counter)
        key = inds[0] if (has_multi_dip_groups and len(inds) >= 2) else 0

        count = counters.get(key, 0)
        dips = dip_map.get(key, default_seq)

        if dips and (count % N == 0):
            for d in dips:
                R.Add(d, p)

        # append stroke branch
        for it in A.Branch(p):
            R.Add(it, p)

        counters[key] = count + 1

    return R

R = pick(A, B, C)
# ---------- end gtp5_py3_insert_strokes ----------
dfl_weaver = DFLWeaver(
    more_than_1=more_than_1,
    tool_change_motions=createtarget_5,
    drawing_motions=ins_2,
    painting_motions=gtp5_py3_insert_strokes.R,
    motion_choice=approach_choice_bool)

# ---- group: Order Program
merge_2 = Merge(Data1=createtarget, Data2=flatten(dfl_weaver), Data3=createtarget_4)  # -> flatten(Result)

# ----
data_4 = Data(dfl_weaver)
grafted_drawing_commands = ClusterOutput(data_4)
flattened_targets = ClusterOutput(merge_2)

# ==== cluster DFLURFixtures
x_distance_from_edge = ClusterInput()
robot_cart_selection = ClusterInput()
d2 = ClusterInput()
custom_fixture_z = ClusterInput()
F = ClusterInput()
fixture_selection = ClusterInput()
adaptorplate = Mesh(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)
carttabletop = Mesh(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)
carttrack = Mesh([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])
tabletop = Mesh(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)
tabletrack = Mesh([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])
zoffset = Panel("-15")
_50_riser_square = Mesh(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)
extension = Mesh(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)
zoffset_2 = Panel("24.5")
zoffset_3 = Panel("78")
_90_circle_mount = Mesh(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)
turntable = Mesh(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)
zoffset_4 = Panel("3")
_140_circle_mount = Mesh(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)
clay_cover = Mesh(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)
mesh = Mesh([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])
_100_plate_square = Mesh(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)
extension_clay = Mesh(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)
multiplication = Multiplication(A=x_distance_from_edge, B=-1)
merge = Merge(Data1=carttabletop, Data2=flatten(carttrack))
merge_2 = Merge(Data1=tabletop, Data2=flatten(tabletrack))
addition = Addition(A=custom_fixture_z, B=zoffset)
mesh_2 = Mesh(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)
zoffset_5 = Panel("19")
drawing_table = Mesh(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)
number_slider = Slider(100, range=0..100)
mesh_3 = Mesh(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)
mjoin = MeshJoin(Meshes=[turntable, extension, _50_riser_square])
addition_2 = Addition(A=zoffset_2, B=zoffset_3)
turntablebase = Mesh(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)
mjoin_2 = MeshJoin(Meshes=[turntable, extension, _100_plate_square])
addition_3 = Addition(A=zoffset_2, B=zoffset_4)
mjoin_3 = MeshJoin(Meshes=[turntable, clay_cover])
mjoin_4 = MeshJoin(Meshes=[turntable, clay_cover, mesh, _140_circle_mount])
mjoin_5 = MeshJoin(Meshes=[turntable, clay_cover, mesh])
X = UnitX(Factor=F)
pt = ConstructPoint(XCoordinate=multiplication, YCoordinate=0, ZCoordinate=0)
merge_3 = Merge(Data1=graft(merge), Data2=graft(merge_2))
merge_4 = Merge(Data1=addition, Data2=d2, Data3=mesh_2, Data4=mesh_2)
merge_5 = Merge(Data1=zoffset_5, Data2="500", Data3=drawing_table, Data4=mesh_2)
move = Move(Geometry=mesh_3, Motion=X)  # -> Geometry, Transform
merge_6 = Merge(Data1=addition_2, Data2="500", Data3=turntablebase, Data4=mjoin)
merge_7 = Merge(Data1=zoffset_2, Data2="500", Data3=turntablebase, Data4=turntable)
merge_8 = Merge(Data1=addition_2, Data2="500", Data3=turntablebase, Data4=mjoin_2)
addition_4 = Addition(A=addition_3, B=zoffset_3)
merge_9 = Merge(Data1=addition_3, Data2="500", Data3=turntablebase, Data4=mjoin_3)
item = ListItem(List=merge_3, Index=robot_cart_selection, Wrap=True)
bbox = BoundingBox(Content=move.Geometry, Plane=PlaneXY(0, 0, 0))  # -> Box, Box_2
merge_10 = Merge(Data1=addition_4, Data2="500", Data3=turntablebase, Data4=mjoin_4)
tabletop_2 = ListItem(List=flatten(item), Index=0, Wrap=True)
track = ListItem(List=flatten(item), Index=1, Wrap=True)
track_2 = ListItem(List=flatten(item), Index=2, Wrap=True)
debrep = DeconstructBrep(Brep=bbox.Box)  # -> Faces, Edges, Vertices
move_2 = Move(Geometry=tabletop_2, Motion=pt)  # -> Geometry, Transform
move_3 = Move(Geometry=[track, track_2], Motion=pt)  # -> Geometry, Transform
area = Area(Geometry=debrep.Faces)  # -> Area, Centroid
item_2 = ListItem(List=debrep.Faces, Index=Slider(4, range=0..10), Wrap=True)
pdecon = Deconstruct(Point=area.Centroid)  # -> XComponent, YComponent, ZComponent
area_2 = Area(Geometry=item_2)  # -> Area, Centroid
sort = SortList(Keys=pdecon.ZComponent, ValuesA=area.Centroid)  # -> Keys, ValuesA
item_3 = ListItem(List=sort.ValuesA, Index=0, Wrap=True)
xy = XYPlane(Origin=Point(0, 0, 0))
pdecon_2 = Deconstruct(Point=item_3)  # -> XComponent, YComponent, ZComponent
merge_11 = Merge(Data1="-7", Data2=flatten(pdecon_2.XComponent), Data3=flatten(move.Geometry))
merge_12 = Merge(
    Data1=graft(merge_4),
    Data2=graft(merge_5),
    Data3=graft(merge_7),
    Data4=graft(merge_6),
    Data5=graft(merge_8),
    Data6=graft(merge_9),
    Data7=graft(merge_10),
    Data8=graft(merge_11))
Y = UnitY(Factor=1)
move_4 = Move(Geometry=merge_12, Motion=Y)  # -> Geometry, Transform
item_4 = ListItem(List=merge_12, Index=fixture_selection, Wrap=True)
tabletop_3 = ListItem(List=flatten(item_4), Index=0, Wrap=False)
track_3 = ListItem(List=flatten(item_4), Index=1, Wrap=False)
track_4 = ListItem(List=flatten(item_4), Index=2, Wrap=False)
track_5 = ListItem(List=flatten(item_4), Index=3, Wrap=False)
construct_point = ConstructPoint(XCoordinate=track_3, YCoordinate=0, ZCoordinate=tabletop_3)
table_mesh = ClusterOutput(move_2.Geometry)
adaptorplate_2 = ClusterOutput(adaptorplate)
fixture_track_mesh = ClusterOutput(move_3.Geometry)
fixture_z = ClusterOutput(tabletop_3)
fixture_base_plane = ClusterOutput(construct_point)
fixture_x = ClusterOutput(track_3)
fixture_mesh = ClusterOutput(track_4)
fixture_kinematics_mesh = ClusterOutput(track_5)

# ==== cluster IKEAPENCIL
drawing_curve = ClusterInput()
tool_pressure = ClusterInput()
tool_retract = ClusterInput()
tool_name = Panel("ikea_pencil")
new_pen_holder = BooleanToggle(True)
pen_preview_colour = ColourSwatch(SwatchColor=RGB(120, 120, 120))

pen_length = Slider(85.6, range=1..250)
pen_dia = Slider(7.5, range=6..16)
pen_weight_kg = Panel(".1")

use_calibrated_tcp = BooleanToggle(False)
pt = ConstructPoint(XCoordinate="0.33", YCoordinate="5.33", ZCoordinate="180.22")

motion_type = ValueList({"Drawing": 0, "Painting": 1}, selected="Drawing")
paint_pot = ValueList({"1": 0, "2": 1}, selected="1")
dfl_dr2_tool = DFLDR2Tool(
    new_pen_holder=new_pen_holder,
    tool_length=pen_length,
    tool_dia=pen_dia,
    tool_weight=pen_weight_kg,
    tool_name=tool_name,
    use_calibrated=use_calibrated_tcp,
    preview_colour=pen_preview_colour,
    calibrated_tcp=pt,
    drawing_curve=drawing_curve,
    motion_type=motion_type,
    paint_pot_choice=paint_pot,
    tool_pressure=tool_pressure,
    tool_retract=tool_retract)  # -> tool, tcp, drawing_data
tool_centre_point = Panel(dfl_dr2_tool.tcp)
tcp = ClusterOutput(dfl_dr2_tool.tcp)
drawing_data = ClusterOutput(dfl_dr2_tool.drawing_data)

# ==== cluster DRPreview
D = ClusterInput()
G = ClusterInput()
G_2 = ClusterInput()
T = ClusterInput()
pt = Point(Point(0, 0, 0.5))
preview_colours = SplitTree(Data=D, Masks=flatten("{?;2}"))  # -> Positive, Negative
move = Move(Geometry=G_2, Motion=pt)  # -> Geometry, Transform
deconstructtarget = DeconstructTarget(Target=T)  # -> Joints, Plane
trim = TrimTree(Tree=preview_colours.Positive, Depth=1)
clean = CleanTree(RemoveNulls=True, RemoveInvalid=True, RemoveEmpty=True, Tree=deconstructtarget.Plane)
col = Colour(trim)
pline = PolyLine(Vertices=clean, Closed=False)
explode = Explode(Curve=pline, Recursive=True)  # -> Segments, Vertices
move_2 = Move(Geometry=explode.Segments, Motion=pt)  # -> Geometry, Transform
filter = StreamFilter(Gate=G, Stream0=move.Geometry, Stream1=move_2.Geometry)
col_2 = ClusterOutput(col)
s_0 = ClusterOutput(filter)

# ==== cluster DFLDR2Tool_2
new_pen_holder = ClusterInput()
tool_length = ClusterInput()
tool_dia = ClusterInput()
tool_weight = ClusterInput()
use_calibrated = ClusterInput()
tool_name = ClusterInput()
preview_colour = ClusterInput()
calibrated_tcp = ClusterInput()
drawing_curve = ClusterInput()
motion_type = ClusterInput()
paint_pots = ClusterInput()
paint_pot_choice = ClusterInput()
tool_pressure = ClusterInput()
tool_retract = ClusterInput()
new_pen_holder_2 = Number(new_pen_holder)
penholder1 = Cluster_3(B=tool_weight, A=tool_length, A_2=tool_dia)  # -> R, i, flatten(R_2)
penholder2 = PenHolder2_2(B=tool_weight, A=tool_length, A_2=tool_dia)  # -> R, G, simplify(mesh_4)
cluster = Cluster_3(B=tool_weight, A=tool_length, A_2=tool_dia)  # -> R, i, R_2
pt = Point(calibrated_tcp)
item = ListItem(List=paint_pots, Index=paint_pot_choice, Wrap=True)
filter = StreamFilter(Gate=new_pen_holder_2, Stream0=penholder1.R, Stream1=penholder2.R)
filter_2 = StreamFilter(Gate=new_pen_holder_2, Stream0=penholder1.R_2, Stream1=penholder2.mesh_4)
filter_3 = StreamFilter(Gate=new_pen_holder_2, Stream0=penholder1.i, Stream1=penholder2.G)
num = Number(filter)
mesh = Mesh(filter_2)
pln = Plane(flatten(filter_3))
pl_origin = PlaneOrigin(Base=pln, Origin=pt)
merge = Merge(Data1=pt, Data2=pln)
filter_4 = StreamFilter(Gate=use_calibrated, Stream0=pln, Stream1=pl_origin)
item_2 = ListItem(List=merge, Index=0, Wrap=True)
create_tool = CreateTool(Name=flatten(tool_name), TCP=flatten(filter_4), Weight=flatten(num), Mesh=flatten(mesh))  # -> Tool, TCP
entwine = Entwine(
    Branch00=tool_name,
    Branch01=create_tool.Tool,
    Branch02=preview_colour,
    Branch03=drawing_curve,
    Branch04=motion_type,
    Branch05=tool_pressure,
    Branch06=tool_retract,
    Branch07=item,
    FlattenInputs=True)  # -> simplify(Result)
tool = ClusterOutput(create_tool.Tool)
tcp = ClusterOutput(create_tool.TCP)
drawing_data = ClusterOutput(entwine)

# ==== cluster DFLSTABILO
drawing_curve = ClusterInput()
preview_colour = ClusterInput()
tool_pressure = ClusterInput()
tool_name = Panel("Stabilo")
new_pen_holder = BooleanToggle(True)
pen_length = Slider(107, range=1..250)
pen_dia = Slider(7.5, range=6..16)
pen_weight_kg = Panel(".1")

use_calibrated_tcp = BooleanToggle(False)
pt = ConstructPoint(XCoordinate="0", YCoordinate="0", ZCoordinate="0")

motion_type = ValueList({"Drawing": 0, "Painting": 1}, selected="Drawing")
paint_pot = ValueList({"1": 0, "2": 1}, selected="1")
retract = Slider(8, range=0..8)
dfl_dr2_tool = DFLDR2Tool_2(
    new_pen_holder=new_pen_holder,
    tool_length=pen_length,
    tool_dia=pen_dia,
    tool_weight=pen_weight_kg,
    use_calibrated=use_calibrated_tcp,
    tool_name=tool_name,
    preview_colour=preview_colour,
    calibrated_tcp=pt,
    drawing_curve=drawing_curve,
    motion_type=motion_type,
    paint_pot_choice=paint_pot,
    tool_pressure=tool_pressure,
    tool_retract=retract)  # -> tool, tcp, drawing_data
panel = Panel(dfl_dr2_tool.tcp)
drawing_data = ClusterOutput(dfl_dr2_tool.drawing_data)

# ==== cluster DFLPAINTBRUSH
preview_colour = ClusterInput()
drawing_curve = ClusterInput()
paint_pots = ClusterInput()
paint_pot_choice = ClusterInput()
tool_pressure = ClusterInput()
tool_retract = ClusterInput()
tool_name = Panel("DFL_PaintBrush")
new_pen_holder = BooleanToggle(True)
brush_length = Slider(121, range=1..250)
brush_dia = Slider(6, range=6..16)
pen_weight_kg = Panel(".1")
pt = ConstructPoint(XCoordinate="0", YCoordinate="0", ZCoordinate="0")
use_calibrated_tcp = BooleanToggle(False)
motion_type = ValueList({"Drawing": 0, "Painting": 1}, selected="Painting")
dfl_dr2_tool = DFLDR2Tool_2(
    new_pen_holder=new_pen_holder,
    tool_length=brush_length,
    tool_dia=brush_dia,
    tool_weight=pen_weight_kg,
    use_calibrated=use_calibrated_tcp,
    tool_name=tool_name,
    preview_colour=preview_colour,
    calibrated_tcp=pt,
    drawing_curve=drawing_curve,
    motion_type=motion_type,
    paint_pots=paint_pots,
    paint_pot_choice=paint_pot_choice,
    tool_pressure=tool_pressure,
    tool_retract=tool_retract)  # -> tool, tcp, drawing_data
panel = Panel(dfl_dr2_tool.tcp)
drawing_data = ClusterOutput(dfl_dr2_tool.drawing_data)

# ==== cluster RBBoundingHatch
base_plane = ClusterInput()
hatch_angle = ClusterInput()
rotate = Rotate(Geometry=base_plane, Angle=degrees(hatch_angle), Plane=PlaneXY(0, 0, 0))  # -> Geometry, Transform
E = ClusterInput()
shift = ClusterInput()
rotated_plane = ClusterOutput(rotate.Geometry)
boundary = BoundarySurfaces(Edges=E)
brec = BoundingRectangle(Geometry=boundary, Plane=rotate.Geometry, Axis=0, Slide=0, Union=True)  # -> Bounding, DimensionX, DimensionY
offset = OffsetCurve(Curve=brec.Bounding, Distance=shift, Plane=base_plane, Corners=1)
explode = Explode(Curve=offset, Recursive=True)  # -> Segments, Vertices
hatch_gap = ClusterInput()
item = ListItem(List=explode.Segments, Index=0, Wrap=True)  # -> Item, Item1, Item2
crv = Curve(item.Item)
Z = UnitZ(Factor=hatch_gap)
divdist = DivideDistance(Curve=item.Item1, Distance=hatch_gap)  # -> Points, Tangents, Parameters
item_2 = ListItem(List=divdist.Points, Index=0, Wrap=True)
extr = Extrude(Base=boundary, Direction=Z)
move = Move(Geometry=extr, Motion=expr("-x/2", Z))  # -> Geometry, Transform
move2pt = MoveToPoint(Geometry=crv, PointA=item_2, PointB=divdist.Points)  # -> Moved, Vector, Transform
hatches = ClusterOutput(move2pt.Moved)
region_breps = ClusterOutput(move.Geometry)

# ==== cluster DFLPaperSetup
length = ClusterInput()
height = ClusterInput()
X = ClusterInput()
Z = ClusterInput()
multiplication = Multiplication(A=length, B=-0.5)
multiplication_2 = Multiplication(A=length, B=0.5)
multiplication_3 = Multiplication(A=height, B=-0.5)
multiplication_4 = Multiplication(A=height, B=0.5)
subtraction = Subtraction(A=Z, B=15)
dom = ConstructDomain(DomainStart=multiplication, DomainEnd=multiplication_2)
dom_2 = ConstructDomain(DomainStart=multiplication_3, DomainEnd=multiplication_4)
pt = ConstructPoint(XCoordinate=X, YCoordinate=0, ZCoordinate=subtraction)
xy = XYPlane(Origin=pt)
height_dom = ClusterOutput(dom)
width_dom = ClusterOutput(dom_2)
P = ClusterOutput(xy)

# ==== cluster DFLCrvToPln: Turns Curves to Polylines, then divides Curved Sections Based on a tolerance input, Positions a plane at each point
P = ClusterInput()
C = ClusterInput()
td = ClusterInput()
topoly = CurveToPolyline(Curve=C, ToleranceDistance=td, ToleranceAngle=0)  # -> Polyline, Segments
cp = ControlPoints(Curve=topoly.Polyline)  # -> Points, Weights, Knots
pl_origin = PlaneOrigin(Base=P, Origin=cp.Points)
pl = ClusterOutput(pl_origin)

# ==== cluster DFLReOrientPlanes
planes = ClusterInput()
rotation_axis = ClusterInput()  # X=0 Y=1 Z=2
fine_adjustment = ClusterInput()
quad_rotate = ClusterInput()

deplane = DeconstructPlane(Plane=planes)  # -> Origin, XAxis, YAxis, ZAxis
filter = StreamFilter(Gate=rotation_axis, Stream0=deplane.XAxis, Stream1=deplane.YAxis, Stream2=deplane.ZAxis)
amp = Amplitude(Vector=filter, Amplitude="1")
move = Move(Geometry=deplane.Origin, Motion=amp)  # -> Geometry, Transform
ln = Line(StartPoint=deplane.Origin, EndPoint=move.Geometry)
addition = Addition(A=fine_adjustment, B=quad_rotate)
rotax = RotateAxis(Geometry=planes, Angle=degrees(addition), Axis=ln)  # -> Geometry, Transform

rotated_planes = ClusterOutput(rotax.Geometry)

# ==== cluster DFLToolTest
# Robotic Commands
robot = ClusterInput()
tool_name = ClusterInput()
tool = ClusterInput()
correctly_oriented_plane_s = ClusterInput()
test_location_plane = ClusterInput()
program_name = ClusterInput()
robot_system = ClusterInput()
panel = Panel("Please ensurethat DFL staff have set up the Robot, and that you have reviewed the simulation in Grasshopper or on the SmartPad")
popup_title_no_spaces = Panel("Insert_Spacer")
popup_title_no_spaces_2 = Panel("press continue to lower to 20mm slowly")
popup_title_no_spaces_3 = Panel("Adjust_pen")
popup_title_no_spaces_4 = Panel("Adjust pen height so pen tip lightly rests on spacer")
data = Data(robot)

# ---- group: Initial Pose
popup_title_no_spaces_5 = Panel("Operator_Safety_Pen_test")
dfl_ur_custom_popup = DFLURCustomPopup(N=popup_title_no_spaces_5, popup_text=panel)
create_target = CreateTarget(IsCartesian=False)

# ----
concat = Concatenate(FragmentA="Insert ", FragmentB=tool_name, FragmentC=" and Click continue to resume")
data_2 = Data(tool)
dfl_ur_custom_popup_2 = DFLURCustomPopup(N=popup_title_no_spaces, popup_text=popup_title_no_spaces_2)
Z = UnitZ(Factor="20")
pln = Plane(correctly_oriented_plane_s)
pln_2 = Plane(test_location_plane)
Z_2 = UnitZ(Factor="41")
Z_3 = UnitZ(Factor="0")
dfl_ur_custom_popup_3 = DFLURCustomPopup(N=popup_title_no_spaces_3, popup_text=popup_title_no_spaces_4)
concat_2 = Concatenate(FragmentA=program_name, FragmentB="_pentest")
initial_pose_axis_values_in_degrees = Panel("""0
-90
0
-90
0
0""")
item = ListItem(List=flatten(data_2), Index=0, Wrap=True)
pen_change_pose_av_degrees = Panel("""9
-50
-126
-37
83
0""")
item_2 = ListItem(List=flatten(data_2), Index=-1, Wrap=True)
move = Move(Geometry=pln_2, Motion=Z)  # -> Geometry, Transform
item_3 = ListItem(List=flatten(pln), Index=0, Wrap=True)
move_2 = Move(Geometry=pln_2, Motion=Z_2)  # -> Geometry, Transform
move_3 = Move(Geometry=pln_2, Motion=Z_3)  # -> Geometry, Transform
degrees_to_radians = DegreesToRadians(Degrees=initial_pose_axis_values_in_degrees, RobotSystem=data, MechanicalGroup=0)
degrees_to_radians_2 = DegreesToRadians(Degrees=pen_change_pose_av_degrees, RobotSystem=data, MechanicalGroup=0)
pln_3 = Plane(item_3)
pln_4 = Plane(item_3)
pln_5 = Plane(item_3)
pl_origin = PlaneOrigin(Base=pln_3, Origin=move.Geometry)
pl_origin_2 = PlaneOrigin(Base=pln_4, Origin=move_2.Geometry)
pl_origin_3 = PlaneOrigin(Base=pln_5, Origin=move_3.Geometry)

# ---- group: Linear Movements
controlled_speed = Panel("100")
list = ValueList({"Joint", "Linear"}, selected="Linear")
createtarget = CreateTarget(Plane=pl_origin, Motion=list, Tool=data_2, Speed=controlled_speed, Zone="0.1", IsCartesian=True)

controlled_speed_2 = Panel("2")
list_2 = ValueList({"Joint", "Linear"}, selected="Linear")
createtarget_2 = CreateTarget(
    Plane=pl_origin_3,
    Motion=list_2,
    Tool=data_2,
    Speed=controlled_speed_2,
    Zone="0.1",
    Command=dfl_ur_custom_popup_3,
    IsCartesian=True)

# ----
createtarget_3 = CreateTarget(Joints=degrees_to_radians, Tool=item, Speed=controlled_speed, Zone="0.1", Command=dfl_ur_custom_popup, IsCartesian=False)

# ---- group: Pen Change
pen_change_pose_av_degrees_2 = Panel("""24.38
-106.28
-87.02
-168.27
24.22
46.25""")
popup_title_no_spaces_6 = Panel("Insert_pen")
popup_text = Panel(concat)
degrees_to_radians_3 = DegreesToRadians(Degrees=pen_change_pose_av_degrees_2, RobotSystem=data, MechanicalGroup=0)
dfl_ur_custom_popup_4 = DFLURCustomPopup(N=popup_title_no_spaces_6, popup_text=popup_text)
createtarget_4 = CreateTarget(
    Joints=degrees_to_radians_2,
    Tool=data_2,
    Speed=controlled_speed,
    Zone="0.1",
    Command=dfl_ur_custom_popup_4,
    IsCartesian=False)

# ----
popup_title_no_spaces_7 = Panel("Job_Done")
popup_text_2 = Panel("Job Complete! Please put all the caps back on the pens and tidy up!")
dfl_ur_custom_popup_5 = DFLURCustomPopup(N=popup_title_no_spaces_7, popup_text=popup_text_2)
createtarget_5 = CreateTarget(
    Joints=degrees_to_radians_2,
    Tool=item_2,
    Speed=controlled_speed,
    Zone="0.1",
    Command=[dfl_ur_custom_popup, dfl_ur_custom_popup_5],
    IsCartesian=False)

# ---- group: Linear Movements
list_3 = ValueList({"Joint", "Linear"}, selected="Linear")
createtarget_6 = CreateTarget(Plane=pl_origin_2, Motion=list_3, Tool=data_2, Speed=controlled_speed, Zone="0.1", IsCartesian=True)

# ---- group: Order Program
weave = Weave(
    Pattern=[0, 1, 2, 3],
    Stream0=createtarget_4,
    Stream1=createtarget,
    Stream2=createtarget_2,
    Stream3=createtarget_6,
    NullGaps=False)
merge = Merge(Data1=flatten(weave), Data2=createtarget_5)  # -> flatten(Result)

# ----
panel_2 = Panel(merge)
create_program = CreateProgram(Name=concat_2, RobotSystem=robot_system, Targets=merge, StepSize=1)  # -> Program, Code, Duration, Warnings, Errors
program = ClusterOutput(create_program.Program)

# ==== cluster DFLWeaver
drawing_motions = ClusterInput()
more_than_1 = ClusterInput()
tool_change_motions = ClusterInput()
painting_motions = ClusterInput()
motion_choice = ClusterInput()
drawing_motions_2 = TrimTree(Tree=drawing_motions, Depth=1)
paint_motions = TrimTree(Tree=painting_motions, Depth=1)
filter = StreamFilter(Gate=more_than_1, Stream0=drawing_motions, Stream1=drawing_motions_2)
filter_2 = StreamFilter(Gate=more_than_1, Stream0=painting_motions, Stream1=paint_motions)
gtp5_py3_sel_branch = Python3Script(A=filter, B=filter_2, M=motion_choice)  # -> D, R; inputs A: tree, B: tree, M: tree
# ---------- gtp5_py3_sel_branch: Python ----------
# Drop-in: choose Drawing vs Painting per branch using a mask tree.
# Works with masks at {tool} or deeper (e.g. {tool;stroke}); mask prefixes apply to subpaths.
# Keeps original GH_Goo types (no unwrapping).

from Grasshopper import DataTree
from Grasshopper.Kernel.Data import GH_Path
from Grasshopper.Kernel.Types import GH_Boolean, GH_Number, GH_Integer, GH_String

def to_paths(T):
    try: return list(T.Paths)
    except: return []

def unwrap_bool(v):
    # Accept GH_* wrappers and plain types/strings
    if isinstance(v, GH_Boolean): return bool(v.Value)
    if isinstance(v, (GH_Number, GH_Integer)): return v.Value != 0
    if isinstance(v, GH_String):
        s = v.Value.strip().lower()
        if s in ("true","t","yes","y","on","1"): return True
        if s in ("false","f","no","n","off","0"): return False
        try: return float(s) != 0.0
        except: return False
    if isinstance(v, bool): return v
    if isinstance(v, (int, float)): return v != 0
    if isinstance(v, str):
        s = v.strip().lower()
        if s in ("true","t","yes","y","on","1"): return True
        if s in ("false","f","no","n","off","0"): return False
        try: return float(s) != 0.0
        except: return False
    return False

def starts_with(full_path, prefix_path):
    # Allow mask {0} to match {0;*}; longest prefix (deepest) will win.
    fi = list(full_path.Indices)
    pi = list(prefix_path.Indices)
    if len(pi) > len(fi): return False
    for i in range(len(pi)):
        if fi[i] != pi[i]: return False
    return True

def build_mask_pairs(M):
    # Collect (mask_path, bool), sort deepest first so longest prefix wins
    pairs = []
    for mp in to_paths(M):
        br = M.Branch(mp)
        if br and br[0] is not None:
            pairs.append((mp, unwrap_bool(br[0])))
    pairs.sort(key=lambda t: len(t[0].Indices), reverse=True)
    return pairs

def choose_source_for_path(p, mask_pairs, A, B):
    # Default to DRAW(A); apply first (deepest) matching mask prefix
    paint = False
    for mp, val in mask_pairs:
        if starts_with(p, mp):
            paint = val
            break
    return (B if paint else A), ("PAINT(B)" if paint else "DRAW(A)")

def pick_whole_branches_keep_types(A, B, M):
    D = []
    R = DataTree[object]()
    mask_pairs = build_mask_pairs(M)

    # If mask empty, default to DRAW(A) for everything
    if not mask_pairs:
        for p in to_paths(A):
            for it in A.Branch(p): R.Add(it, p)
        D.append("Mask empty → using DRAW(A) for all branches")
        return R, D

    D.append("Mask pairs (deepest-first): %s" % ["%s=%s"%(mp, v) for mp,v in mask_pairs])

    # Union of paths from A and B so we preserve any branches present in either
    union_paths = []
    for p in to_paths(A):
        if p not in union_paths: union_paths.append(p)
    for p in to_paths(B):
        if p not in union_paths: union_paths.append(p)

    D.append("Paths: A=%d, B=%d, union=%d" % (len(to_paths(A)), len(to_paths(B)), len(union_paths)))

    for p in union_paths:
        src, label = choose_source_for_path(p, mask_pairs, A, B)
        if src.PathExists(p):
            br = src.Branch(p)
            D.append("%s -> %s  items=%d" % (p, label, len(br)))
            for it in br:
                R.Add(it, p)  # keep original GH_Goo/Target types
        else:
            # Chosen source lacks this branch; skip but log it
            D.append("%s -> %s  (chosen source has no branch)" % (p, label))

    return R, D

R, D = pick_whole_branches_keep_types(A, B, M)
# ---------- end gtp5_py3_sel_branch ----------
filter_3 = StreamFilter(Gate=motion_choice, Stream0=filter, Stream1=filter_2)
filter_4 = StreamFilter(Gate=more_than_1, Stream0=filter_3, Stream1=gtp5_py3_sel_branch.R)
merge = Merge(Data1=tool_change_motions, Data2=filter_4)
weave = Weave(Pattern=[0, 1], Stream0=tool_change_motions, Stream1=filter_4, NullGaps=False)
filter_5 = StreamFilter(Gate=more_than_1, Stream0=merge, Stream1=weave)
s_0 = ClusterOutput(filter_5)

# ==== cluster MoreThan1
T = ClusterInput()
trim = TrimTree(Tree=T, Depth=1)
tstat = TreeStatistics(Tree=trim)  # -> Paths, Length, Count
lng = ListLength(List=tstat.Paths)
larger = LargerThan(FirstNumber=lng, SecondNumber="1")  # -> LargerThan, OrEqualTo
bool = Boolean(larger.LargerThan)
bool_2 = ClusterOutput(bool)

# ==== cluster DFLDR2Tool
new_pen_holder = ClusterInput()
tool_length = ClusterInput()
tool_dia = ClusterInput()
tool_weight = ClusterInput()
tool_name = ClusterInput()
use_calibrated = ClusterInput()
preview_colour = ClusterInput()
calibrated_tcp = ClusterInput()
drawing_curve = ClusterInput()
motion_type = ClusterInput()
paint_pots = ClusterInput()
paint_pot_choice = ClusterInput()
tool_pressure = ClusterInput()
tool_retract = ClusterInput()
new_pen_holder_2 = Number(new_pen_holder)
penholder1 = Cluster_3(B=tool_weight, A=tool_length, A_2=tool_dia)  # -> R, i, flatten(R_2)
penholder2 = PenHolder2(A=tool_length, A_2=tool_dia, B=tool_weight)  # -> R, G, simplify(mesh_4)
cluster = Cluster_3(B=tool_weight, A=tool_length, A_2=tool_dia)  # -> R, i, R_2
pt = Point(calibrated_tcp)
item = ListItem(List=paint_pots, Index=paint_pot_choice, Wrap=True)
filter = StreamFilter(Gate=new_pen_holder_2, Stream0=penholder1.R, Stream1=penholder2.R)
filter_2 = StreamFilter(Gate=new_pen_holder_2, Stream0=penholder1.i, Stream1=penholder2.G)
filter_3 = StreamFilter(Gate=new_pen_holder_2, Stream0=penholder1.R_2, Stream1=penholder2.mesh_4)
num = Number(filter)
mesh = Mesh(filter_3)
pln = Plane(flatten(filter_2))
pl_origin = PlaneOrigin(Base=pln, Origin=pt)
merge = Merge(Data1=pt, Data2=pln)
filter_4 = StreamFilter(Gate=use_calibrated, Stream0=pln, Stream1=pl_origin)
item_2 = ListItem(List=merge, Index=0, Wrap=True)
create_tool = CreateTool(Name=flatten(tool_name), TCP=flatten(filter_4), Weight=flatten(num), Mesh=flatten(mesh))  # -> Tool, TCP
entwine = Entwine(
    Branch00=tool_name,
    Branch01=create_tool.Tool,
    Branch02=preview_colour,
    Branch03=drawing_curve,
    Branch04=motion_type,
    Branch05=tool_pressure,
    Branch06=tool_retract,
    Branch07=item,
    FlattenInputs=True)  # -> simplify(Result)
tool = ClusterOutput(create_tool.Tool)
tcp = ClusterOutput(create_tool.TCP)
drawing_data = ClusterOutput(entwine)

# ==== cluster PenHolder2_2
B = ClusterInput()
A = ClusterInput()
A_2 = ClusterInput()
holder_weight = Panel(".133")
pen_v_block_offset_mm = Panel("50")
pen_length_offset = Panel("-2")
addition = Addition(A=holder_weight, B=B)
addition_2 = Addition(A=pen_v_block_offset_mm, B=pen_length_offset)
division = Division(A=A_2, B=2)
addition_3 = Addition(A=A, B=addition_2)
subtraction = Subtraction(A="10.1", B=division)
subtraction_2 = Subtraction(A=division, B=1)
merge = Merge(Data1=division, Data2=division)
pt = ConstructPoint(XCoordinate=subtraction, YCoordinate=0, ZCoordinate=0)
lng = ListLength(List=merge)
multiplication = Multiplication(A=subtraction, B="0.9")
pt_2 = ConstructPoint(XCoordinate=pt, YCoordinate=0, ZCoordinate=pen_v_block_offset_mm)
pt_3 = ConstructPoint(XCoordinate=pt, YCoordinate=0, ZCoordinate=addition_3)
range = Range(Domain="0 to 1", Steps=expr("x-1", lng))
ln = Line(StartPoint=pt_2, EndPoint=pt_3)
pen_visualization_hack = GraphMapper(
    range,
    x0=0,
    x1=1,
    y0=0,
    y1=1,
    container_name="Bezier",
    cpx=[0, 0.1894655079, 0.002457328374, 1],
    cpy=[0, 0.6900714636, 1, 1])
pframes = PerpFrames(Curve=ln, Count="1", Align=True)  # -> Frames, Parameters
vpipe = PipeVariable(Curve=ln, Parameters=pen_visualization_hack, Radii=merge, Caps=0, FitRail=False)
item = ListItem(List=pframes.Frames, Index=1, Wrap=True)
cap = CapHoles(Brep=vpipe)
rot3d = Rotate3D(Geometry=item, Angle=degrees("180"), Center=pt_2, Axis=Vector(0, 0, 1))  # -> Geometry, Transform
filedge = FilletEdge(Shape=cap, Blend=1, Metric=0, Edges=2, Radii=subtraction_2)
mesh = MeshBrep(
    Brep=filedge,
    Settings={GridMaxCount=0, GridMinCount=16, JaggedSeams=False, MaxEdgeLength=0, MinEdgeLength=0.0001, MinTolerance=0, Refine=True, RefineAngle=0, RelativeTolerance=0.65, SimplePlanes=True, Tolerance=0})  # -> flatten(Mesh)
mesh_2 = Mesh(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)
munion = MeshUnion(Meshes=[mesh_2, mesh])
mesh_3 = Mesh(munion)
R = ClusterOutput(addition)
G = ClusterOutput(rot3d.Geometry)
mesh_4 = ClusterOutput(mesh_3)

# ==== cluster DFLURCustomPopup
N = ClusterInput()
popup_text = ClusterInput()
concat = Concatenate(
    FragmentA="popup (\"",
    FragmentB=popup_text,
    FragmentC="\", title=\"",
    FragmentD=N,
    FragmentE="\", warning=False, error=False, blocking=True)")
customcmd = CustomCommand(Name=N, Manufacturer="UR", Code=concat)
command = ClusterOutput(customcmd)

# ==== cluster Cluster_3
B = ClusterInput()
A = ClusterInput()
holder_weight = Panel(".133")
pen_length_offset = Panel("-1")
A_2 = ClusterInput()
addition = Addition(A=holder_weight, B=B)
pen_v_block_offset_mm = Panel("16")
subtraction = Subtraction(A=A, B=pen_length_offset)
pt = ConstructPoint(XCoordinate="1", YCoordinate=0, ZCoordinate=0)
pt_2 = Point(Point(0, 0, 0))
pt_3 = ConstructPoint(XCoordinate=0, YCoordinate=0, ZCoordinate="1")
pt_4 = ConstructPoint(XCoordinate=0, YCoordinate=0, ZCoordinate="1")
division = Division(A=Slider(10, range=0..10), B=2)
pt_5 = ConstructPoint(XCoordinate=0, YCoordinate=subtraction, ZCoordinate=pen_v_block_offset_mm)
ln = Line(StartPoint=pt_2, EndPoint=pt)
ln_2 = Line(StartPoint=pt_2, EndPoint=pt_3)
ln_3 = Line(StartPoint=pt_2, EndPoint=pt_4)
pt_6 = ConstructPoint(XCoordinate=division, YCoordinate=division, ZCoordinate=0)
merge = Merge(Data1=division, Data2=division)
xy = XYPlane(Origin=pt_6)
lng = ListLength(List=merge)
cir = Circle(Plane=xy, Radius=division)
range = Range(Domain="0 to 1", Steps=expr("x-1", lng))
rotax = RotateAxis(Geometry=cir, Angle=degrees("45"), Axis=ln_2)  # -> Geometry, Transform
pen_visualization_hack = GraphMapper(range, x0=0, x1=1, y0=0, y1=1, container_name="Bezier", cpx=[0, 0.1894655079, 0, 1], cpy=[0, 0.6900714636, 1, 1])
rotax_2 = RotateAxis(Geometry=rotax.Geometry, Angle=degrees("90"), Axis=ln)  # -> Geometry, Transform
move = Move(Geometry=rotax_2.Geometry, Motion=pt_5)  # -> Geometry, Transform
rotax_3 = RotateAxis(Geometry=move.Geometry, Angle=degrees("-45"), Axis=ln_3)  # -> Geometry, Transform
area = Area(Geometry=rotax_3.Geometry)  # -> Area, Centroid
pdecon = Deconstruct(Point=area.Centroid)  # -> XComponent, YComponent, ZComponent
pt_7 = ConstructPoint(XCoordinate=0, YCoordinate=0, ZCoordinate=pdecon.ZComponent)
ln_4 = Line(StartPoint=pt_7, EndPoint=area.Centroid)
pframes = PerpFrames(Curve=ln_4, Count="1", Align=True)  # -> Frames, Parameters
vpipe = PipeVariable(Curve=ln_4, Parameters=pen_visualization_hack, Radii=merge, Caps=2)
item = ListItem(List=pframes.Frames, Index=1, Wrap=True)
mesh = Mesh(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)
mesh_2 = MeshBrep(
    Brep=vpipe,
    Settings={GridMaxCount=0, GridMinCount=16, JaggedSeams=False, MaxEdgeLength=0, MinEdgeLength=0.0001, MinTolerance=0, Refine=True, RefineAngle=0, RelativeTolerance=0.65, SimplePlanes=True, Tolerance=0})
munion = MeshUnion(Meshes=flatten([mesh, mesh_2]))
R = ClusterOutput(addition)
i = ClusterOutput(item)
R_2 = ClusterOutput(munion)

# ==== cluster PenHolder2
A = ClusterInput()
A_2 = ClusterInput()
B = ClusterInput()
holder_weight = Panel(".133")
pen_v_block_offset_mm = Panel("50")
pen_length_offset = Panel("-2")
addition = Addition(A=holder_weight, B=B)
addition_2 = Addition(A=pen_v_block_offset_mm, B=pen_length_offset)
division = Division(A=A_2, B=2)
addition_3 = Addition(A=A, B=addition_2)
subtraction = Subtraction(A="10.1", B=division)
merge = Merge(Data1=division, Data2=division)
subtraction_2 = Subtraction(A=division, B=1)
pt = ConstructPoint(XCoordinate=subtraction, YCoordinate=0, ZCoordinate=0)
multiplication = Multiplication(A=subtraction, B="0.9")
lng = ListLength(List=merge)
pt_2 = ConstructPoint(XCoordinate=pt, YCoordinate=0, ZCoordinate=pen_v_block_offset_mm)
pt_3 = ConstructPoint(XCoordinate=pt, YCoordinate=0, ZCoordinate=addition_3)
range = Range(Domain="0 to 1", Steps=expr("x-1", lng))
ln = Line(StartPoint=pt_2, EndPoint=pt_3)
pen_visualization_hack = GraphMapper(
    range,
    x0=0,
    x1=1,
    y0=0,
    y1=1,
    container_name="Bezier",
    cpx=[0, 0.1894655079, 0.002457328374, 1],
    cpy=[0, 0.6900714636, 1, 1])
pframes = PerpFrames(Curve=ln, Count="1", Align=True)  # -> Frames, Parameters
vpipe = PipeVariable(Curve=ln, Parameters=pen_visualization_hack, Radii=merge, Caps=0, FitRail=False)
item = ListItem(List=pframes.Frames, Index=1, Wrap=True)
cap = CapHoles(Brep=vpipe)
rot3d = Rotate3D(Geometry=item, Angle=degrees("180"), Center=pt_2, Axis=Vector(0, 0, 1))  # -> Geometry, Transform
filedge = FilletEdge(Shape=cap, Blend=1, Metric=0, Edges=2, Radii=subtraction_2)
mesh = MeshBrep(
    Brep=filedge,
    Settings={GridMaxCount=0, GridMinCount=16, JaggedSeams=False, MaxEdgeLength=0, MinEdgeLength=0.0001, MinTolerance=0, Refine=True, RefineAngle=0, RelativeTolerance=0.65, SimplePlanes=True, Tolerance=0})  # -> flatten(Mesh)
mesh_2 = Mesh(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)
munion = MeshUnion(Meshes=[mesh_2, mesh])
mesh_3 = Mesh(munion)
R = ClusterOutput(addition)
G = ClusterOutput(rot3d.Geometry)
mesh_4 = ClusterOutput(mesh_3)
