# Grasshopper definition DFLUR5_DR2_T32024.gh (Grasshopper 1.0.8)
# plug-ins: Robots, Pufferfish, Human

# ---- group: Section / Functional Group
# info: Written by Richard Blackwell and Charlotte firth for the Design Futures Lab and BENV10020202
# Requires
# Attention!
# Customise
# Instructions for UR operator: Please ensure you Pen and paper is Correctly loaded, that DFL staff have set up the Robot, and that you have reviewed the simulation in Grasshopper or on the SmartPad
steps = Panel("""STEPS
STEP""")

# ---- group: DFL PENCIL
pencil_length = Slider(170, range=1..250)
pencil_dia = Slider(7.5, range=6..16)
pressure = Slider(1, range=0..8)
hatch_angle = Slider(-60, range=-90..90)
line_gap = Slider(0.3, range=0..10)
dfl_pencil = DFLPencil(length=pencil_length, dia=pencil_dia, speed_2=hatch_angle, hatch_freqency=line_gap, tip_dia=pressure)

# ---- group: DFL sharpie
hatch_angle_2 = Slider(0, range=-90..90)
line_gap_2 = Slider(1, range=0..10)
name_of_pen = Panel("DFL_Sharpie_Basic")
preview_colour = ColourSwatch(SwatchColor=RGB(255, 0, 255))
dfl_sharpie = DFLSharpie(name=name_of_pen, prev=preview_colour, speed_2=hatch_angle_2, hatch_freqency=line_gap_2)

# ---- group: Setup Fixture
fixture_in_use = ValueList({"Custom Fixture": 0, "Draw Table": 1, "Turn Table": 2}, selected="Draw Table")
robot_placement = ValueList({"Cart": 0, "Table": 1}, selected="Cart")
adaptor_distance_from_table_edge = Slider(162, range=0..600)

custom_z_offset = Slider(0, range=0..50)
custom_x_offset = Slider(500, range=0..800)

# ---- group: Fully Custom Tool
tip_dia_mm = Panel("0.3")
pen_length = Slider(107, range=1..250)
pen_dia = Slider(7.5, range=6..16)
speed = Slider(100, range=1..100)
name_of_pen_2 = Panel("Custom_Stabillo_magenta")
nib_height = Panel("1")
preview_colour_2 = ColourSwatch(SwatchColor=RGB(0, 255, 254))
pen_weight_kg = Panel(".01")

pen_pressure = Slider(0.5, range=0..8)
line_gap_3 = Slider(0.3, range=0..10)
retract_height = Slider(4, range=0..8)
hatch_angle_3 = Slider(-60, range=-90..90)

# ---- group: Dfl Stabilo Mini
hatch_angle_4 = Slider(0, range=-90..90)
line_gap_4 = Slider(0.3, range=0..10)
name_of_pen_3 = Panel("DFL_Stabillo_Mini")
preview_colour_3 = ColourSwatch(SwatchColor=RGB(255, 255, 0))
dfl_stabilo_mini = DFLStabiloMini(name=name_of_pen_3, prev=preview_colour_3, speed_2=hatch_angle_4, hatch_freqency=line_gap_4)

# ----
# DFL Draw a 4 Colour Drawing from Adobe Illustrator
# Grasshopper Instrucitons: Import your Drawing
# File as a .ai File
# Select Boundry Curves upon import
# Position Art Where you can see it in the XY plane
# Confiugure tools
# Choose Toolpath type (curve, fill)_
# Click Data Dam to Generate Toolpath
# View/Test Simulation
# Adjust 'Pen Tilt' to avoid Singularities
# Set File Path for USB Drive
# Name Project
# Click Save Button
# Eject Drive Safely and Load onto Robot
# Click File Load Program
# Select Most Current .URP file on USB drive
instructions_for_ur_operator = Panel("Please ensure you Pen and paper is Correctly loaded, that DFL staff have set up the Robot, and that you have reviewed the simulation in Grasshopper or on the SmartPad")

# ---- group: Dfl Stabilo Mini
hatch_angle_5 = Slider(0, range=-90..90)
line_gap_5 = Slider(0.3, range=0..10)
name_of_pen_4 = Panel("DFL_Stabillo_Mini")
preview_colour_4 = ColourSwatch(SwatchColor=RGB(255, 0, 255))
dfl_stabilo_mini_2 = DFLStabiloMini(name=name_of_pen_4, prev=preview_colour_4, speed_2=hatch_angle_5, hatch_freqency=line_gap_5)

# ---- group: DFL Sharpie basic
dfl_sharpie_basic = DFLSharpieBasic()

# ---- group: Robot Setup + initial pose
transfer_speed = Slider(100, range=1..100)
zone_accuracy = Slider(0.01, range=0..1)

# ---- group: Setup Fixture
dfl_ur_fixutres = DFLURFixutres(A=adaptor_distance_from_table_edge, i_2=robot_placement, d1=custom_z_offset, d2=custom_x_offset, i=fixture_in_use)  # -> G, adaptorplate_2, G_2, fixture_z, fixture_x, i_4, i_3

# ---- group: Fully Custom Tool
dfl_custom_pen = DFLCustomPen(
    d1=name_of_pen_2,
    preview_colour=preview_colour_2,
    length=pen_length,
    dia=pen_dia,
    weight=pen_weight_kg,
    tip_dia=tip_dia_mm,
    speed=speed,
    nib_height=nib_height,
    hatch_angle=hatch_angle_3,
    hatch_frequency=line_gap_3,
    pressure=pen_pressure,
    retract_height=retract_height)

# ----
dfl_stabilo_mini_basic = DFLStabiloMiniBasic()

re_generate = Button()

# ---- group: Place holder content
crv = Curve([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])

# ----
panel = Panel("""662.12,-119.64,3.88
336.37,-119.8,1.97
336.76,120.8,3.13
665.19,122.35,5.14""")

cluster = Cluster(M=dfl_ur_fixutres.G, C=dfl_ur_fixutres.G)  # -> M_2, path_2
table = CustomPreview(Geometry=dfl_ur_fixutres.G, Material=ColourSwatch(SwatchColor=RGBA(217, 185, 126, 200)))
fixture = CustomPreview(Geometry=[dfl_ur_fixutres.i_4, dfl_ur_fixutres.i_3], Material=ColourSwatch(SwatchColor=RGB(214, 214, 214)))
mounts = CustomPreview(Geometry=[dfl_ur_fixutres.adaptorplate_2, dfl_ur_fixutres.G_2], Material=ColourSwatch(SwatchColor=RGB(152, 149, 158)))
previewmat = CustomPreviewMaterials(Geometry=cluster.M_2, DiffuseColor=RGB(255, 255, 255), DiffuseBitmap=cluster.path_2)

# ---- group: Paper Size
width_y = Slider(210, range=0..420)
length_x = Slider(297, range=0..420)

# ----
x_distance_from_robot = Panel(dfl_ur_fixutres.fixture_x)
fixtureheight_z = Panel(dfl_ur_fixutres.fixture_z)
dfl_paper_setup = DFLPaperSetup(A_2=length_x, A_3=width_y, X=x_distance_from_robot, A=fixtureheight_z)  # -> I_2, I, P

# ---- group: 4 point Calibration
_4_point_calibration_x_y_z = Panel("")
dfl_4_point_calibration = DFL4PointCalibration(L=_4_point_calibration_x_y_z, G=dfl_paper_setup.P)

# ----
ideal_paper_plane = Plane(dfl_paper_setup.P)
calibrated_plane = Plane(dfl_4_point_calibration)
paper_plane = Plane(ideal_paper_plane)

layer_name_case_sensitive = Panel("Cyan")
strokes = BooleanToggle(False)
fills = BooleanToggle(True)
dfl_drawing_import = DFLDrawingImport(
    run=re_generate,
    paper_plane=ideal_paper_plane,
    tool_data=dfl_custom_pen,
    layer_name=layer_name_case_sensitive,
    curves=strokes,
    fills=fills)

layer_name_case_sensitive_2 = Panel("Magenta")
strokes_2 = BooleanToggle(False)
fills_2 = BooleanToggle(True)
dfl_drawing_import_2 = DFLDrawingImport(
    run=re_generate,
    paper_plane=ideal_paper_plane,
    tool_data=dfl_stabilo_mini_2,
    layer_name=layer_name_case_sensitive_2,
    curves=strokes_2,
    fills=fills_2)

layer_name_case_sensitive_3 = Panel("Black")
strokes_3 = BooleanToggle(True)
fills_3 = BooleanToggle(False)
dfl_drawing_import_3 = DFLDrawingImport(
    run=re_generate,
    paper_plane=ideal_paper_plane,
    tool_data=dfl_stabilo_mini_basic,
    layer_name=layer_name_case_sensitive_3,
    gh_curves=crv,
    curves=strokes_3,
    fills=fills_3)

layer_name_case_sensitive_4 = Panel("Yellow")
strokes_4 = BooleanToggle(False)
fills_4 = BooleanToggle(True)
dfl_drawing_import_4 = DFLDrawingImport(
    run=re_generate,
    paper_plane=ideal_paper_plane,
    tool_data=dfl_stabilo_mini,
    layer_name=layer_name_case_sensitive_4,
    curves=strokes_4,
    fills=fills_4)

# ---- group: Opperations Order
layer_order = Entwine(
    Branch0X=dfl_drawing_import,
    Branch1X=dfl_drawing_import_2,
    Branch2X=dfl_drawing_import_4,
    Branch3X=dfl_drawing_import_3,
    FlattenInputs=False)  # -> simplify(Result)

# ---- group: Fills as Srfs
split = SplitTree(Data=layer_order, Masks=flatten("{?;2}"))  # -> Positive, Negative

# ---- group: Tool Data
split_2 = SplitTree(Data=layer_order, Masks="{?;0}")  # -> Positive, Negative

# ---- group: Section
# Template Elements
branch = TreeBranch(Tree=simplify(split_2.Positive), Path="{0}", MaintainPaths=True)
tool_data_index = Panel(branch)

# ---- group: Robot Setup + initial pose
# Robot Setup
list = RobotsLibrary(
    {"DFL - UR5", "DFL- UR5 + Turntable", "DFL - KR70", "UR3e", "UR5e", "UR10e", "UR16e", "UR3", "UR5", "UR10"}, selected="UR5",
    Type=0)
inital_pose_axis_values_in_degrees = Panel("""0
-50
-80
-90
90
0""")
loadrobot = LoadRobotSystem(Name=list, Base=PlaneXY(0, 0, 0))
degrees_to_radians = DegreesToRadians(Degrees=inital_pose_axis_values_in_degrees, RobotSystem=loadrobot, MechanicalGroup=0)
controlled_speed = ListItem(List=split_2.Positive, Index=1, Wrap=True)

# ----
name_order = NameOrder(L=split_2.Positive)
pen_weight = ListItem(List=split_2.Positive, Index=2, Wrap=True)
tcp = ListItem(List=split_2.Positive, Index=5, Wrap=True)
tool_mesh = ListItem(List=split_2.Positive, Index=6, Wrap=True)

create_tool = CreateTool(Name=flatten(name_order), TCP=flatten(tcp), Weight=flatten(pen_weight), Mesh=flatten(tool_mesh))  # -> Tool, TCP
tool_centre_point = Panel(create_tool.TCP)

# ---- group: Drawing Curves
split_3 = SplitTree(Data=layer_order, Masks=flatten("{?;1}"))  # -> Positive, Negative

# ----
srf = Surface(split.Positive)

# ---- group: Make Hatches
hatch_freqency = ListItem(List=split_2.Positive, Index=9, Wrap=True)  # -> simplify(Item)
hatch_angle_6 = ListItem(List=split_2.Positive, Index=8, Wrap=True)
pen_tip_dia = ListItem(List=split_2.Positive, Index=3, Wrap=True)
dfl_linear_hatch = DFLLinearHatch(C=srf, G=ideal_paper_plane, tip_dia=hatch_freqency, hatch_gap=pen_tip_dia, A=degrees(hatch_angle_6))
dfl_trim_fills = DFLTrimFills(boundary_srf=simplify(srf), curves=dfl_linear_hatch)

# ---- group: Control points (should not exeed 10,000)
cp = ControlPoints(Curve=flatten([split_3.Positive, dfl_trim_fills]))  # -> flatten(Points), Weights, Knots
lng = ListLength(List=cp.Points)
number_of_points = Panel(lng)

# ---- group: Create Transfer Planes
retact_height = ListItem(List=split_2.Positive, Index=11, Wrap=True)
offpln = OffsetPlane(Plane=paper_plane, Distance=retact_height, BothSides=0, OffsetX=False, OffsetY=False, OffsetZ=True)
pen_transfer_plane = Plane(offpln)

# ---- group: Create Pressure planes
pen_pressure_2 = ListItem(List=split_2.Positive, Index=10, Wrap=True)
multiplication = Multiplication(A=pen_pressure_2, B=-1)
offpln_2 = OffsetPlane(Plane=paper_plane, Distance=multiplication, BothSides=0, OffsetX=False, OffsetY=False, OffsetZ=True)
pen_pressed_plane = Plane(offpln_2)

# ---- group: Drawing Preview
tool_preview_colour = ListItem(List=split_2.Positive, Index=4, Wrap=True)  # -> simplify(Item)

# ----
layer_name = ListItem(List=split_2.Positive, Index=0, Wrap=True)  # -> Item1, Item
pen_name = ListItem(List=split_2.Positive, Index=0, Wrap=True)
pen_change_pose_av_degrees = Panel("""24.38
-106.28
-87.02
-168.27
24.22
46.25""")
concat = Concatenate(
    FragmentA=pen_name,
    FragmentB=name_of_pen_2,
    FragmentD=" for ",
    FragmentE=layer_name.Item1,
    FragmentC=" layer and click continue to resume")
concat_2 = Concatenate(FragmentB=layer_name.Item1, FragmentC="_change")
popup_title_no_spaces = Panel(concat_2)
popup_text = Panel(concat)
degrees_to_radians_2 = DegreesToRadians(Degrees=pen_change_pose_av_degrees, RobotSystem=loadrobot, MechanicalGroup=0)
dfl_ur_custom_popup = DFLURCustomPopup(N=popup_title_no_spaces, B=popup_text)
create_target = CreateTarget(
    Joints=degrees_to_radians_2,
    Tool=flatten(create_tool.Tool),
    Speed=transfer_speed,
    Command=flatten(dfl_ur_custom_popup),
    IsCartesian=False)

# ----
# Robotic Commands
popup_title_no_spaces_2 = Panel("Operator_Safety")
popup_text_2 = Panel(instructions_for_ur_operator)
dfl_ur_custom_popup_2 = DFLURCustomPopup(N=popup_title_no_spaces_2, B=popup_text_2)
first_tool = ListItem(List=flatten(create_tool.Tool), Index=0, Wrap=True)
create_target_2 = CreateTarget(Joints=degrees_to_radians, Tool=first_tool, Speed=transfer_speed, Command=dfl_ur_custom_popup_2, IsCartesian=False)

# ---- group: Job Done
popup_title_no_spaces_3 = Panel("Job_Done")
popup_text_3 = Panel("Job Complete! Please put all the caps back on the pens and tidy up!")
rev = ReverseList(List=flatten(create_tool.Tool))
list_item = ListItem(List=flatten(rev), Index=0, Wrap=True)  # -> Item1, Item
custom_popup = CustomPopup(N=popup_title_no_spaces_3, B=popup_text_3, D=popup_title_no_spaces_3)
create_target_3 = CreateTarget(
    Joints=degrees_to_radians,
    Tool=list_item.Item,
    Speed=transfer_speed,
    Zone=zone_accuracy,
    Command=custom_popup,
    IsCartesian=False)

# ----
save_as_urp = Button()

# ---- group: Save URP / Save a Backup
select_backup_directory = FilePath("/Users/z3528358/Documents/GitHub/DR/Script Archive/")
backup = Panel(select_backup_directory)

# ---- group: Save URP / Program Name
panel_2 = Panel("BENV 2001")

# ----
ur_colour = URColour()

# ---- group: Save URP
rec = DataRecorder(save_as_urp, DataLimit=-10, RecordData=True)
increment_on_save = IncrementOnSave(L=rec, Panel=rec, T=panel_2)
next_file_name = Panel(increment_on_save)

# ---- group: Paper Preview
rectangle = Rectangle(Plane=ideal_paper_plane, XSize=dfl_paper_setup.I_2, YSize=dfl_paper_setup.I, Radius=0)  # -> Rectangle, Length
paper_outline = ColourSwatch(SwatchColor=RGB(33, 19, 19))
fillet = Fillet(Curve=rectangle.Rectangle, Radius=1)

# ----
# Path Planning
weave = Weave(Pattern=[0, 1], Stream0=split_3.Positive, Stream1=dfl_trim_fills, NullGaps=False)
clean = CleanTree(RemoveNulls=True, RemoveInvalid=True, RemoveEmpty=False, Tree=weave)

# ---- group: Re Calculate
dam = DataDam(DataA=clean, BufferDelay=2500000, BufferMode=0)

# ---- group: Move To Paper
paper_plane_2 = Plane(pen_pressed_plane)
join = JoinCurves(Curves=dam, Preserve=False)
bbox = BoundingBox(Content=flatten(join), Plane=paper_plane_2, UnionBox=True)  # -> Box, Box_2
project = Project(Geometry=join, Plane=paper_plane_2)  # -> Geometry, Transform
area = Area(Geometry=bbox.Box)  # -> Area, Centroid
move2pt = MoveToPoint(Geometry=project.Geometry, PointA=area.Centroid, PointB=paper_plane)  # -> Moved, Vector, Transform

# ---- group: Paper Preview (continued)
move2pt_2 = MoveToPoint(Geometry=fillet, PointA=ideal_paper_plane, PointB=area.Centroid)  # -> Moved, Vector, Transform
previewlw = CustomPreviewLineweights(Geometry=[fillet, move2pt_2.Moved], Shader=paper_outline, Absolute=True)

# ---- group: Custom Preview Lineweights
project_2 = Project(Geometry=move2pt.Moved, Plane=ideal_paper_plane)  # -> Geometry, Transform
previewlw_2 = CustomPreviewLineweights(Geometry=simplify(project_2.Geometry), Shader=tool_preview_colour, Absolute=False)

# ----
transfer_plane = Plane(pen_transfer_plane)
dfl_add_leads = DFLAddLeads(transfer_plane=transfer_plane, curves=move2pt.Moved)

dfl_curves_to_planes = DFLCrvToPln(B=paper_plane, C=dfl_add_leads, td=Slider(0.01, range=0..10))

pen_tilt = Slider(0, range=0..45)
list_2 = ValueList({"0 deg": 0, "90 deg": 90, "180 deg": 180, "270 deg": 270, "360 deg": 360}, selected="90 deg")
list_3 = ValueList({"x": 0, "y": 1, "z": 2}, selected="z")
dfl_re_orient_planes = DFLReOrientPlanes(planes=dfl_curves_to_planes, rotation_axis=list_3, fine_adjustment=pen_tilt, quad_rotate=list_2)

pen_tilt_2 = Slider(0, range=0..45)
list_4 = ValueList({"0 deg": 0, "90 deg": 90, "180 deg": 180, "270 deg": 270, "360 deg": 360}, selected="180 deg")
list_5 = ValueList({"x": 0, "y": 1, "z": 2}, selected="x")
dfl_re_orient_planes_2 = DFLReOrientPlanes(planes=dfl_re_orient_planes, rotation_axis=list_5, fine_adjustment=pen_tilt_2, quad_rotate=list_4)

pln = Plane(dfl_re_orient_planes_2)

# ---- group: Number of planes (should not exeed 40,000)
lng_2 = ListLength(List=flatten(pln))
number_of_points_2 = Panel(lng_2)

# ---- group: Make Linear Movements
controlled_speed_2 = Panel(controlled_speed)
list_6 = ValueList({"Joint", "Linear"}, selected="Linear")
trim = TrimTree(Tree=pln, Depth=1)
create_target_4 = CreateTarget(
    Plane=trim,
    Motion=list_6,
    Tool=create_tool.Tool,
    Speed=simplify(controlled_speed_2),
    Zone=zone_accuracy,
    IsCartesian=True)

# ---- group: Order Toolpaths
weave_2 = Weave(Pattern=[0, 1], Stream0=graft(create_target), Stream1=create_target_4, NullGaps=False)  # -> flatten(Weave)
merge = Merge(Data1=create_target_2, Data2=weave_2, Data3=create_target_3)  # -> flatten(Result)

# ----
# Simulate
create_program = CreateProgram(Name=next_file_name, RobotSystem=loadrobot, Targets=merge, StepSize=1)  # -> Program, Code, Duration, Warnings, Errors
sim_slider = Slider(1, range=0..1)
program_simulation = ProgramSimulation(Program=create_program.Program, Time=sim_slider, Normalized=True)  # -> SystemMeshes, JointRotations, Plane, Index, Time, flatten(Program), Errors
tool_colour = ColourSwatch(SwatchColor=RGB(92, 92, 92))
split_4 = SplitList(List=program_simulation.SystemMeshes, Index=7)  # -> ListA, ListB
custom_preview = CustomPreview(Geometry=split_4.ListA, Material=ur_colour)

# ----
# Analysis
any_program_warnings = Panel(create_program.Warnings)
any_program_errors = Panel(create_program.Errors)
duration = Panel(create_program.Duration)
degrees = Degrees(Radians=graft(program_simulation.JointRotations))  # -> simplify(Degrees)
each_axis_rotation_analysis = Panel(degrees)

# ---- group: Dynamic Camera Person
robot_tcp_to_target = Slider(7, range=1..7)
lense_length = Slider(61, range=1..150)
item = ListItem(List=program_simulation.Plane, Index=robot_tcp_to_target, Wrap=True)
mod_viewport = ModifyViewport(ViewportName="Camera_Person", CameraTarget=item, CameraLensLength=lense_length, AnimateRestore=False, RestoreFrames=10)

# ---- group: Colour Swatch
trail = SimpleTrail(Program=program_simulation.Program, Length=500, MechanicalGroup=0)

# ---- group: Save URP
select_directory = FilePath("/Volumes/RB/UR/")
set_as_your_usb_drive = Panel(select_directory)
dispatch = Dispatch(List=[set_as_your_usb_drive, backup], DispatchPattern=save_as_urp)  # -> ListA, ListB
saveprog = SaveProgram(Program=create_program.Program, Folder=dispatch.ListA)

# ----
custom_preview_2 = CustomPreview(Geometry=flatten([split_4.ListB, trail]), Material=tool_colour)

# ==== cluster IncrementOnSave
panel = Panel(ClusterInput())
T = ClusterInput()
rep = ReplaceText(Text=T, Find=" ", Replace="_", RecursiveReplace=False)
L = ClusterInput()
lng = ListLength(List=L)
division = Division(A=lng, B=2)
round = Round(Number=division)  # -> Nearest, Floor, Ceiling
panel_2 = Panel(round.Ceiling)
concat = Concatenate(FragmentA=rep, FragmentC="_", FragmentB=panel_2)
R = ClusterOutput(concat)

# ==== cluster DFLCustomPen
d1 = ClusterInput()
preview_colour = ClusterInput()
length = ClusterInput()
dia = ClusterInput()
weight = ClusterInput()
speed = ClusterInput()
tip_dia = ClusterInput()
mesh = Mesh(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)
pen_length_offset = Panel("1.5")
pen_v_block_offset_mm = Panel("16")
holder_weight = Panel(".133")
division = Division(A=dia, B=2)
pt = ConstructPoint(XCoordinate=division, YCoordinate=division, ZCoordinate=0)
addition = Addition(A=holder_weight, B=weight)
xy = XYPlane(Origin=pt)
cir = Circle(Plane=xy, Radius=division)
subtraction = Subtraction(A=length, B=pen_length_offset)
pt_2 = Point(Point(0, 0, 0))
pt_3 = ConstructPoint(XCoordinate=0, YCoordinate=0, ZCoordinate="1")
ln = Line(StartPoint=pt_2, EndPoint=pt_3)
rotax = RotateAxis(Geometry=cir, Angle=degrees("45"), Axis=ln)  # -> Geometry, Transform
pt_4 = ConstructPoint(XCoordinate="1", YCoordinate=0, ZCoordinate=0)
ln_2 = Line(StartPoint=pt_2, EndPoint=pt_4)
rotax_2 = RotateAxis(Geometry=rotax.Geometry, Angle=degrees("90"), Axis=ln_2)  # -> Geometry, Transform
pt_5 = ConstructPoint(XCoordinate=0, YCoordinate=subtraction, ZCoordinate=pen_v_block_offset_mm)
move = Move(Geometry=rotax_2.Geometry, Motion=pt_5)  # -> Geometry, Transform
pt_6 = ConstructPoint(XCoordinate=0, YCoordinate=0, ZCoordinate="1")
ln_3 = Line(StartPoint=pt_2, EndPoint=pt_6)
range = Range(Domain="0 to 1", Steps="3")
rotax_3 = RotateAxis(Geometry=move.Geometry, Angle=degrees("-45"), Axis=ln_3)  # -> Geometry, Transform
pen_visulaization_hack = GraphMapper(range, x0=0, x1=1, y0=0, y1=1, container_name="Bezier", cpx=[0, 0.1894655079, 0, 1], cpy=[0, 0.6900714636, 1, 1])
area = Area(Geometry=rotax_3.Geometry)  # -> Area, Centroid
pdecon = Deconstruct(Point=area.Centroid)  # -> XComponent, YComponent, ZComponent
merge = Merge(Data1=division, Data2=division, Data3=tip_dia, Data4=tip_dia)
pt_7 = ConstructPoint(XCoordinate=0, YCoordinate=0, ZCoordinate=pdecon.ZComponent)
ln_4 = Line(StartPoint=pt_7, EndPoint=area.Centroid)
vpipe = PipeVariable(Curve=ln_4, Parameters=pen_visulaization_hack, Radii=merge, Caps=2)
mesh_2 = MeshBrep(
    Brep=vpipe,
    Settings={GridMaxCount=0, GridMinCount=16, JaggedSeams=False, MaxEdgeLength=0, MinEdgeLength=0.0001, MinTolerance=0, Refine=True, RefineAngle=0, RelativeTolerance=0.65, SimplePlanes=True, Tolerance=0})
pframes = PerpFrames(Curve=ln_4, Count="1", Align=True)  # -> Frames, Parameters
munion = MeshUnion(Meshes=flatten([mesh, mesh_2]))
item = ListItem(List=pframes.Frames, Index=1, Wrap=True)
data = Data(preview_colour)
num = Number(speed)
num_2 = Number(tip_dia)
num_3 = Number(addition)
hatch_frequency = ClusterInput()
hatch_angle = ClusterInput()
retract_height = ClusterInput()
pressure = ClusterInput()
nib_height = ClusterInput()
pln = Plane(flatten(item))
mesh_3 = Mesh(munion)
merge_2 = Merge(
    Data1=d1,
    Data2=num,
    Data3=num_3,
    Data4=num_2,
    Data5=data,
    Data6=pln,
    Data7=mesh_3,
    Data8=nib_height,
    Data9=hatch_angle,
    Data10=hatch_frequency,
    Data11=pressure,
    Data12=retract_height)  # -> flatten(Result)
tool_data = ClusterOutput(merge_2)
panel = Panel(merge_2)

# ==== cluster CustomPopup
B = ClusterInput()
D = ClusterInput()
N = ClusterInput()
concat = Concatenate(
    FragmentA="popup (\"",
    FragmentB=B,
    FragmentC="\", title=\"",
    FragmentD=D,
    FragmentE="\", warning=False, error=False, blocking=True)")
customcmd = CustomCommand(Name=N, Manufacturer="UR", Code=concat)
C = ClusterOutput(customcmd)

# ==== cluster DFL4PointCalibration
L = ClusterInput()
G = ClusterInput()
item = ListItem(List=L, Index=0, Wrap=True)  # -> Item, Item1, Item2, Item3
plfit = PlaneFit(Points=L)  # -> Plane, Deviation
srf4pt = _4PointSurface(CornerA=item.Item, CornerB=item.Item1, CornerC=item.Item2, CornerD=item.Item3)
flippln = FlipPlane(Plane=plfit.Plane, Guide=G, FlipX=False, FlipY=False, FlipZ=True)  # -> Flipped, R
area = Area(Geometry=srf4pt)  # -> Area, Centroid
move2pt = MoveToPoint(Geometry=flippln.Flipped, PointA=flippln.Flipped, PointB=area.Centroid)  # -> Moved, Vector, Transform
M = ClusterOutput(move2pt.Moved)

# ==== cluster DFLPaperSetup
A = ClusterInput()
A_2 = ClusterInput()
A_3 = ClusterInput()
X = ClusterInput()
subtraction = Subtraction(A=A, B=15)
multiplication = Multiplication(A=A_3, B=-0.5)
multiplication_2 = Multiplication(A=A_3, B=0.5)
multiplication_3 = Multiplication(A=A_2, B=-0.5)
multiplication_4 = Multiplication(A=A_2, B=0.5)
pt = ConstructPoint(XCoordinate=X, YCoordinate=0, ZCoordinate=subtraction)
dom = ConstructDomain(DomainStart=multiplication, DomainEnd=multiplication_2)
dom_2 = ConstructDomain(DomainStart=multiplication_3, DomainEnd=multiplication_4)
xy = XYPlane(Origin=pt)
I = ClusterOutput(dom)
I_2 = ClusterOutput(dom_2)
P = ClusterOutput(xy)

# ==== cluster DFLDrawingImport
run = ClusterInput()
layer_name = ClusterInput()
gh_curves = ClusterInput()
paper_plane = ClusterInput()
tool_data = ClusterInput()
curves = ClusterInput()
fills = ClusterInput()
merge = Merge(Data1=tool_data, Data2=layer_name)
filter = StreamFilter(Gate=run, Stream0="curve")
filter_2 = StreamFilter(Gate=run, Stream0="curve")
filter_3 = StreamFilter(Gate=run, Stream0=merge)
addition = Addition(A=curves, B=fills)
filter_4 = StreamFilter(Gate=fills, Stream1=filter)
filter_5 = StreamFilter(Gate=curves, Stream1=filter_2)
dpipeline = DynamicGeometryPipeline(
    LayerFilter=graft(layer_name),
    TypeFilter=filter_4,
    NameFilter="*",
    GroupByLayer=False,
    GroupByType=False,
    IncludeHidden=True,
    IncludeLocked=True,
    enableFullPath=True,
    listenToAttributes=True)  # -> simplify(GeometryOut)
dpipeline_2 = DynamicGeometryPipeline(
    LayerFilter=graft(layer_name),
    TypeFilter=filter_5,
    NameFilter="*",
    GroupByLayer=False,
    GroupByType=False,
    IncludeHidden=True,
    IncludeLocked=True,
    enableFullPath=True,
    listenToAttributes=True)  # -> simplify(GeometryOut)
merge_2 = Merge(Data1=dpipeline_2, Data2=gh_curves)  # -> flatten(Result)
merge_3 = Merge(Data1=dpipeline, Data2=gh_curves)  # -> flatten(Result)
clean = CleanTree(RemoveNulls=True, RemoveInvalid=True, RemoveEmpty=True, Tree=merge_3)
clean_2 = CleanTree(RemoveNulls=True, RemoveInvalid=True, RemoveEmpty=True, Tree=merge_2)
project = Project(Geometry=clean, Plane=paper_plane)  # -> Geometry, Transform
project_2 = Project(Geometry=clean_2, Plane=paper_plane)  # -> Geometry, Transform
crv = Curve(flatten(project.Geometry))
crv_2 = Curve(flatten(project_2.Geometry))
filter_6 = StreamFilter(Gate=curves, Stream1=crv)
filter_7 = StreamFilter(Gate=addition, Stream1=filter_3, Stream2=filter_3)
merge_4 = Merge(Data1=crv_2, Data2=filter_6)
boundary = BoundarySurfaces(Edges=crv)
entwine = Entwine(Branch0X=filter_7, Branch1X=merge_4, Branch2X=boundary, FlattenInputs=False)  # -> simplify(Result)
tool_with_curves = ClusterOutput(entwine)

# ==== cluster DFLLinearHatch
A = ClusterInput()
C = ClusterInput()
G = ClusterInput()
rotate = Rotate(Geometry=G, Angle=degrees(A), Plane=G)  # -> simplify(Geometry), Transform
bbox = BoundingBox(Content=C, Plane=rotate.Geometry, UnionBox=False)  # -> Box, Box_2
debrep = DeconstructBrep(Brep=bbox.Box)  # -> Faces, Edges, Vertices
tip_dia = ClusterInput()
hatch_gap = ClusterInput()
item = ListItem(List=debrep.Edges, Index=0, Wrap=True)  # -> Item, Item1
panel = Panel(tip_dia)
addition = Addition(A=tip_dia, B=hatch_gap)
crv = Curve(item.Item)
crv_2 = Curve(item.Item1)
end = EndPoints(Curve=crv_2)  # -> Start, End
divdist = DivideDistance(Curve=crv, Distance=addition)  # -> Points, Tangents, Parameters
move2pt = MoveToPoint(Geometry=crv_2, PointA=end.Start, PointB=divdist.Points)  # -> Moved, Vector, Transform
trimmed_curves = ClusterOutput(move2pt.Moved)

# ==== cluster DFLTrimFills
boundary_srf = ClusterInput()
pt = Point(Point(0, 0, 1))
pt_2 = Point(Point(0, 0, -0.5))
extr = Extrude(Base=boundary_srf, Direction=pt)
move = Move(Geometry=extr, Motion=pt_2)  # -> Geometry, Transform
trim = TrimTree(Tree=move.Geometry, Depth=1)
curves = ClusterInput()
trim_2 = TrimWithBrep(Curve=curves, Brep=graft(move.Geometry))  # -> Inside, Outside
trim_3 = TrimTree(Tree=trim_2.Inside, Depth="4")
T = ClusterOutput(trim_3)

# ==== cluster DFLURFixutres
turntablebase = Mesh(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)
drawing_table = Mesh(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)
turntable = Mesh(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)
zoffset = Panel("34.8")
zoffset_2 = Panel("19")
mesh = Mesh(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)
zoffset_3 = Panel("0")
d1 = ClusterInput()
d2 = ClusterInput()
carttrack = Mesh([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])
carttabletop = Mesh(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)
tabletop = Mesh(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)
merge = Merge(Data1=zoffset_2, Data2="500", Data3=drawing_table, Data4=mesh)
tabletrack = Mesh([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])
merge_2 = Merge(Data1=zoffset, Data2="500", Data3=turntablebase, Data4=turntable)
merge_3 = Merge(Data1=d1, Data2=d2, Data3=mesh, Data4=mesh)
merge_4 = Merge(Data1=carttabletop, Data2=flatten(carttrack))
merge_5 = Merge(Data1=tabletop, Data2=flatten(tabletrack))
merge_6 = Merge(Data1=graft(merge_3), Data2=graft(merge), Data3=graft(merge_2))
i = ClusterInput()
merge_7 = Merge(Data1=graft(merge_4), Data2=graft(merge_5))
i_2 = ClusterInput()
item = ListItem(List=merge_6, Index=i, Wrap=True)
item_2 = ListItem(List=merge_7, Index=i_2, Wrap=True)
A = ClusterInput()
tabletop_2 = ListItem(List=flatten(item_2), Index=0, Wrap=True)
track = ListItem(List=flatten(item_2), Index=1, Wrap=True)
track_2 = ListItem(List=flatten(item_2), Index=2, Wrap=True)
tabletop_3 = ListItem(List=flatten(item), Index=0, Wrap=False)
track_3 = ListItem(List=flatten(item), Index=1, Wrap=False)
track_4 = ListItem(List=flatten(item), Index=2, Wrap=False)
track_5 = ListItem(List=flatten(item), Index=3, Wrap=False)
multiplication = Multiplication(A=A, B=-1)
i_3 = ClusterOutput(track_5)
fixture_z = ClusterOutput(tabletop_3)
fixture_x = ClusterOutput(track_3)
i_4 = ClusterOutput(track_4)
adaptorplate = Mesh(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)
pt = ConstructPoint(XCoordinate=multiplication, YCoordinate=0, ZCoordinate=0)
move = Move(Geometry=tabletop_2, Motion=pt)  # -> Geometry, Transform
move_2 = Move(Geometry=[track, track_2], Motion=pt)  # -> Geometry, Transform
G = ClusterOutput(move.Geometry)
adaptorplate_2 = ClusterOutput(adaptorplate)
G_2 = ClusterOutput(move_2.Geometry)

# ==== cluster Cluster
C = ClusterInput()
M = ClusterInput()
bbox = BoundingBox(Content=C, Plane=PlaneXY(0, 0, 0))  # -> Box, Box_2
path = FilePath("/Users/z3528358/Documents/GitHub/DR/Assets/oak.bmp")
debrep = DeconstructBrep(Brep=bbox.Box)  # -> Faces, Edges, Vertices
path_2 = ClusterOutput(path)
number_slider = Slider(3, range=0..10)
item = ListItem(List=debrep.Edges, Index=7, Wrap=True)
bbox_2 = BoundingBox(Content=C, Plane=PlaneXY(0, 0, 0))  # -> Box, Box_2
len = Length(Curve=item)
debrep_2 = DeconstructBrep(Brep=bbox_2.Box)  # -> Faces, Edges, Vertices
item_2 = ListItem(List=debrep_2.Edges, Index=0, Wrap=True)
division = Division(A=len, B=number_slider)
len_2 = Length(Curve=item_2)
division_2 = Division(A=len_2, B=number_slider)
dom = ConstructDomain(DomainStart=0, DomainEnd=division)
dom_2 = ConstructDomain(DomainStart=0, DomainEnd=division_2)
xy = XYPlane(Origin=Point(0, 0, 0))
planarmap = PlanarMapping(Mesh=M, Plane=xy, XExtents=dom_2, YExtents=dom)  # -> MappedMesh, MappingPlane
M_2 = ClusterOutput(planarmap.MappedMesh)

# ==== cluster DFLURCustomPopup
N = ClusterInput()
B = ClusterInput()
concat = Concatenate(
    FragmentA="popup (\"",
    FragmentB=B,
    FragmentC="\", title=\"",
    FragmentD=N,
    FragmentE="\", warning=False, error=False, blocking=True)")
customcmd = CustomCommand(Name=N, Manufacturer="UR", Code=concat)
C = ClusterOutput(customcmd)

# ==== cluster DFLAddLeads
curves = ClusterInput()
transfer_plane = ClusterInput()

# ---- group: Lead In and Out
join = JoinCurves(Curves=curves, Preserve=False)
opncrv = OpenCurve(Curve=join, Length=0.001, Normalized=False, Seam=0)  # -> Opened, R
end = EndPoints(Curve=opncrv.Opened)  # -> Start, End
project = Project(Geometry=end.Start, Plane=transfer_plane)  # -> Geometry, Transform
project_2 = Project(Geometry=end.End, Plane=transfer_plane)  # -> Geometry, Transform
ln = Line(StartPoint=project_2.Geometry, EndPoint=end.End)
ln_2 = Line(StartPoint=project.Geometry, EndPoint=end.Start)
weave = Weave(Pattern=[0, 1, 2], Stream0=ln_2, Stream1=opncrv.Opened, Stream2=ln, NullGaps=False)
join_2 = JoinCurves(Curves=weave, Preserve=False)  # -> simplify(Curves)

# ----
curves_with_leads = ClusterOutput(join_2)

# ==== cluster DFLCrvToPln: Turns Curves to Polylines, then divides Curved Sections Basesd on a tollarance input, Positions a plane at each point
C = ClusterInput()
td = ClusterInput()
topoly = CurveToPolyline(Curve=C, ToleranceDistance=td, ToleranceAngle=0)  # -> Polyline, Segments
cp = ControlPoints(Curve=topoly.Polyline)  # -> simplify(Points), Weights, Knots
B = ClusterInput()
pl_origin = PlaneOrigin(Base=B, Origin=cp.Points)  # -> simplify(Plane)
pl = ClusterOutput(pl_origin)

# ==== cluster URColour
robot_colour = ColourSwatch(SwatchColor=RGB(0, 0, 0))
robot_colour_2 = ColourSwatch(SwatchColor=RGB(176, 197, 214))
material = CreateMaterial(Diffuse=robot_colour_2, Specular=robot_colour_2, Emission=robot_colour, Transparency=0, Shine="50")
M = ClusterOutput(material)

# ==== cluster DFLStabiloMiniBasic

# ---- group: Set Up Pen / Tool
tip_dia_mm = Panel("0.3")
name_of_pen = Panel("DFL_Stabillo_mini_basic")
pen_length = Slider(107, range=1..250)
pen_dia = Slider(7.5, range=6..16)
speed = Slider(100, range=1..100)
nib_height = Panel("1")
preview_colour = ColourSwatch(SwatchColor=RGB(0, 0, 0))
pen_weight_kg = Panel(".01")

hatch_angle = Slider(0, range=-90..90)
pen_pressure = Slider(1, range=0..8)
line_gap = Slider(0.3, range=0..10)
retract_height = Slider(4, range=0..8)

dfl_custom_pen = DFLCustomPen(
    d1=name_of_pen,
    preview_colour=preview_colour,
    length=pen_length,
    dia=pen_dia,
    weight=pen_weight_kg,
    tip_dia=tip_dia_mm,
    speed=speed,
    nib_height=nib_height,
    hatch_angle=hatch_angle,
    hatch_frequency=line_gap,
    pressure=pen_pressure,
    retract_height=retract_height)

# ----
tool_data = ClusterOutput(dfl_custom_pen)

# ==== cluster DFLSharpieBasic

# ---- group: Set Up Pen / Tool
tip_dia_mm = Panel(".8")
name_of_pen = Panel("DFL_Sharpie_Basic")
pen_length = Slider(123.4, range=1..250)
pen_dia = Slider(8, range=6..16)
speed = Slider(100, range=1..100)
nib_height = Panel("1")
preview_colour = ColourSwatch(SwatchColor=RGB(0, 0, 0))
pen_weight_kg = Panel(".01")

hatch_angle = Slider(0, range=-90..90)
pen_pressure = Slider(1, range=0..8)
line_gap = Slider(1, range=0..10)
retract_height = Slider(4, range=0..8)

dfl_custom_pen = DFLCustomPen(
    d1=name_of_pen,
    preview_colour=preview_colour,
    length=pen_length,
    dia=pen_dia,
    weight=pen_weight_kg,
    tip_dia=tip_dia_mm,
    speed=speed,
    nib_height=nib_height,
    hatch_angle=hatch_angle,
    hatch_frequency=line_gap,
    pressure=pen_pressure,
    retract_height=retract_height)

# ----
tool_data = ClusterOutput(dfl_custom_pen)

# ==== cluster DFLSharpie

# ---- group: Set Up Pen / Tool
tip_dia_mm = Panel(".8")
pen_length = Slider(123.4, range=1..250)
pen_dia = Slider(8, range=6..16)
speed = Slider(100, range=1..100)
nib_height = Panel("1")
pen_weight_kg = Panel(".01")

pen_pressure = Slider(1, range=0..8)
retract_height = Slider(4, range=0..8)

# ----
name = ClusterInput()
prev = ClusterInput()
speed_2 = ClusterInput()
hatch_freqency = ClusterInput()

# ---- group: Set Up Pen / Tool
dfl_custom_pen = DFLCustomPen(
    d1=name,
    preview_colour=prev,
    length=pen_length,
    dia=pen_dia,
    weight=pen_weight_kg,
    tip_dia=tip_dia_mm,
    speed=speed,
    nib_height=nib_height,
    hatch_angle=speed_2,
    hatch_frequency=hatch_freqency,
    pressure=pen_pressure,
    retract_height=retract_height)

# ----
tool_data = ClusterOutput(dfl_custom_pen)

# ==== cluster DFLPencil

# ---- group: Set Up Pen / Tool
tip_dia_mm = Panel("1")
name_of_pen = Panel("DR_Pencil")
speed = Slider(90, range=1..100)
nib_height = Panel("15")
preview_colour = ColourSwatch(SwatchColor=RGB(150, 150, 150))
pen_weight_kg = Panel(".01")

# ----
length = ClusterInput()
dia = ClusterInput()
speed_2 = ClusterInput()
hatch_freqency = ClusterInput()
tip_dia = ClusterInput()

# ---- group: Set Up Pen / Tool
retract_height = Slider(2, range=0..8)
dfl_custom_pencil = DFLCustomPencil(
    d1=name_of_pen,
    preview_colour=preview_colour,
    length=length,
    dia=dia,
    weight=pen_weight_kg,
    tip_dia=tip_dia_mm,
    speed=speed,
    nib_height=nib_height,
    hatch_angle=speed_2,
    hatch_frequency=hatch_freqency,
    pressure=tip_dia,
    retract_height=retract_height)

# ----
tool_data = ClusterOutput(dfl_custom_pencil)

# ==== cluster DFLStabiloMini

# ---- group: Set Up Pen / Tool
tip_dia_mm = Panel("0.3")
pen_length = Slider(107, range=1..250)
pen_dia = Slider(7.5, range=6..16)
speed = Slider(100, range=1..100)
nib_height = Panel("1")
pen_weight_kg = Panel(".01")

pen_pressure = Slider(1, range=0..8)
retract_height = Slider(4, range=0..8)

# ----
name = ClusterInput()
prev = ClusterInput()
speed_2 = ClusterInput()
hatch_freqency = ClusterInput()

# ---- group: Set Up Pen / Tool
dfl_custom_pen = DFLCustomPen(
    d1=name,
    preview_colour=prev,
    length=pen_length,
    dia=pen_dia,
    weight=pen_weight_kg,
    tip_dia=tip_dia_mm,
    speed=speed,
    nib_height=nib_height,
    hatch_angle=speed_2,
    hatch_frequency=hatch_freqency,
    pressure=pen_pressure,
    retract_height=retract_height)

# ----
tool_data = ClusterOutput(dfl_custom_pen)

# ==== cluster NameOrder
L = ClusterInput()
pen_name = ListItem(List=L, Index=0, Wrap=True)
lng = ListLength(List=flatten(pen_name))
dom = ConstructDomain(DomainStart=1, DomainEnd=expr("x", lng))
range = Range(Domain=dom, Steps=expr("x-1", lng))
concat = Concatenate(FragmentA=flatten(pen_name), FragmentC="_", FragmentB=range)
R = ClusterOutput(concat)

# ==== cluster DFLReOrientPlanes
planes = ClusterInput()
rotation_axis = ClusterInput()  # X=0 Y=1 Z=2
fine_adjustment = ClusterInput()
quad_rotate = ClusterInput()

deplane = DeconstructPlane(Plane=planes)  # -> Origin, XAxis, YAxis, ZAxis
filter = StreamFilter(Gate=rotation_axis, Stream0=deplane.XAxis, Stream1=deplane.YAxis, Stream2=deplane.ZAxis)
amp = Amplitude(Vector=filter, Amplitude="1")
move = Move(Geometry=deplane.Origin, Motion=amp)  # -> Geometry, Transform
ln = Line(StartPoint=deplane.Origin, EndPoint=move.Geometry)
addition = Addition(A=fine_adjustment, B=quad_rotate)
rotax = RotateAxis(Geometry=planes, Angle=degrees(addition), Axis=ln)  # -> Geometry, Transform

rotated_planes = ClusterOutput(rotax.Geometry)

# ==== cluster DFLCustomPencil
d1 = ClusterInput()
preview_colour = ClusterInput()
length = ClusterInput()
dia = ClusterInput()
weight = ClusterInput()
speed = ClusterInput()
tip_dia = ClusterInput()
mesh = Mesh(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)
pen_length_offset = Panel("1.5")
pen_v_block_offset_mm = Panel("16")
holder_weight = Panel(".133")
division = Division(A=dia, B=2)
pt = ConstructPoint(XCoordinate=division, YCoordinate=division, ZCoordinate=0)
addition = Addition(A=holder_weight, B=weight)
xy = XYPlane(Origin=pt)
cir = Circle(Plane=xy, Radius=division)
subtraction = Subtraction(A=length, B=pen_length_offset)
pt_2 = Point(Point(0, 0, 0))
pt_3 = ConstructPoint(XCoordinate=0, YCoordinate=0, ZCoordinate="1")
ln = Line(StartPoint=pt_2, EndPoint=pt_3)
rotax = RotateAxis(Geometry=cir, Angle=degrees("45"), Axis=ln)  # -> Geometry, Transform
pt_4 = ConstructPoint(XCoordinate="1", YCoordinate=0, ZCoordinate=0)
ln_2 = Line(StartPoint=pt_2, EndPoint=pt_4)
rotax_2 = RotateAxis(Geometry=rotax.Geometry, Angle=degrees("90"), Axis=ln_2)  # -> Geometry, Transform
pt_5 = ConstructPoint(XCoordinate=0, YCoordinate=subtraction, ZCoordinate=pen_v_block_offset_mm)
move = Move(Geometry=rotax_2.Geometry, Motion=pt_5)  # -> Geometry, Transform
pt_6 = ConstructPoint(XCoordinate=0, YCoordinate=0, ZCoordinate="1")
ln_3 = Line(StartPoint=pt_2, EndPoint=pt_6)
range = Range(Domain="0 to 1", Steps="2")
rotax_3 = RotateAxis(Geometry=move.Geometry, Angle=degrees("-45"), Axis=ln_3)  # -> Geometry, Transform
pen_visulaization_hack = GraphMapper(
    range,
    x0=0,
    x1=1,
    y0=0,
    y1=1,
    container_name="Bezier",
    cpx=[0, 0.003550653812, 0.2838807106, 1],
    cpy=[0, 0.6609072685, 0.9948297143, 1])
area = Area(Geometry=rotax_3.Geometry)  # -> Area, Centroid
pdecon = Deconstruct(Point=area.Centroid)  # -> XComponent, YComponent, ZComponent
merge = Merge(Data1=division, Data2=division, Data3=tip_dia)
pt_7 = ConstructPoint(XCoordinate=0, YCoordinate=0, ZCoordinate=pdecon.ZComponent)
ln_4 = Line(StartPoint=pt_7, EndPoint=area.Centroid)
vpipe = PipeVariable(Curve=ln_4, Parameters=pen_visulaization_hack, Radii=merge, Caps=2)
mesh_2 = MeshBrep(
    Brep=vpipe,
    Settings={GridMaxCount=0, GridMinCount=16, JaggedSeams=False, MaxEdgeLength=0, MinEdgeLength=0.0001, MinTolerance=0, Refine=True, RefineAngle=0, RelativeTolerance=0.65, SimplePlanes=True, Tolerance=0})
pframes = PerpFrames(Curve=ln_4, Count="1", Align=True)  # -> Frames, Parameters
munion = MeshUnion(Meshes=flatten([mesh, mesh_2]))
item = ListItem(List=pframes.Frames, Index=1, Wrap=True)
data = Data(preview_colour)
num = Number(speed)
num_2 = Number(tip_dia)
num_3 = Number(addition)
hatch_frequency = ClusterInput()
hatch_angle = ClusterInput()
retract_height = ClusterInput()
pressure = ClusterInput()
nib_height = ClusterInput()
pln = Plane(flatten(item))
mesh_3 = Mesh(munion)
merge_2 = Merge(
    Data1=d1,
    Data2=num,
    Data3=num_3,
    Data4=num_2,
    Data5=data,
    Data6=pln,
    Data7=mesh_3,
    Data8=nib_height,
    Data9=hatch_angle,
    Data10=hatch_frequency,
    Data11=pressure,
    Data12=retract_height)  # -> flatten(Result)
tool_data = ClusterOutput(merge_2)
panel = Panel(merge_2)
